# Grasshopper definition DiffcheckExportTest.ghx (Grasshopper 1.0.8)
# plug-ins: RhinoCodePluginGH

file_path = FilePath("C:\Users\eleni\Desktop\test")
brep = Brep(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)
dfxmlexporter = DFXMLExporter(i_dump=Button(), i_assembly_name="Assembly Test", i_export_dir=file_path, i_breps=brep)  # -> o_xml, o_joints, o_sides; inputs i_dump: Boolean, i_assembly_name: String, i_export_dir: String, i_breps: list of Brep
#   port i_dump: Press button to export xml
#   port i_assembly_name: The name of the assembly to export.
#   port i_export_dir: The directors where to export the xml file.
#   port i_breps: The breps of the structure.
#   port o_xml: The string of xml to be exported.
#   port o_joints: The breps of the faces belonging to joints.
#   port o_sides: The breps of the faces belonging to sides.
# ---------- dfxmlexporter: Python ----------
#! python3
# requirements: diffCheck

import System
import typing

import Rhino
import Rhino.Geometry as rg

from ghpythonlib.componentbase import executingcomponent as component

from diffCheck.df_geometries import DFVertex, DFFace, DFBeam, DFAssembly
import diffCheck.df_transformations
import diffCheck.df_joint_detector
import diffCheck.df_util


class DFXMLExporter(component):
    def RunScript(self,
            i_dump: bool,
            i_assembly_name: str,
            i_export_dir: str,
            i_breps: System.Collections.Generic.IList[Rhino.Geometry.Brep]):
        """
            This read breps from Rhino, converts them to DFBeams and DFAssemblies, and exports them to XML.
            
            :param i_dump: whether to dump the xml
            :param i_export_dir: directory to export the xml
            :param i_breps: list of breps
        """
        # beams
        beams : typing.List[DFBeam] = []
        for brep in i_breps:
            beam = DFBeam.from_brep(brep)
            beams.append(beam)

        # assembly
        assembly1 = DFAssembly(beams, i_assembly_name)

        # dump the xml
        xml : str = assembly1.to_xml()
        if i_dump:
            assembly1.dump(xml, i_export_dir)
        o_xml = xml

        # show the joint/side faces
        o_joints = [jf.to_brep() for jf in assembly1.all_joint_faces]
        o_sides = [sf.to_brep() for sf in assembly1.all_side_faces]

        return o_xml, o_joints, o_sides
# ---------- end dfxmlexporter ----------
