# Grasshopper definition diffcheckExport_rhino8.ghx (Grasshopper 1.0.8)
# plug-ins: RhinoCodePluginGH

# ----
# Additive
# 00 - Simple 2D Frame
panel = Panel("00_Additive")
ghpython_script = GhPythonScript(idx=Slider(0, range=0..10), folder_name=panel, export=Toggle(True))  # -> out, i_assembly_name, path; inputs export: Boolean
# ---------- ghpython_script: Python ----------
__author__ = "eleni"
__version__ = "2024.03.20"

import Rhino
import System
import scriptcontext
import sys
import os


HERE = ghenv.LocalScope.ghdoc.Path
path = os.path.abspath(os.path.join(HERE, '..', '..', folder_name + "/0" + idx))
i_assembly_name = "Add_" + "0" + idx
# ---------- end ghpython_script ----------
brep = Brep([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])
data = Data(ghpython_script.i_assembly_name)
file_path = FilePath(ghpython_script.path)

# ----
# 01 - Platonic Solid with Nodes + noise to avoid symmetry
panel_2 = Panel("00_Additive")
ghpython_script_2 = GhPythonScript(idx=Slider(1, range=0..10), folder_name=panel_2, export=Toggle(True))  # -> out, i_assembly_name, path; inputs export: Boolean; same code as ghpython_script
joints = Brep(flatten([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]))
beams = Brep(flatten([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]))
file_path_2 = FilePath(ghpython_script_2.path)
data_2 = Data(ghpython_script_2.i_assembly_name)
brep_2 = Brep([beams, joints])

# ----
# 02 - Reciprocal Frame
number_slider = Slider(2, range=0..10)
ghpython_script_3 = GhPythonScript(idx=number_slider, folder_name="00_Additive", export=Toggle(True))  # -> out, i_assembly_name, path; inputs export: Boolean; same code as ghpython_script
brep_3 = Brep([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])
data_3 = Data(ghpython_script_3.i_assembly_name)
file_path_3 = FilePath(ghpython_script_3.path)

# ----
# 03 - Frame with Butt and Mitter Joints
number_slider_2 = Slider(3, range=0..10)
ghpython_script_4 = GhPythonScript(idx=number_slider_2, folder_name="00_Additive", export=Toggle(True))  # -> out, i_assembly_name, path; inputs export: Boolean; same code as ghpython_script
file_path_4 = FilePath(ghpython_script_4.path)
data_4 = Data(ghpython_script_4.i_assembly_name)
brep_4 = Brep([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])

# ----
# 04 - spatial assembly with joints, interlocking
number_slider_3 = Slider(4, range=0..10)
ghpython_script_5 = GhPythonScript(idx=number_slider_3, folder_name="00_Additive", export=Toggle(True))  # -> out, i_assembly_name, path; inputs export: Boolean; same code as ghpython_script
brep_5 = Brep(flatten([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]))
data_5 = Data(ghpython_script_5.i_assembly_name)
file_path_5 = FilePath(ghpython_script_5.path)

# ----
# 05 - spatial assembly with nodes, many elements and dense
number_slider_4 = Slider(5, range=0..10)
ghpython_script_6 = GhPythonScript(idx=number_slider_4, folder_name="00_Additive", export=Toggle(True))  # -> out, i_assembly_name, path; inputs export: Boolean; same code as ghpython_script
joints_2 = Brep(flatten([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]))
beams_2 = Brep(flatten([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]))
data_6 = Data(ghpython_script_6.i_assembly_name)
file_path_6 = FilePath(ghpython_script_6.path)
brep_6 = Brep([beams_2, joints_2])

button = Button()
dfxmlexporter = DFXMLExporter(i_dump=Button(), i_assembly_name=data_2, i_export_dir=file_path_2, i_breps=brep_2)  # -> o_xml, o_joints, o_sides; inputs i_dump: Boolean, i_assembly_name: String, i_export_dir: String, i_breps: list of Brep
#   port i_dump: Press button to export xml
#   port i_assembly_name: The name of the assembly to export.
#   port i_export_dir: The directors where to export the xml file.
#   port i_breps: The breps of the structure.
#   port o_xml: The string of xml to be exported.
#   port o_joints: The breps of the faces belonging to joints.
#   port o_sides: The breps of the faces belonging to sides.
# ---------- dfxmlexporter: Python ----------
#! python3
# r: diffCheck==0.0.9

import System
import typing

import Rhino
import Rhino.Geometry as rg

from ghpythonlib.componentbase import executingcomponent as component

import diffCheck
from diffCheck.df_geometries import DFBeam, DFAssembly


class DFXMLExporter(component):
    def RunScript(self,
            i_dump: bool,
            i_assembly_name: str,
            i_export_dir: str,
            i_breps: System.Collections.Generic.IList[Rhino.Geometry.Brep]):
        """
            This read breps from Rhino, converts them to DFBeams and DFAssemblies, and exports them to XML.
            
            :param i_dump: whether to dump the xml
            :param i_export_dir: directory to export the xml
            :param i_breps: list of breps
        """
        # beams
        beams: typing.List[DFBeam] = []
        for brep in i_breps:
            beam = DFBeam.from_brep(brep)
            beams.append(beam)

        # assembly
        assembly1 = DFAssembly(beams, i_assembly_name)

        # dump the xml
        xml: str = assembly1.to_xml()
        if i_dump:
            assembly1.dump_xml(xml, i_export_dir)
        o_xml = xml

        # show the joint/side faces
        o_joints = [jf.to_brep() for jf in assembly1.all_joint_faces]
        o_sides = [sf.to_brep() for sf in assembly1.all_side_faces]

        return o_xml, o_joints, o_sides
# ---------- end dfxmlexporter ----------
dfxmlexporter_2 = DFXMLExporter(i_dump=Button(), i_assembly_name=data, i_export_dir=file_path, i_breps=brep)  # -> o_xml, o_joints, o_sides; inputs i_dump: Boolean, i_assembly_name: String, i_export_dir: String, i_breps: list of Brep; same code as dfxmlexporter
dfxmlexporter_3 = DFXMLExporter(i_dump=Button(), i_assembly_name=data_3, i_export_dir=file_path_3, i_breps=brep_3)  # -> o_xml, o_joints, o_sides; inputs i_dump: Boolean, i_assembly_name: String, i_export_dir: String, i_breps: list of Brep; same code as dfxmlexporter
dfxmlexporter_4 = DFXMLExporter(i_dump=Button(), i_assembly_name=data_4, i_export_dir=file_path_4, i_breps=brep_4)  # -> o_xml, o_joints, o_sides; inputs i_dump: Boolean, i_assembly_name: String, i_export_dir: String, i_breps: list of Brep; same code as dfxmlexporter
dfxmlexporter_5 = DFXMLExporter(i_dump=Button(), i_assembly_name=data_5, i_export_dir=file_path_5, i_breps=brep_5)  # -> o_xml, o_joints, o_sides; inputs i_dump: Boolean, i_assembly_name: String, i_export_dir: String, i_breps: list of Brep; same code as dfxmlexporter
dfxmlexporter_6 = DFXMLExporter(i_dump=Button(), i_assembly_name=data_6, i_export_dir=file_path_6, i_breps=brep_6)  # -> o_xml, o_joints, o_sides; inputs i_dump: Boolean, i_assembly_name: String, i_export_dir: String, i_breps: list of Brep; same code as dfxmlexporter
surface = Surface(dfxmlexporter.o_joints)
surface_2 = Surface(dfxmlexporter.o_sides)
surface_3 = Surface(dfxmlexporter_2.o_joints)
surface_4 = Surface(dfxmlexporter_2.o_sides)
surface_5 = Surface(dfxmlexporter_3.o_joints)
surface_6 = Surface(dfxmlexporter_3.o_sides)
surface_7 = Surface(dfxmlexporter_4.o_joints)
surface_8 = Surface(dfxmlexporter_4.o_sides)
surface_9 = Surface(dfxmlexporter_5.o_joints)
surface_10 = Surface(dfxmlexporter_5.o_sides)
colour_swatch = ColourSwatch(SwatchColor=RGB(255, 255, 61))
surface_11 = Surface(dfxmlexporter_6.o_joints)
surface_12 = Surface(dfxmlexporter_6.o_sides)
custom_preview = CustomPreview(
    Geometry=surface_2,
    Material={diffuse=RGB(221, 160, 221), emission=RGB(66, 48, 66), shine=0.5, specular=RGB(255, 255, 255), transparency=0})
custom_preview_2 = CustomPreview(Geometry=surface_4, Material=ColourSwatch(SwatchColor=RGB(255, 255, 61)))
custom_preview_3 = CustomPreview(Geometry=surface, Material=ColourSwatch(SwatchColor=RGB(87, 64, 255)))
custom_preview_4 = CustomPreview(Geometry=surface_3, Material=ColourSwatch(SwatchColor=RGB(87, 64, 255)))
custom_preview_5 = CustomPreview(Geometry=surface_6, Material=ColourSwatch(SwatchColor=RGB(255, 255, 61)))
custom_preview_6 = CustomPreview(Geometry=surface_5, Material=ColourSwatch(SwatchColor=RGB(87, 64, 255)))
custom_preview_7 = CustomPreview(Geometry=surface_7, Material=ColourSwatch(SwatchColor=RGB(87, 64, 255)))
custom_preview_8 = CustomPreview(Geometry=surface_8, Material=ColourSwatch(SwatchColor=RGB(255, 255, 61)))
custom_preview_9 = CustomPreview(Geometry=surface_10, Material=ColourSwatch(SwatchColor=RGB(255, 255, 61)))
custom_preview_10 = CustomPreview(Geometry=surface_12, Material=ColourSwatch(SwatchColor=RGB(255, 255, 61)))
custom_preview_11 = CustomPreview(Geometry=surface_9, Material=ColourSwatch(SwatchColor=RGB(87, 64, 255)))
custom_preview_12 = CustomPreview(Geometry=surface_11, Material=ColourSwatch(SwatchColor=RGB(87, 64, 255)))

# ----
# 03
number_slider_5 = Slider(3, range=0..10)
ghpython_script_7 = GhPythonScript(idx=number_slider_5, folder_name="01_Subtractive", export=Toggle(True))  # -> out, i_assembly_name, path; inputs export: Boolean
# ---------- ghpython_script_7: Python ----------
__author__ = "eleni"
__version__ = "2024.03.20"

import Rhino
import System
import scriptcontext
import sys
import os


HERE = ghenv.LocalScope.ghdoc.Path
path = os.path.abspath(os.path.join(HERE, '..', '..', folder_name + "/0" + idx))
i_assembly_name = "Sub_" + "0" + idx
# ---------- end ghpython_script_7 ----------
data_7 = Data(ghpython_script_7.i_assembly_name)
file_path_7 = FilePath(ghpython_script_7.path)
brep_7 = Brep(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)

# ----
# 02
number_slider_6 = Slider(2, range=0..10)
ghpython_script_8 = GhPythonScript(idx=number_slider_6, folder_name="01_Subtractive", export=Toggle(True))  # -> out, i_assembly_name, path; inputs export: Boolean; same code as ghpython_script_7
brep_8 = Brep(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)
file_path_8 = FilePath(ghpython_script_8.path)
data_8 = Data(ghpython_script_8.i_assembly_name)

# ----
# 01
number_slider_7 = Slider(1, range=0..10)
ghpython_script_9 = GhPythonScript(idx=number_slider_7, folder_name="01_Subtractive", export=Toggle(True))  # -> out, i_assembly_name, path; inputs export: Boolean; same code as ghpython_script_7
brep_9 = Brep(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)
file_path_9 = FilePath(ghpython_script_9.path)
data_9 = Data(ghpython_script_9.i_assembly_name)

# ----
# 04
number_slider_8 = Slider(4, range=0..10)
ghpython_script_10 = GhPythonScript(idx=number_slider_8, folder_name="01_Subtractive", export=Toggle(True))  # -> out, i_assembly_name, path; inputs export: Boolean; same code as ghpython_script_7
data_10 = Data(ghpython_script_10.i_assembly_name)
file_path_10 = FilePath(ghpython_script_10.path)
brep_10 = Brep(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)

# ----
# 00
number_slider_9 = Slider(0, range=0..10)
ghpython_script_11 = GhPythonScript(idx=number_slider_9, folder_name="01_Subtractive", export=Toggle(True))  # -> out, i_assembly_name, path; inputs export: Boolean; same code as ghpython_script_7
data_11 = Data(ghpython_script_11.i_assembly_name)
brep_11 = Brep(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)
file_path_11 = FilePath(ghpython_script_11.path)

dfxmlexporter_7 = DFXMLExporter(i_dump=Button(), i_assembly_name=data_7, i_export_dir=file_path_7, i_breps=brep_7)  # -> o_xml, o_joints, o_sides; inputs i_dump: Boolean, i_assembly_name: String, i_export_dir: String, i_breps: list of Brep; same code as dfxmlexporter
dfxmlexporter_8 = DFXMLExporter(i_dump=Button(), i_assembly_name=data_8, i_export_dir=file_path_8, i_breps=brep_8)  # -> o_xml, o_joints, o_sides; inputs i_dump: Boolean, i_assembly_name: String, i_export_dir: String, i_breps: list of Brep; same code as dfxmlexporter
dfxmlexporter_9 = DFXMLExporter(i_dump=Button(), i_assembly_name=data_10, i_export_dir=file_path_10, i_breps=brep_10)  # -> o_xml, o_joints, o_sides; inputs i_dump: Boolean, i_assembly_name: String, i_export_dir: String, i_breps: list of Brep; same code as dfxmlexporter
dfxmlexporter_10 = DFXMLExporter(i_dump=Button(), i_assembly_name=data_9, i_export_dir=file_path_9, i_breps=brep_9)  # -> o_xml, o_joints, o_sides; inputs i_dump: Boolean, i_assembly_name: String, i_export_dir: String, i_breps: list of Brep; same code as dfxmlexporter
dfxmlexporter_11 = DFXMLExporter(i_dump=Button(), i_assembly_name=data_11, i_export_dir=file_path_11, i_breps=brep_11)  # -> o_xml, o_joints, o_sides; inputs i_dump: Boolean, i_assembly_name: String, i_export_dir: String, i_breps: list of Brep; same code as dfxmlexporter
surface_13 = Surface(dfxmlexporter_7.o_joints)
surface_14 = Surface(dfxmlexporter_7.o_sides)
surface_15 = Surface(dfxmlexporter_8.o_joints)
surface_16 = Surface(dfxmlexporter_8.o_sides)
surface_17 = Surface(dfxmlexporter_10.o_joints)
surface_18 = Surface(dfxmlexporter_10.o_sides)
surface_19 = Surface(dfxmlexporter_9.o_joints)
surface_20 = Surface(dfxmlexporter_9.o_sides)
surface_21 = Surface(dfxmlexporter_11.o_joints)
surface_22 = Surface(dfxmlexporter_11.o_sides)
custom_preview_13 = CustomPreview(Geometry=surface_14, Material=ColourSwatch(SwatchColor=RGB(255, 255, 61)))
custom_preview_14 = CustomPreview(Geometry=surface_13, Material=ColourSwatch(SwatchColor=RGB(87, 64, 255)))
custom_preview_15 = CustomPreview(Geometry=surface_16, Material=ColourSwatch(SwatchColor=RGB(255, 255, 61)))
custom_preview_16 = CustomPreview(Geometry=surface_15, Material=ColourSwatch(SwatchColor=RGB(87, 64, 255)))
custom_preview_17 = CustomPreview(Geometry=surface_20, Material=ColourSwatch(SwatchColor=RGB(255, 255, 61)))
custom_preview_18 = CustomPreview(Geometry=surface_18, Material=ColourSwatch(SwatchColor=RGB(255, 255, 61)))
custom_preview_19 = CustomPreview(Geometry=surface_19, Material=ColourSwatch(SwatchColor=RGB(87, 64, 255)))
custom_preview_20 = CustomPreview(Geometry=surface_17, Material=ColourSwatch(SwatchColor=RGB(87, 64, 255)))
custom_preview_21 = CustomPreview(Geometry=surface_22, Material=ColourSwatch(SwatchColor=RGB(255, 255, 61)))
custom_preview_22 = CustomPreview(Geometry=surface_21, Material=ColourSwatch(SwatchColor=RGB(87, 64, 255)))
