# Grasshopper definition diffcheck_joints.ghx (Grasshopper 1.0.7)
# plug-ins: Human, Bifocals

number_slider = Slider(0.05, range=0..0.1)
number_slider_2 = Slider(1, range=0..1)
number_slider_3 = Slider(1, range=0..1)
xz_plane = XZPlane(Origin=Point(0, 0, 0))
radians = Radians(Degrees=Slider(90, range=0..100))
construct_domain = ConstructDomain(DomainStart=expr("-0.5*x", number_slider_2), DomainEnd=expr("0.5*x", number_slider_2))
construct_domain_2 = ConstructDomain(DomainStart=expr("-(0.5/5)*x", number_slider_2), DomainEnd=expr("(0.5/5)*x", number_slider_2))
rotate = Rotate(Geometry=xz_plane, Angle=radians, Plane=PlaneXY(0, 0, 0))  # -> Geometry, Transform
construct_domain_3 = ConstructDomain(DomainStart=expr("-0.5*x", number_slider_3), DomainEnd=expr("0.5*x", number_slider_3))
construct_domain_4 = ConstructDomain(DomainStart=expr("-(0.5/5)*x", number_slider_3), DomainEnd=expr("(0.5/5)*x", number_slider_3))
xz_plane_2 = XZPlane(Origin=Point(0, 0, 0))
expression = Expression(x=number_slider_3, Expression="(0.2)*x")
expression_2 = Expression(x=number_slider_2, Expression="-(0.5/5)*4 * x")
expression_3 = Expression(x=number_slider_2, Expression="(0.5/5)*4 * x")
unit_x = UnitX(Factor=expr("0.5*x", number_slider_2))
rectangle = Rectangle(Plane=rotate.Geometry, XSize=construct_domain, YSize=construct_domain_2, Radius=0)  # -> Rectangle, Length
expression_4 = Expression(x=number_slider_3, Expression="-(0.5/5)*4 * x")
rectangle_2 = Rectangle(Plane=xz_plane_2, XSize=construct_domain_3, YSize=construct_domain_4, Radius=0)  # -> Rectangle, Length
unit_z = UnitZ(Factor=expression)
unit_y = UnitY(Factor=expr("-x", number_slider_2))
unit_z_2 = UnitZ(Factor=expression_2)
unit_z_3 = UnitZ(Factor=expression_3)
unit_z_4 = UnitZ(Factor=expression_4)
unit_y_2 = UnitY(Factor=expr("-x", number_slider_3))
unit_y_3 = UnitY(Factor=expr("-x", number_slider_3))
move = Move(Geometry=rectangle_2.Rectangle, Motion=unit_z)  # -> Geometry, Transform
unit_y_4 = UnitY(Factor=expr("0.5*x", number_slider_3))
unit_x_2 = UnitX(Factor=number_slider_2)

cuts1 = Curve([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])
cuts0 = Curve([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])

cuts0_2 = Curve([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])
cuts1_2 = Curve([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])

cuts0_3 = Curve([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])
cuts1_3 = Curve([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])

# ----
# Half Lap if diagonal
number_slider_4 = Slider(29, range=0..100)
# Scarf Joint with incline if parallel
# Crossed Lap if vertical
number_slider_5 = Slider(9, range=0..100)
# Mortise tenon if parallel
number_slider_6 = Slider(39, range=0..100)
solver = Solver(cuts0=cuts0_3, cuts1=cuts1_3, type=number_slider_5)  # -> custom_joints, custom_types; inputs cuts0: list of Curve, cuts1: list of Curve, type: Int32
#   port cuts0: cuts for removal from the first beam
# ---------- solver: Python ----------
from ghpythonlib.componentbase import executingcomponent as component
import Grasshopper, GhPython
import System
import Rhino
import rhinoscriptsyntax as rs
from Rhino.Geometry import Polyline, Point3d

class MyComponent(component):
    
    def RunScript(self, _cuts0, _cuts1, _type):
        
        
        _custom_joints = []
        _custom_types = []
        type = 39 if _type is None else _type
        
        for i in range(len(_cuts0)):
            _custom_joints.append(_cuts0[i])
            _custom_types.append(type)
        
        for i in range(len(_cuts1)):
            _custom_joints.append(_cuts1[i])
            _custom_types.append(-type)
        
        
        # return outputs if you have them; here I try it for you:
        return (_custom_joints, _custom_types)
# ---------- end solver ----------
solver_2 = Solver(cuts0=cuts0, cuts1=cuts1, type=number_slider_6)  # -> custom_joints, custom_types; inputs cuts0: list of Curve, cuts1: list of Curve, type: Int32; same code as solver
solver_3 = Solver(cuts0=cuts0_2, cuts1=cuts1_2, type=number_slider_4)  # -> custom_joints, custom_types; inputs cuts0: list of Curve, cuts1: list of Curve, type: Int32; same code as solver
merge = Merge(Data1=solver.custom_types, Data2=solver_3.custom_types, Data3=solver_2.custom_types)
merge_2 = Merge(Data1=solver.custom_joints, Data2=solver_3.custom_joints, Data3=solver_2.custom_joints)

cuts1_4 = Curve([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])
cuts0_4 = Curve([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])

cuts0_5 = Curve([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])
cuts1_5 = Curve([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])

cuts1_6 = Curve([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])
cuts0_6 = Curve([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])

cuts0_7 = Curve([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])
cuts1_7 = Curve([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])

# ----
# Half Lap if diagonal
number_slider_7 = Slider(29, range=0..100)
solver_4 = Solver(cuts0=cuts0_5, cuts1=cuts1_5, type=Slider(9, range=0..100))  # -> custom_joints, custom_types; inputs cuts0: list of Curve, cuts1: list of Curve, type: Int32; same code as solver
solver_5 = Solver(cuts0=cuts0_7, cuts1=cuts1_7, type=Slider(39, range=0..100))  # -> custom_joints, custom_types; inputs cuts0: list of Curve, cuts1: list of Curve, type: Int32; same code as solver
solver_6 = Solver(cuts0=cuts0_6, cuts1=cuts1_6, type=number_slider_7)  # -> custom_joints, custom_types; inputs cuts0: list of Curve, cuts1: list of Curve, type: Int32; same code as solver
merge_3 = Merge(Data1=solver_4.custom_joints, Data2=solver_6.custom_joints, Data3=solver_5.custom_joints)
merge_4 = Merge(Data1=solver_4.custom_types, Data2=solver_6.custom_types, Data3=solver_5.custom_types)

cuts0_8 = Curve([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])
cuts1_8 = Curve([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])

cuts1_9 = Curve([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])
ghpython_script = GhPythonScript(x=move.Geometry, distance=number_slider)  # -> out, pol; inputs x: Polyline
# ---------- ghpython_script: Python ----------
import Rhino.Geometry as rg




#x[0]+= rg.Vector3d(0, 0, -distance)
x[1]+= rg.Vector3d(0, 0, -distance)
x[2]+= rg.Vector3d(0, 0, distance)
#x[3]+= rg.Vector3d(0, 0, distance)
#x[4]+= rg.Vector3d(0, 0, -distance)

pol = rg.Curve.CreateInterpolatedCurve(x,1)
# ---------- end ghpython_script ----------
cuts0_9 = Curve([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])

# ----
# Mortise Tenon if vertical
number_slider_8 = Slider(9, range=0..100)
# Half Lap if diagonal
number_slider_9 = Slider(29, range=0..100)
solver_7 = Solver(cuts0=cuts0_9, cuts1=cuts1_9, type=number_slider_8)  # -> custom_joints, custom_types; inputs cuts0: list of Curve, cuts1: list of Curve, type: Int32; same code as solver
solver_8 = Solver(cuts0=cuts0_8, cuts1=cuts1_8, type=Slider(39, range=0..100))  # -> custom_joints, custom_types; inputs cuts0: list of Curve, cuts1: list of Curve, type: Int32; same code as solver
solver_9 = Solver(cuts0=cuts0_4, cuts1=cuts1_4, type=number_slider_9)  # -> custom_joints, custom_types; inputs cuts0: list of Curve, cuts1: list of Curve, type: Int32; same code as solver
merge_5 = Merge(Data1=solver_7.custom_joints, Data2=solver_9.custom_joints, Data3=solver_8.custom_joints)
merge_6 = Merge(Data1=solver_7.custom_types, Data2=solver_9.custom_types, Data3=solver_8.custom_types)

point_on_curve = PointOnCurve(cuts1_5, parameter=0.5)
# Kinda like dowtail but out of scale
# Mortise Tenon if vertical
point_list = PointList(Points=point_on_curve, Size=Slider(0.2, range=0..1))
move_2 = Move(Geometry=rectangle.Rectangle, Motion=unit_x)  # -> Geometry, Transform
move_3 = Move(Geometry=move_2.Geometry, Motion=unit_z_2)  # -> Geometry, Transform
move_4 = Move(Geometry=move_2.Geometry, Motion=unit_z_3)  # -> Geometry, Transform
move_5 = Move(Geometry=ghpython_script.pol, Motion=unit_y_4)  # -> Geometry, Transform
move_6 = Move(Geometry=move_5.Geometry, Motion=unit_y_3)  # -> Geometry, Transform
move_7 = Move(Geometry=move_5.Geometry, Motion=unit_z_4)  # -> Geometry, Transform
move_8 = Move(Geometry=move_7.Geometry, Motion=unit_y_2)  # -> Geometry, Transform
number_slider_10 = Slider(1, range=0..10)
move_9 = Move(Geometry=move_4.Geometry, Motion=expr("-x", unit_x_2))  # -> Geometry, Transform
move_10 = Move(Geometry=move_3.Geometry, Motion=expr("-x", unit_x_2))  # -> Geometry, Transform
move_11 = Move(Geometry=move_2.Geometry, Motion=expr("-x", unit_x_2))  # -> Geometry, Transform
ghpython_script_2 = GhPythonScript(x=move_4.Geometry, distance=number_slider)  # -> out, pol; inputs x: Polyline
# ---------- ghpython_script_2: Python ----------
import Rhino.Geometry as rg

#x[2]+= rg.Vector3d(0, 0, -distance)
#x[3]+= rg.Vector3d(0, 0, -distance)
x[1]+= rg.Vector3d(0, 0, distance)
x[0]+= rg.Vector3d(0, 0, distance)
x[4]+= rg.Vector3d(0, 0, distance)
pol = rg.Curve.CreateInterpolatedCurve(x,1)
# ---------- end ghpython_script_2 ----------
ghpython_script_3 = GhPythonScript(x=move_2.Geometry, distance=number_slider)  # -> out, pol; inputs x: Polyline
# ---------- ghpython_script_3: Python ----------
import Rhino.Geometry as rg

x[2]+= rg.Vector3d(0, 0, -distance)
x[3]+= rg.Vector3d(0, 0, -distance)
x[1]+= rg.Vector3d(0, 0, distance)
x[0]+= rg.Vector3d(0, 0, distance)
x[4]+= rg.Vector3d(0, 0, distance)
pol = rg.Curve.CreateInterpolatedCurve(x,1)
# ---------- end ghpython_script_3 ----------
ghpython_script_4 = GhPythonScript(x=move_3.Geometry, distance=number_slider)  # -> out, pol; inputs x: Polyline
# ---------- ghpython_script_4: Python ----------
import Rhino.Geometry as rg

x[2]+= rg.Vector3d(0, 0, -distance)
x[3]+= rg.Vector3d(0, 0, -distance)
#x[0]+= rg.Vector3d(0, 0, -distance)
#x[4]+= rg.Vector3d(0, 0, -distance)
pol = rg.Curve.CreateInterpolatedCurve(x,1)
# ---------- end ghpython_script_4 ----------
merge_7 = Merge(Data1=move_7.Geometry, Data2=move_8.Geometry, Data3=move_5.Geometry, Data4=move_6.Geometry)
merge_8 = Merge(
    Data1=move_10.Geometry,
    Data2=ghpython_script_4.pol,
    Data3=move_11.Geometry,
    Data4=ghpython_script_3.pol,
    Data5=move_9.Geometry,
    Data6=ghpython_script_2.pol)

cuts0_10 = Curve([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])
cuts1_10 = Curve([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])

cuts0_11 = Curve([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])
cuts1_11 = Curve([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])

cuts0_12 = Curve([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])
cuts1_12 = Curve([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])

# ----
# Scarf Joint if parallel
# Dovetail Crossed Lap if vertical
number_slider_11 = Slider(9, range=0..100)
# Scarf Joint with incline if parallel
number_slider_12 = Slider(39, range=0..100)
# Crossed Lap with detail if diagonal
number_slider_13 = Slider(29, range=0..100)
# Associate lines with Element
solver_10 = Solver(cuts0=cuts0_11, cuts1=cuts1_11, type=number_slider_11)  # -> custom_joints, custom_types; inputs cuts0: list of Curve, cuts1: list of Curve, type: Int32; same code as solver
solver_11 = Solver(cuts0=cuts0_12, cuts1=cuts1_12, type=number_slider_13)  # -> custom_joints, custom_types; inputs cuts0: list of Curve, cuts1: list of Curve, type: Int32; same code as solver
solver_12 = Solver(cuts0=cuts0_10, cuts1=cuts1_10, type=number_slider_12)  # -> custom_joints, custom_types; inputs cuts0: list of Curve, cuts1: list of Curve, type: Int32; same code as solver
merge_9 = Merge(Data1=solver_10.custom_types, Data2=solver_11.custom_types, Data3=solver_12.custom_types)
merge_10 = Merge(Data1=solver_10.custom_joints, Data2=solver_11.custom_joints, Data3=solver_12.custom_joints)

cuts1_13 = Curve([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])
cuts0_13 = Curve([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])

cuts0_14 = Curve([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])
cuts1_14 = Curve([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])

cuts0_15 = Curve([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])
cuts1_15 = Curve([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])

# ----
# Half Lap if diagonal
number_slider_14 = Slider(29, range=0..100)
# Crossed Lap if vertical
number_slider_15 = Slider(9, range=0..100)
# Mortise tenon if parallel
number_slider_16 = Slider(39, range=0..100)
solver_13 = Solver(cuts0=cuts0_15, cuts1=cuts1_15, type=number_slider_15)  # -> custom_joints, custom_types; inputs cuts0: list of Curve, cuts1: list of Curve, type: Int32; same code as solver
solver_14 = Solver(cuts0=cuts0_13, cuts1=cuts1_13, type=number_slider_16)  # -> custom_joints, custom_types; inputs cuts0: list of Curve, cuts1: list of Curve, type: Int32; same code as solver
solver_15 = Solver(cuts0=cuts0_14, cuts1=cuts1_14, type=number_slider_14)  # -> custom_joints, custom_types; inputs cuts0: list of Curve, cuts1: list of Curve, type: Int32; same code as solver
merge_11 = Merge(Data1=solver_13.custom_types, Data2=solver_15.custom_types, Data3=solver_14.custom_types)
merge_12 = Merge(Data1=solver_13.custom_joints, Data2=solver_15.custom_joints, Data3=solver_14.custom_joints)

cuts0_16 = Curve(merge_7)

cuts0_17 = Curve([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])
cuts1_16 = Curve([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])

cuts1_17 = Curve(merge_8)

cuts0_18 = Curve([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])
cuts1_18 = Curve([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])

# ----
# Scarf Joint if parallel
# Dovetail if vertical
number_slider_17 = Slider(9, range=0..100)
# Crossed Lap with detail if diagonal
number_slider_18 = Slider(39, range=0..100)
# Associate lines with Element
solver_16 = Solver(cuts0=cuts0_18, cuts1=cuts1_18, type=number_slider_17)  # -> custom_joints, custom_types; inputs cuts0: list of Curve, cuts1: list of Curve, type: Int32; same code as solver
solver_17 = Solver(cuts0=cuts0_16, cuts1=cuts1_17, type=Slider(29, range=0..100))  # -> custom_joints, custom_types; inputs cuts0: list of Curve, cuts1: list of Curve, type: Int32; same code as solver
solver_18 = Solver(cuts0=cuts0_17, cuts1=cuts1_16, type=number_slider_18)  # -> custom_joints, custom_types; inputs cuts0: list of Curve, cuts1: list of Curve, type: Int32; same code as solver
merge_13 = Merge(Data1=solver_16.custom_types, Data2=solver_17.custom_types, Data3=solver_18.custom_types)
merge_14 = Merge(Data1=solver_16.custom_joints, Data2=solver_17.custom_joints, Data3=solver_18.custom_joints)

width = Panel("120")
crv = Curve([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])
point_on_curve_2 = PointOnCurve(crv, parameter=0.5)
height = Panel("120")

cuts1_19 = Curve([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])
cuts0_19 = Curve([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])

cuts0_20 = Curve([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])
cuts1_20 = Curve([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])

cuts1_21 = Curve([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])
panel = Panel(solver_10.custom_joints)
cuts0_21 = Curve([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])

# ----
# Mortise Tenon if vertical
number_slider_19 = Slider(9, range=0..100)
# Half Lap if diagonal
number_slider_20 = Slider(29, range=0..100)
solver_19 = Solver(cuts0=cuts0_21, cuts1=cuts1_21, type=number_slider_19)  # -> custom_joints, custom_types; inputs cuts0: list of Curve, cuts1: list of Curve, type: Int32; same code as solver
solver_20 = Solver(cuts0=cuts0_20, cuts1=cuts1_20, type=Slider(39, range=0..100))  # -> custom_joints, custom_types; inputs cuts0: list of Curve, cuts1: list of Curve, type: Int32; same code as solver
solver_21 = Solver(cuts0=cuts0_19, cuts1=cuts1_19, type=number_slider_20)  # -> custom_joints, custom_types; inputs cuts0: list of Curve, cuts1: list of Curve, type: Int32; same code as solver
merge_15 = Merge(Data1=solver_19.custom_joints, Data2=solver_21.custom_joints, Data3=solver_20.custom_joints)
merge_16 = Merge(Data1=solver_19.custom_types, Data2=solver_21.custom_types, Data3=solver_20.custom_types)

width_2 = Panel("150")
crv_2 = Curve([<curve referenced from the Rhino model> x3])
point_on_curve_3 = PointOnCurve(crv_2, parameter=0.5)
height_2 = Panel("100")
panel_2 = Panel(solver_16.custom_joints)
point_list_2 = PointList(Points=point_on_curve_2, Size=Slider(92, range=0..1000))
python = GhPythonScript(height=height, width=width, wireframe=crv)  # -> out, rectangles_side_a, rectangles_side_b, brep_basis, extrusion_direction; inputs height: Int32, width: Int32, wireframe: list of Line
# ---------- python: Python ----------
__author__ = "damien"
__version__ = "2024.3.31"

import Rhino

rectangles_side_a = []
rectangles_side_b = []
extrusion_direction = []
brep_basis = []

helpers =[]

for i in range(len(wireframe)):
    
    #calculate perpendicular vector to input wireframe
    perp_vectors = Rhino.Geometry.Vector3d.CrossProduct(wireframe[i].Direction,Rhino.Geometry.Vector3d(0,1,0))
    perp_vectors.Unitize()
    
    #copy curve direction
    direction_copy = wireframe[i].Direction
    direction_copy.Unitize()
    
    shifted_start = Rhino.Geometry.Point3d(wireframe[i].From - Rhino.Geometry.Point3d(height * direction_copy))
    basis_point = Rhino.Geometry.Point3d.Add(wireframe[i].From, perp_vectors*(height/2)+Rhino.Geometry.Vector3d(0,width/2,0))
    
    origin_plane = Rhino.Geometry.Plane(basis_point, wireframe[i].Direction,Rhino.Geometry.Vector3d(0,1,0))
    helpers.append(origin_plane)
    
    rectangles_side_a.append(Rhino.Geometry.Rectangle3d(origin_plane,wireframe[i].Length,-1*width))
    
    points_side_b = Rhino.Geometry.Point3d.Add(basis_point,perp_vectors*-1*height)
    planes_side_b = Rhino.Geometry.Plane(points_side_b,wireframe[i].Direction,Rhino.Geometry.Vector3d(0,1,0))
    rectangles_side_b.append(Rhino.Geometry.Rectangle3d(planes_side_b,wireframe[i].Length,-1*width))
    
    shifted_point_side_b_brep = points_side_b + (Rhino.Geometry.Point3d(direction_copy*height)) * (-1)
    plane_side_b_brep = Rhino.Geometry.Plane(shifted_point_side_b_brep,wireframe[i].Direction,Rhino.Geometry.Vector3d(0,1,0))
    brep_basis.append(Rhino.Geometry.Rectangle3d(plane_side_b_brep,wireframe[i].Length + height*2, -1*width))
    
    extrusion_direction.append(origin_plane.ZAxis*height)
# ---------- end python ----------
point_list_3 = PointList(Points=point_on_curve_3, Size=Slider(92, range=0..1000))
panel_3 = Panel(solver_10.custom_types)
python_2 = GhPythonScript(height=height_2, width=width_2, wireframe=crv_2)  # -> out, rectangles_side_a, rectangles_side_b, brep_basis, extrusion_direction; inputs height: Int32, width: Int32, wireframe: list of Line; same code as python
panel_4 = Panel(solver_16.custom_types)
curve = Curve(python.rectangles_side_b)
curve_2 = Curve(python.rectangles_side_a)
weave = Weave(Pattern=[0, 1], Stream0=python.rectangles_side_a, Stream1=python.rectangles_side_b, NullGaps=False)
curve_3 = Curve(python_2.rectangles_side_b)
curve_4 = Curve(python_2.rectangles_side_a)

panel_5 = Panel("""100
0.5
39""")
panel_6 = Panel("""100
0.5
9""")
panel_7 = Panel("""100
0.5
29""")
joint_parameters = Joint_parameters(ss_e_ip=panel_6, ts_e_p=panel_7, cr_c_ip=panel_5)  # -> p; inputs ss_e_ip: list, ss_e_op: list, ts_e_p: list, cr_c_ip: list, tt_e_p: list, ss_e_r: list, b: list
#   port ss_e_ip: side-to-side in-plane joint parameters
# ---------- joint_parameters: Python ----------
from ghpythonlib.componentbase import executingcomponent as component
import Grasshopper, GhPython
import math

class joint_parameters_component(component):
    def RunScript(
        self,
        _ss_e_ip,
        _ss_e_op,
        _ts_e_p,
        _cr_c_ip,
        _tt_e_p,
        _ss_e_r,
        _b

    ):
        
        joint_parameters = [
            300, 0.5, 3,   # 1-9 ss_e_ip (side-to-side edge in-plane)
            50, 0.64, 15,  # 10-19 ss_e_op (side-to-side edge out-of-plane)
            450, 0.5, 20,  # 20-29 ts_e_p (top-to-side edge plane)
            300, 0.5, 30,  # 30-39 cr_c_ip (cross cutting in-plane)
            6, 0.95, 40,   # 40-49 tt_e_p  (top-to-top edge plane)
            300, 0.5, 58,  # 50-59 ss_e_r (side-to-side edge rotated)
            300, 1.0, 60   # 60-69 b (boundary)
        ]

        for i in range(len(_ss_e_ip)):
            joint_parameters[0*3+i] = _ss_e_ip[i]

        for i in range(len(_ss_e_op)):
            joint_parameters[1*3+i] = _ss_e_op[i]

        for i in range(len(_ts_e_p)):
            joint_parameters[2*3+i] = _ts_e_p[i]

        for i in range(len(_cr_c_ip)):
            joint_parameters[3*3+i] = _cr_c_ip[i]
        
        if(math.floor(joint_parameters[3*3+2]) == 38):
            joint_parameters[3*3+2]= 30
        
        for i in range(len(_tt_e_p)):
            joint_parameters[4*3+i] = _tt_e_p[i]

        for i in range(len(_ss_e_r)):
            joint_parameters[5*3+i] = _ss_e_r[i]

        for i in range(len(_b)):
            joint_parameters[6*3+i] = _b[i]

        _joint_p = joint_parameters

        return _joint_p
# ---------- end joint_parameters ----------

weave_2 = Weave(Pattern=[0, 1], Stream0=python_2.rectangles_side_a, Stream1=python_2.rectangles_side_b, NullGaps=False)

panel_8 = Panel("""100
0.5
39""")
panel_9 = Panel("""100
0.5
9""")
panel_10 = Panel("""100
0.5
29""")
joint_parameters_2 = Joint_parameters(ss_e_ip=panel_9, ts_e_p=panel_10, cr_c_ip=panel_8)  # -> p; inputs ss_e_ip: list, ss_e_op: list, ts_e_p: list, cr_c_ip: list, tt_e_p: list, ss_e_r: list, b: list; same code as joint_parameters

topoly = CurveToPolyline(Curve=weave, ToleranceDistance=0, ToleranceAngle=0)  # -> Polyline, Segments
topoly_2 = CurveToPolyline(Curve=weave_2, ToleranceDistance=0, ToleranceAngle=0)  # -> Polyline, Segments

number_slider_21 = Slider(3, range=0..3)
filter = StreamFilter(Gate=number_slider_21, Stream0=merge_10, Stream1=merge_12, Stream2=merge_15)
filter_2 = StreamFilter(Gate=number_slider_21, Stream0=merge_9, Stream1=merge_11, Stream2=merge_16)

number_slider_22 = Slider(0, range=0..3)
filter_3 = StreamFilter(Gate=number_slider_22, Stream0=merge_14, Stream1=merge_2, Stream2=merge_5, Stream3=merge_3)
filter_4 = StreamFilter(Gate=number_slider_22, Stream0=merge_13, Stream1=merge, Stream2=merge_6, Stream3=merge_4)

panel_11 = Panel(topoly.Polyline)
panel_12 = Panel(topoly_2.Polyline)
# Find both side-2-side and cross
number_slider_23 = Slider(2, range=0..2)
# Volumes
number_slider_24 = Slider(3, range=0..10)
input_set = Input_set(polylines=topoly.Polyline)  # -> data; inputs polylines: tree of Polyline, vectors: tree of Vector3d, joint_types: tree of Int32, three_valence: tree of Int32, adjacency: tree of Int32
#   port polylines: a data-tree of polyline pairs
# ---------- input_set: Python ----------
from ghpythonlib.componentbase import executingcomponent as component
import Grasshopper, GhPython
__author__ = "petras"
__version__ = "2023.04.02"


import System
import Rhino
import rhinoscriptsyntax as rs
import ghpythonlib.treehelpers as th
from Rhino.Geometry import Polyline
from Rhino.Geometry import Vector3d
from Rhino.Geometry import Plane

class MyComponent(component):
    
    def get_plane(self, _polyline, _orientation_point):
        
        len = _polyline.Count - 1
        normal = Vector3d(0,0,0)
        
        for i in range((_polyline.Count - 1)):
            num = ((i - 1) + len) % len
            item1 = ((i + 1) + len) % len
            point3d =_polyline[num]
            point3d1 =_polyline[item1]
            item2 = _polyline[i]
            normal = normal + Vector3d.CrossProduct(Vector3d(item2 - point3d), Vector3d(point3d1 - item2))
        
        normal.Unitize()
        plane = Plane(_polyline.CenterPoint(), normal)
        if(plane.DistanceTo(_orientation_point)<0):
            plane.Flip()
        
        return plane
    
    
    
    def RunScript(self, _plines, _insertion_vectors, _joints_per_face, _three_valence, _adjacency):
        
        
        
        plines = []
        planes = []
        if( _plines.DataCount > 0):
            for i in range(_plines.BranchCount):
                plines.append(_plines.Branch(i))
                # create planes for orientation
                
                planes.append(self.get_plane(_plines.Branch(i)[0],_plines.Branch(i)[1][0]))
        
        insertion_vectors =  th.tree_to_list(_insertion_vectors) if _insertion_vectors.DataCount > 0 else []
        joints_per_face =  th.tree_to_list(_joints_per_face) if _joints_per_face.DataCount > 0 else []
        three_valence =  th.tree_to_list(_three_valence) if _three_valence.DataCount > 0 else []
        adjacency = th.tree_to_list(_adjacency) if _adjacency.DataCount > 0 else []
        
        # output
        _data = [[plines,insertion_vectors,joints_per_face,three_valence,adjacency, planes]]
        
        
        # return outputs if you have them; here I try it for you:
        return _data
# ---------- end input_set ----------
# Find both side-2-side and cross
number_slider_25 = Slider(2, range=0..2)
# Volumes
number_slider_26 = Slider(3, range=0..10)
input_set_2 = Input_set(polylines=topoly_2.Polyline)  # -> data; inputs polylines: tree of Polyline, vectors: tree of Vector3d, joint_types: tree of Int32, three_valence: tree of Int32, adjacency: tree of Int32; same code as input_set
# custome joints
panel_13 = Panel(filter)
# custome joints
panel_14 = Panel(filter_3)
extr = Extrude(Base=python.brep_basis, Direction=python.extrusion_direction)
extr_2 = Extrude(Base=python_2.brep_basis, Direction=python_2.extrusion_direction)
solver_22 = Solver(
    data=input_set,
    joint_p=joint_parameters,
    find=number_slider_23,
    get=number_slider_24,
    custom_joints=filter,
    custom_types=filter_2)  # -> data; inputs joint_p: list, scale: list, extension: list, find: Int32, get: Int32, custom_joints: list of Polyline, custom_types: list of Int32
#   port data: collection of inputs that represent the elements, insertion vectors, joint types and adjacency, use input_set commonent to group these inputs
#   port joint_p: joint parameters
#   port scale: scale of joint, default is [1,1,1]
#   port extension: extension by distance, plates often has [0,0,10], whereas beams [10,10,10], default is [0,0,0]
#   port find: search_type search type 0 - side-to-side, 1 - cross, 2 - both
#   port get: output_type 0 - outlines | 1 - lines | 2 - areas | 3 - volumes | 4 - merged geometry of joints
#   port data: user input_get component to ungroup all the data to the individual data-trees
# ---------- solver_22: Python ----------
__author__ = "petras"
__version__ = "2023.04.02"

from ghpythonlib.componentbase import executingcomponent as component
import Grasshopper, GhPython
import Rhino
from Rhino.Geometry import Polyline, Point3d
#from compas_rhino import conversions
import System

import time
from ctypes import *
#from compas_wood.ctypes_conversion import *

def list_polylines_coord(polylines, scale = 10):
    f = []
    v = []
    for polyline in polylines:
        f.append(len(polyline))
        for point in polyline:
            v.append(point[0]*scale)
            v.append(point[1]*scale)
            v.append(point[2]*scale)
            #v.extend(point)
    _f = (c_size_t * len(f))(*f)
    _v = (c_float * len(v))(*v)
    return _f, c_size_t(len(f)), _v, c_size_t(len(v))


def lists_vectors_coord(vectors):
    faces = [len(v) for v in vectors]
    f = (c_size_t * len(vectors))(*faces)
    v = [coord for vec in vectors for point in vec for coord in point]

    v_s = c_size_t(len(v))  # * sizeof(c_float)
    v = (c_float * len(v))(*v)
    return f, c_size_t(len(vectors)), v, v_s


def lists_numbers_coord(numbers):
    v_s = 0
    f_s = len(numbers)
    f = (c_size_t * len(numbers))()

    for i in range(len(numbers)):
        f[i] = len(numbers[i])
        v_s += len(numbers[i]) * 1

    v = (c_int * v_s)()

    count = 0
    for i in range(len(numbers)):
        for j in range(len(numbers[i])):
            v[count] = numbers[i][j]
            count += 1

    return f, c_size_t(f_s), v, c_size_t(v_s)


def list_ints_coord(numbers):
    f_s = len(numbers)
    f = [0.0] * f_s
    for i in range(f_s):
        f[i] = numbers[i]
    return (c_int * len(f))(*f), c_size_t(f_s)


def list_numbers_coord(numbers):
    f_s = len(numbers)
    f = [0.0] * f_s
    for i in range(f_s):
        f[i] = numbers[i]
    return (c_float * len(f))(*f), c_size_t(f_s)



def coord_polylines_lists(groups_f, groups_f_s, out_f, out_f_s, out_v, out_v_s):
    polylines = [
        [Polyline([]) for j in range(groups_f[i])] for i in range(groups_f_s.value)
    ]

    a = 0
    b = 0
    pline_count = 0
    num_points = 3
    num_groups = groups_f_s.value

    points = []
    for i in range(0, out_v_s.value, num_points):
        #points.append([out_v[i]*0.1, out_v[i + 1]*0.1, out_v[i + 2]*0.1])
        points.append(Point3d(out_v[i]*0.1, out_v[i + 1]*0.1, out_v[i + 2]*0.1))
        num_points_per_polyline = out_f[pline_count]

        if len(points) == num_points_per_polyline:
            for j in range(a, groups_f_s.value):
                if groups_f[j] > 0:
                    a = j
                    break

            polylines[a][b] = Polyline(points)
            points = []
            num_polylines_per_group = groups_f[a]
            if b == (num_polylines_per_group - 1):
                a += 1
                b = 0
            else:
                b += 1
            pline_count += 1

    return polylines


def coord_numbers_lists(out_f, out_f_s, out_v, out_v_s):

    # create Python objects
    ids = [[] for _ in range(out_f_s.value)]

    for i in range(out_f_s.value):
        ids[i] = [None] * out_f[i]
        if out_f[i] == 0:
            return

    # fill array with points
    a = 0
    b = 0
    for i in range(0, out_v_s.value):
        ids[a][b] = out_v[i]
        if b == (out_f[a] - 1):
            a += 1
            b = 0
        else:
            b += 1

    return ids



class connections_zones(component):
    
    bbox = Rhino.Geometry.BoundingBox.Unset
    lines = []
    insertion_vectors_current = []
    joint_per_face_current_text_entity = []
    polylines = []
    
    def DrawViewportWires(self, args):
        #GrasshopperDocument = Grasshopper.Instances.ActiveCanvas.Document
        #is_selected = False
        """
        for _ in GrasshopperDocument.Objects:
            is_selected = _.Attributes.Selected
        """
        #col = args.WireColour_Selected if is_selected else args.WireColour;
        col =  args.WireColour
        line_weight = args.DefaultCurveThickness;
        try:
            for polyline in self.polylines:
                args.Display.DrawPolyline(polyline,  col, line_weight)
            """
            plane = Plane.WorldXY
            for line in self.lines:
                args.Display.DrawLineArrow(line, Color.FromArgb(207, 0, 90), 2, 100)
            for insertionVectorsCurrent in self.insertion_vectors_current:
                if(insertionVectorsCurrent.Length<0.05):
                    continue
                args.Display.DrawLine(insertionVectorsCurrent, Color.FromArgb(0, 0, 0), 5)
            for jointPerFaceCurrent in self.joint_per_face_current_text_entity:
                result, plane = Rhino.RhinoDoc.ActiveDoc.Views.ActiveView.ActiveViewport.GetCameraFrame()
                plane.Origin=(jointPerFaceCurrent.Plane.Origin)
                args.Display.Draw3dText(jointPerFaceCurrent.PlainText, jointPerFaceCurrent.MaskColor, plane, jointPerFaceCurrent.TextHeight, "Arial", False, False,Rhino.DocObjects.TextHorizontalAlignment.Center, Rhino.DocObjects.TextVerticalAlignment.BottomOfTop)
            """
        except Exception, e:
            System.Windows.Forms.MessageBox.Show(str(e), "script error")
    
    def get_ClippingBox(self):
        return self.bbox
    
    def RunScript(self, _data, _join_p, _scale, _extension, _find, _get, _custom_joints, _custom_types):
        # ==============================================================================
        # clear input
        # ==============================================================================
        self.bbox = Rhino.Geometry.BoundingBox.Unset
        self.lines = []
        self.insertion_vectors_current = []
        self.joint_per_face_current_text_entity = []
        self.polylines = []
        # ==============================================================================
        # input
        # ==============================================================================
        if(_data is None):
            return
        
        input_polylines = []
        if( _data[0] != 0):
            #convert to compas polylines
            for i in _data[0]:
                for j in i:
                    input_polylines.append(j)#(conversions.polyline_to_compas(j))
        
        input_vectors = []
        if(_data[1] != None):
            for i in _data[1]:
                list = []
                for j in i:
                    list.append(j)#(conversions.vector_to_compas(j))
                input_vectors.append(list)
        
        joint_parameters = [
            300, 0.5, 3,   # 1-9 ss_e_ip (side-to-side edge in-plane)
            50, 0.64, 15,  # 10-19 ss_e_op (side-to-side edge out-of-plane)
            450, 0.5, 20,  # 20-29 ts_e_p (top-to-side edge plane)
            300, 0.5, 30,  # 30-39 cr_c_ip (cross cutting in-plane)
            6, 0.95, 40,   # 40-49 tt_e_p  (top-to-top edge plane)
            300, 0.5, 58,  # 50-59 ss_e_r (side-to-side edge rotated)
            300, 1.0, 60   # 60-69 b (boundary)
        ]
        
        for i in range(0, len(_join_p)):
            if(i%3==0):
                joint_parameters[i] = _join_p[i]*10
            else:
                joint_parameters[i] = _join_p[i]*1
            
        
        search = id = max(min(2, _find), 0)
        
        scale = [1,1,1]
        for i in range(0, len(_scale)):
            scale[i] = _scale[i]
        
        output_type = _get if _get != None else 4
        
        extension = [0,0,0]
        
        if(len(_extension)>2):
            extension = []
            for i in _extension:
                extension.append(i*10)
        
        
        
        input_adjacency = []
        if(len(_data[4])>0):
            for i in _data[4]:
                for j in i:
                    input_adjacency.append(j)
        
        ############################################################################################################
        # Load inputs and perform conversion
        ############################################################################################################
    
        # input geometry
        # input_polylines = data_set_plates.annen_small_polylines()
        # print(len(input_polylines))
        (
            in_polyline_pairs_f,
            in_polyline_pairs_f_s,
            in_polyline_pairs_v,
            in_polyline_pairs_v_s,
        ) = list_polylines_coord(input_polylines)
        
    
        #input_vectors = data_set_plates.annen_small_edge_directions()
    
        (
            in_vectors_f,
            in_vectors_f_s,
            in_vectors_v,
            in_vectors_v_s,
        ) = lists_vectors_coord(input_vectors)
        
        
        
        input_joints = _data[2]#data_set_plates.annen_small_edge_joints()
        # print(len(input_joints))
        (
            in_joints_f,
            in_joints_f_s,
            in_joints_v,
            in_joints_v_s,
        ) = lists_numbers_coord(input_joints)
    
        input_three_valence =_data[3]#(data_set_plates.annen_small_three_valance_element_indices_and_instruction()   )
        
        # print(len(input_three_valence))
    
        (
            in_three_valence_f,
            in_three_valence_f_s,
            in_three_valence_v,
            in_three_valence_v_s,
        ) = lists_numbers_coord(input_three_valence)
    
        #input_adjacency = []
        
        (
            in_adjancency_v,
            in_adjancency_v_s,
        ) = list_ints_coord(input_adjacency)
    
        # input parameters
        (
            in_joint_parameters_v,
            in_joint_parameters_v_s,
        ) = list_numbers_coord(joint_parameters)
    
        in_search_type = c_int(search)
        (
            in_scale_v,
            in_scale_v_s,
        ) = list_numbers_coord(scale)
        
        in_output_type = c_int(output_type)
        
        #############################################################################################################
        # custom joint types
        #############################################################################################################
        
        input_joint_polyline_pairs = []
        (
            in_joint_polyline_pairs_f,
            in_joint_polyline_pairs_f_s,
            in_joint_polyline_pairs_v,
            in_joint_polyline_pairs_v_s
        ) = list_polylines_coord(_custom_joints,1)
        
        
        input_joint_types = []
        (
            in_joint_types_v,
            in_joint_types_v_s
        ) = list_ints_coord(_custom_types)
        #############################################################################################################
        # output parameters
        #############################################################################################################
        
        
        # output
        
        # out polylines
        out_plines_groups_f = POINTER(c_size_t)()
        out_plines_groups_f_s = c_size_t()
        out_plines_out_f = POINTER(c_size_t)()
        out_plines_out_f_s = c_size_t()
        out_plines_out_v = POINTER(c_float)()
        out_plines_out_v_s = c_size_t()
    
        # out types
        out_types_f = POINTER(c_size_t)()
        out_types_f_s = c_size_t()
        out_types_v = POINTER(c_int)()
        out_types_v_s = c_size_t()
    
        # global_parameters
        (
            in_joint_volume_parameters_v,
            in_joint_volume_parameters_v_s,
        ) = list_numbers_coord(extension)
        
        face_to_face_side_to_side_joints_dihedral_angle = c_float(130.0)
        
        ############################################################################################################
        # Load library and declare function signature
        ############################################################################################################
        

        if System.Environment.OSVersion.Platform == System.PlatformID.Win32NT:
            #print("Windows")
            lib_ = cdll.LoadLibrary("C:/compas_wood/libgmp-10.dll")
            lib = cdll.LoadLibrary("C:/compas_wood/pinvoke_wood.dll")
        elif System.Environment.OSVersion.Platform == System.PlatformID.Unix:
            #print("macOS")
            lib = cdll.LoadLibrary("/Users/compas_wood/libpinvoke_wood.dylib")
        else:
            print("Unknown operating system")
                

        lib.ctypes_get_connection_zones_with_custom_joints.restype = None
        lib.ctypes_get_connection_zones_with_custom_joints.argtypes = [
            # input geometry
            # polylines
            POINTER(c_size_t),
            POINTER(c_size_t),  # if a value is passed by reference, it must be a pointer
            POINTER(c_float),
            POINTER(c_size_t),  # if a value is passed by reference, it must be a pointer
            # vectors
            POINTER(c_size_t),
            POINTER(c_size_t),
            POINTER(c_float),
            POINTER(c_size_t),
            # joints
            POINTER(c_size_t),
            POINTER(c_size_t),
            POINTER(c_int),
            POINTER(c_size_t),
            # three valence
            POINTER(c_size_t),
            POINTER(c_size_t),
            POINTER(c_int),
            POINTER(c_size_t),
            # adjacency
            POINTER(c_int),
            POINTER(c_size_t),
            #custom joints
            POINTER(c_size_t),
            POINTER(c_size_t),  # if a value is passed by reference, it must be a pointer
            POINTER(c_float),
            POINTER(c_size_t),  # if a value is passed by reference, it must be a pointer
            #custom joints types
            POINTER(c_int),
            POINTER(c_size_t),
            # input parameters
            POINTER(c_float),
            POINTER(c_size_t),
            # search_type
            POINTER(c_int),
            # scale
            POINTER(c_float),
            POINTER(c_size_t),
            # output_type
            POINTER(c_int),
            # output
            # polylines
            POINTER(POINTER(c_size_t)),
            POINTER(c_size_t),
            POINTER(POINTER(c_size_t)),
            POINTER(c_size_t),
            POINTER(POINTER(c_float)),
            POINTER(c_size_t),
            # types
            POINTER(POINTER(c_size_t)),
            POINTER(c_size_t),
            POINTER(POINTER(c_int)),
            POINTER(c_size_t),
            # global_parameters
            POINTER(c_float), # joint volume
            POINTER(c_size_t), # joint volume
            POINTER(c_float) # dihedral angle to switch between in-plane and out-of-plane jointery default is 150 degrees
        ]
    
        # generate joints
        start_time = time.time()
        ############################################################################################################
        # Call the function
        # https://stackoverflow.com/questions/4145775/how-do-i-convert-a-python-list-into-a-c-array-by-using-ctypes
        # https://stackoverflow.com/questions/53265216/python-ctypes-type-conversion
        ############################################################################################################
        
        
        lib.ctypes_get_connection_zones_with_custom_joints(
            # input geometry
            # polylines
            in_polyline_pairs_f,
            byref(in_polyline_pairs_f_s),
            in_polyline_pairs_v,
            byref(in_polyline_pairs_v_s),
            # vectors
            in_vectors_f,
            byref(in_vectors_f_s),
            in_vectors_v,
            byref(in_vectors_v_s),
            # joints
            in_joints_f,
            byref(in_joints_f_s),
            in_joints_v,
            byref(in_joints_v_s),
            # three_valence
            in_three_valence_f,
            byref(in_three_valence_f_s),
            in_three_valence_v,
            byref(in_three_valence_v_s),
            # adjacency
            in_adjancency_v,
            byref(in_adjancency_v_s),
            
            #custom joints
            in_joint_polyline_pairs_f,
            byref(in_joint_polyline_pairs_f_s),  # if a value is passed by reference, it must be a pointer
            in_joint_polyline_pairs_v,
            byref(in_joint_polyline_pairs_v_s),  # if a value is passed by reference, it must be a pointer
            #custom joints types
            in_joint_types_v,
            byref(in_joint_types_v_s),
            
            # input parameters
            # joint_parameters
            in_joint_parameters_v,
            byref(in_joint_parameters_v_s),
            # search_type
            byref(in_search_type),
            # scale
            in_scale_v,
            byref(in_scale_v_s),
            # output_type
            byref(in_output_type),
            
            
            # output
            # polylines
            byref(out_plines_groups_f),
            byref(out_plines_groups_f_s),
            byref(out_plines_out_f),
            byref(out_plines_out_f_s),
            byref(out_plines_out_v),
            byref(out_plines_out_v_s),
            # types
            byref(out_types_f),
            byref(out_types_f_s),
            byref(out_types_v),
            byref(out_types_v_s),
            # global_parameters
            in_joint_volume_parameters_v,
            byref(in_joint_volume_parameters_v_s),
            byref(face_to_face_side_to_side_joints_dihedral_angle),
        )
        """
    
        print(out_plines_groups_f[0])
        out_polylines = []
        """
        out_polylines = coord_polylines_lists(
            out_plines_groups_f,
            out_plines_groups_f_s,
            out_plines_out_f,
            out_plines_out_f_s,
            out_plines_out_v,
            out_plines_out_v_s,
        )
        
        
        def temp_coord_numbers_lists(out_f, out_f_s, out_v, out_v_s):
        
            # create Python objects
            ids = [[] for _ in range(out_f_s.value)]
            
            
            
            for i in range(out_f_s.value):
                #print(i, out_f_s.value)
                ids[i] = [None] * out_f[i]
                if out_f[i] == 0:
                    break
            
            #print( ids)
            # fill array with points
            a = 0
            b = 0
            #for i in range(0, out_v_s.value):
            #    print( out_v[i])
            """
            ids[a][b] = out_v[i]
            if b == (out_f[a] - 1):
                a += 1
                b = 0
            else:
                b += 1
            """
        
            return ids
        
        _cuts = coord_numbers_lists(
            out_types_f, out_types_f_s, out_types_v, out_types_v_s
        )
        """
        print _cuts
        print  out_types_f, out_types_f_s, out_types_v, out_types_v_s
        print out_types_v[0]
        print out_types_f[0]
        """
        print(
            "\n______________________________________ %s ms ______________________________________"
            % round((time.time() - start_time) * 1000.0, 2)
        )
        
    
    

        
        
        # ==============================================================================
        # output
        # ==============================================================================
        _plines = []
        self.bbox = Rhino.Geometry.BoundingBox.Unset 
        # nest two times the result and add to the tree
        for i in range(0, len(out_polylines)):
            list = []
            for j in range(0, len(out_polylines[i])):
                    list.append(out_polylines[i][j])#(conversions.polyline_to_rhino(out_polylines[i][j]))
                    self.polylines.append(list[-1])
                    self.bbox.Union(list[-1].BoundingBox)
            _plines.append(list)
        
        _data = [[_plines,_data[1],_data[2],_data[3],_data[4],_data[5],_cuts]]
        #print(_cuts)
        
        ############################################################################################################
        # release the memory
        ############################################################################################################
    
        # release output of polylines
        lib.release_size_t(byref(out_plines_groups_f), True)
        lib.release_size_t(byref(out_plines_out_f), True)
        lib.release_float(byref(out_plines_out_v), True)
    
        # release output of types
        lib.release_size_t(byref(out_types_f), True)
        lib.release_int(byref(out_types_v), True)
        
        
        return _data
# ---------- end solver_22 ----------
cap = CapHoles(Brep=extr)  # -> simplify(graft(Brep))
solver_23 = Solver(
    data=input_set_2,
    joint_p=joint_parameters_2,
    find=number_slider_25,
    get=number_slider_26,
    custom_joints=filter_3,
    custom_types=filter_4)  # -> data; inputs joint_p: list, scale: list, extension: list, find: Int32, get: Int32, custom_joints: list of Polyline, custom_types: list of Int32; same code as solver_22
cap_2 = CapHoles(Brep=extr_2)  # -> simplify(graft(Brep))
# custome types
# 3 joints
panel_15 = Panel(filter_2)
# custome types
# 3 joint types
panel_16 = Panel(filter_4)
input_get = Input_get(data=solver_22)  # -> graft(plines_0), graft(plines_1), graft(lines), insertion_vectors, joints_per_face, three_valence, adjacency; inputs split: Boolean
#   port data: collection of inputs that represent the elements, insertion vectors, joint types and adjacency, use input_set commonent to group these inputs
# ---------- input_get: Python ----------
from ghpythonlib.componentbase import executingcomponent as component
import Grasshopper, GhPython
import System

__author__ = "petras"
__version__ = "2023.04.02"

import ghpythonlib.treehelpers as th
from Rhino.Geometry import Polyline
import Rhino
import rhinoscriptsyntax as rs

class MyComponent(component):
    
    def RunScript(self, _data, _split):
        
        if(_data is None):
            return
        
        split = True if _split is None else _split
        
        _plines_0 =  Grasshopper.DataTree[Rhino.Geometry.Curve]()
        _plines_1 =  Grasshopper.DataTree[Rhino.Geometry.Curve]()
        _lines =  Grasshopper.DataTree[Rhino.Geometry.Curve]()
        if(split == False):
            for i in range(len(_data[0])):
                for j in range(len(_data[0][i])):
                    _plines_0.Add(_data[0][i][j].ToNurbsCurve(),Grasshopper.Kernel.Data.GH_Path(i))
        else:
            for i in range(len(_data[0])):
                for j in range(len(_data[0][i])):
                    if(_data[0][i][j].Count == 2):
                        _lines.Add(_data[0][i][j].ToNurbsCurve(),Grasshopper.Kernel.Data.GH_Path(i))
                    else:
                        if(j%2==0):
                            print(_data[0][i][j])
                            _plines_0.Add(_data[0][i][j].ToNurbsCurve(),Grasshopper.Kernel.Data.GH_Path(i))
                        else:
                            _plines_1.Add(_data[0][i][j].ToNurbsCurve(),Grasshopper.Kernel.Data.GH_Path(i))
                #
        
        _insertion_vectors =  th.list_to_tree(_data[1])
        _joints_per_face =  th.list_to_tree(_data[2])
        _three_valence = th.list_to_tree(_data[3])
        _adjacency =th.list_to_tree(_data[4])
        
        # return outputs if you have them; here I try it for you:
        return (_plines_0,_plines_1, _lines, _insertion_vectors, _joints_per_face, _three_valence, _adjacency)
# ---------- end input_get ----------
input_get_2 = Input_get(data=solver_23)  # -> graft(plines_0), graft(plines_1), graft(lines), insertion_vectors, joints_per_face, three_valence, adjacency; inputs split: Boolean; same code as input_get
loft_b = Loft_brep(p0=input_get.plines_0, p1=input_get.plines_1, c=ColourSwatch(SwatchColor=RGB(0, 149, 255)))  # -> brep; inputs p0: list of Curve, p1: list of Curve, c: Color
#   port p0: polylines with holes, bottom
#   port p1: polylines with holes, top
#   port c: color, if given all the brep is colorized else only the sides, this is useful for boolean difference
#   port brep: lofted and capped brep with holes
# ---------- loft_b: Python ----------
"""get joints ids and connections areas between elements"""

__author__ = "petras vestartas"
__version__ = "2023.03.31"


from ghpythonlib.componentbase import executingcomponent as component
import Rhino.RhinoDoc
import Rhino.Geometry
import Rhino.RhinoMath
from System.Drawing import Color


class connections_zones(component):
    def loft_polylines_with_holes(self, curves0, curves1, color):
        """Loft polylines with holes

        Parameters
        ----------
        curves0 : list[rg.Polyline]
        curves1 : list[rg.Polyline]

        Returns
        -------
        rg.Brep
            brep as lofted polylines and cap them
        """

        ###############################################################################
        # user input
        ###############################################################################
        
        if(curves0 == [None]):
            return
        if(curves1 == [None]):
            return
        print(curves0)
        if(len(curves0) == 0):
            return
        if(len(curves1) == 0):
            return
        
        flag = len(curves0) is not 0 if True else len(curves1) != 0
        if flag:
            curves = []
            curves2 = []

            flag0 = len(curves1) == 0
            flag1 = len(curves0) == 0 and len(curves1) != 0
            flag2 = len(curves0) and len(curves1)

            if flag0:
                for i in range(len(curves0)):
                    if float(i) >= float(len(curves0)) * 0.5:
                        curves2.Add(curves0[i])
                    else:
                        curves.Add(curves0[i])
            elif flag1:
                for i in range(0, len(curves1), 2):
                    curves.Add(curves1[i])
                    curves2.Add(curves1[i + 1])
            elif flag2:
                curves = curves0
                curves2 = curves1

            curves0 = curves
            curves1 = curves2

        ###############################################################################
        # Create mesh of the bottom face
        ###############################################################################
        brep_bottom = Rhino.Geometry.Brep.CreatePlanarBreps(
            curves0, Rhino.RhinoDoc.ActiveDoc.ModelAbsoluteTolerance*100
        )[0]
        
        
        brep_top = Rhino.Geometry.Brep.CreatePlanarBreps(
            curves1, Rhino.RhinoDoc.ActiveDoc.ModelAbsoluteTolerance*100
        )[0]

        ###############################################################################
        # Create lofts
        ###############################################################################
        breps_to_join = [brep_bottom, brep_top]
        for i in range(len(curves0)):
            wall = Rhino.Geometry.Brep.CreateFromLoft(
                [curves0[i], curves1[i]],
                Rhino.Geometry.Point3d.Unset,
                Rhino.Geometry.Point3d.Unset,
                Rhino.Geometry.LoftType.Normal,
                False,
            )[0]
            breps_to_join.append(wall)

        ###############################################################################
        # Join Brep
        ###############################################################################
        solid = Rhino.Geometry.Brep.JoinBreps(
            breps_to_join, Rhino.RhinoDoc.ActiveDoc.ModelAbsoluteTolerance*10
        )[0]
        
        faces = []
        for i in range(solid.Faces.Count):
            faces.append(solid.Faces[i].DuplicateFace(False))
        
        solid = Rhino.Geometry.Brep.JoinBreps(
            faces, Rhino.RhinoDoc.ActiveDoc.ModelAbsoluteTolerance*10
        )[0]
        
        
        if solid:
            solid.Faces.SplitKinkyFaces(Rhino.RhinoMath.DefaultAngleTolerance, True)
            
            if (Rhino.Geometry.BrepSolidOrientation.Inward is solid.SolidOrientation):
              solid.Flip();
            
        
        if(color is not None):
            for i in range(solid.Faces.Count):
                solid.Faces[i].PerFaceColor = color
        else:
            for i in range(solid.Faces.Count):
                if i < 2:
                    solid.Faces[i].PerFaceColor = Color.LightGray  # Color.LightGray
                else:
                    solid.Faces[i].PerFaceColor = Color.DeepPink

        return solid

    def RunScript(self, _p0, _p1, _c):
        if _p0 and _p1:
            return self.loft_polylines_with_holes(_p0, _p1, _c)
# ---------- end loft_b ----------
loft_b_2 = Loft_brep(p0=input_get_2.plines_0, p1=input_get_2.plines_1, c=ColourSwatch(SwatchColor=RGB(0, 149, 255)))  # -> brep; inputs p0: list of Curve, p1: list of Curve, c: Color; same code as loft_b
number_slider_27 = Slider(2, range=0..10)
trim = TrimTree(Tree=loft_b, Depth=1)
trim_2 = TrimTree(Tree=loft_b_2, Depth=1)
branch = TreeBranch(Tree=trim, Path=number_slider_27, MaintainPaths=True)
branch_2 = TreeBranch(Tree=cap, Path=number_slider_27, MaintainPaths=True)
branch_3 = TreeBranch(Tree=trim_2, Path=number_slider_10, MaintainPaths=True)
branch_4 = TreeBranch(Tree=cap_2, Path=number_slider_10, MaintainPaths=True)
sunion = SolidUnion(Breps=branch)
sunion_2 = SolidUnion(Breps=branch_3)
sdiff = SolidDifference(BrepsA=branch_2, BrepsB=sunion)
sdiff_2 = SolidDifference(BrepsA=branch_4, BrepsB=sunion_2)
move_12 = Move(Geometry=sdiff, Motion=Vector(0, 2000, 0))  # -> Geometry, Transform
move_13 = Move(Geometry=sdiff_2, Motion=Vector(0, 2000, 0))  # -> Geometry, Transform
bake = BakeGeometry(Bake=True, Geometry=move_12.Geometry, DeleteOldBakes=False, PreserveTrees=False)
bake_2 = BakeGeometry(Bake=True, Geometry=move_13.Geometry, DeleteOldBakes=False, PreserveTrees=False)
