# Grasshopper definition export_error2.ghx (Grasshopper 1.0.8)
# plug-ins: RhinoCodePluginGH

data = Data("Add_01")
file_path = FilePath("C:\Users\eleni\workspace\projects\diffCheck\assets\dataset\00_Additive\01")
panel = Panel(file_path)
panel_2 = Panel(data)

joints = Brep(flatten([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]))
data_2 = Data(data)
file_path_2 = FilePath(file_path)
dfxmlexporter = DFXMLExporter(i_dump=Button(), i_assembly_name=data_2, i_export_dir=file_path_2)  # -> o_xml, o_joints, o_sides; inputs i_dump: Boolean, i_assembly_name: String, i_export_dir: String, i_breps: list of Brep
#   port i_dump: Press button to export xml
#   port i_assembly_name: The name of the assembly to export.
#   port i_export_dir: The directors where to export the xml file.
#   port i_breps: The breps of the structure.
#   port o_xml: The string of xml to be exported.
#   port o_joints: The breps of the faces belonging to joints.
#   port o_sides: The breps of the faces belonging to sides.
# ---------- dfxmlexporter: Python ----------
#! python3
# r: diffCheck==0.0.9

import System
import typing

import Rhino
import Rhino.Geometry as rg

from ghpythonlib.componentbase import executingcomponent as component

import diffCheck
from diffCheck.df_geometries import DFBeam, DFAssembly


class DFXMLExporter(component):
    def RunScript(self,
            i_dump: bool,
            i_assembly_name: str,
            i_export_dir: str,
            i_breps: System.Collections.Generic.IList[Rhino.Geometry.Brep]):
        """
            This read breps from Rhino, converts them to DFBeams and DFAssemblies, and exports them to XML.
            
            :param i_dump: whether to dump the xml
            :param i_export_dir: directory to export the xml
            :param i_breps: list of breps
        """
        # beams
        beams: typing.List[DFBeam] = []
        for brep in i_breps:
            beam = DFBeam.from_brep(brep)
            beams.append(beam)

        # assembly
        assembly1 = DFAssembly(beams, i_assembly_name)

        # dump the xml
        xml: str = assembly1.to_xml()
        if i_dump:
            assembly1.dump_xml(xml, i_export_dir)
        o_xml = xml

        # show the joint/side faces
        o_joints = [jf.to_brep() for jf in assembly1.all_joint_faces]
        o_sides = [sf.to_brep() for sf in assembly1.all_side_faces]

        return o_xml, o_joints, o_sides
# ---------- end dfxmlexporter ----------
surface = Surface()
surface_2 = Surface()
custom_preview = CustomPreview(Geometry=surface_2, Material=ColourSwatch(SwatchColor=RGB(201, 61, 255)))
custom_preview_2 = CustomPreview(Geometry=surface, Material=ColourSwatch(SwatchColor=RGB(87, 64, 255)))
