# Grasshopper definition morticeTenon.gh (Grasshopper 1.0.7)

number_slider = Slider(30, range=0..100)
number_slider_2 = Slider(200, range=0..1000)
Y = Slider(12, range=0..43.5)
Z = Slider(22, range=0..73.5)
dom = ConstructDomain(DomainStart=expr("-x/2", number_slider), DomainEnd=expr("x/2", number_slider))
dom_2 = ConstructDomain(DomainStart=expr("-x/2", Y), DomainEnd=expr("x/2", Y))
dom_3 = ConstructDomain(DomainStart=expr("-x/2", Z), DomainEnd=expr("x/2", Z))
box = CenterBox(Base=PlaneXY(0, 0, 0), X=expr("x/2", number_slider), Y=expr("x/2", number_slider), Z=expr("x/2", number_slider_2))
pt = ConstructPoint(XCoordinate=expr("x/2", number_slider), YCoordinate=0, ZCoordinate=0)
box_2 = DomainBox(Base=pt, X=Slider(22, range=0..33.5, expression="-x"), Y=dom_2, Z=dom_3)
box_3 = DomainBox(Base=pt, X=number_slider_2, Y=dom, Z=dom)
Y_2 = UnitY(Factor=1)
rad = Radians(Degrees=Slider(27.8, range=0..100))
move = Move(Geometry=pt, Motion=Y_2)  # -> Geometry, Transform
sunion = SolidUnion(Breps=[box_3, box_2])
ln = Line(StartPoint=pt, EndPoint=move.Geometry)
rotax = RotateAxis(Geometry=box_3, Angle=rad, Axis=ln)  # -> Geometry, Transform
rotax_2 = RotateAxis(Geometry=box_2, Angle=rad, Axis=ln)  # -> Geometry, Transform
X = UnitX(Factor=Slider(4.57, range=0..12))
move_2 = Move(Geometry=sunion, Motion=X)  # -> Geometry, Transform
sdiff = SolidDifference(BrepsA=box, BrepsB=box_2)
