# Grasshopper definition dynamiclogo.gh (Grasshopper 1.0.8)
# plug-ins: RhinoCodePluginGH, Pufferfish, EleFront

reset = Button()  # disabled
button = Button()  # disabled
trigger = Trigger(Interval=-1, TimerInterval=5)  # disabled
scsy_cpy = ScriptSyncCpython(btn=Button())  # -> stdout, o_tree, o_combinations, o_seem_start, o_scale_f, o_thickness, o_number_ctrl_pts, o_dist_from_centers, o_tightness; inputs btn: Boolean, packages_2_reload: list
#   port btn: Connect a button to open a file dialog to select a cpython file to run.
#   port packages_2_reload: Pass a list with the name of the custom packages you want to reload. This function is useful if you are developing a i.e. PyPI package and you want to reload the submodules after you modified something. The function will reload the package and all its submodules. If you want to reload the package and all its submodules, just pass the package name. If you want to reload only a submodule, pass the package name and the submodule name separated by a dot. If you want to reload multiple submodules, pass the package
#   port stdout: The redirected standard output of the component scriptsync.
#   port o_seem_start: Generic example output of the component
# ---------- scsy_cpy: Python ----------
from ghpythonlib.componentbase import executingcomponent as component

import System
import System.Drawing
import System.Windows.Forms
import Rhino
import Grasshopper
import Grasshopper as gh
from Grasshopper.Kernel import GH_RuntimeMessageLevel as RML
import sys
import os
import time

import contextlib
import io

import abc
import socket
import threading
import queue
import json

import importlib
import sys


class GHThread(threading.Thread, metaclass=abc.ABCMeta):
    """
        A base class for Grasshopper threads.
    """
    def __init__(self, name : str):
        super().__init__(name=name, daemon=False)
        self._component_on_canvas = True
        self._component_enabled = True

    @abc.abstractmethod
    def run(self):
        """ Run the thread. """
        pass

    def _check_if_component_on_canvas(self):
        """ Check if the component is on canvas from thread. """
        def __check_if_component_on_canvas():
            if ghenv.Component.OnPingDocument() is None:
                self._component_on_canvas = False
                return False
            else:
                self._component_on_canvas = True
                return True
        action = System.Action(__check_if_component_on_canvas)
        Rhino.RhinoApp.InvokeOnUiThread(action)

    def _check_if_component_enabled(self):
        """ Check if the component is enabled from thread. """
        def __check_if_component_enabled():
            if ghenv.Component.Locked:
                self._component_enabled = False
            else:
                self._component_enabled = True
        action = System.Action(__check_if_component_enabled)
        Rhino.RhinoApp.InvokeOnUiThread(action)

    def expire_component_solution(self):
        """ Fire the recalculation of the component solution from thread. """
        def __expire_component_solution():
            ghenv.Component.Params.Output[0].ClearData()  # clear the output
            ghenv.Component.ExpireSolution(True)  # expire the component
        action = System.Action(__expire_component_solution)
        Rhino.RhinoApp.InvokeOnUiThread(action)

    def clear_component(self):
        """ Clear the component from thread. """
        def __clear_component():
            ghenv.Component.ClearData()
        action = System.Action(__clear_component)
        Rhino.RhinoApp.InvokeOnUiThread(action)

    def add_runtime_warning(self, exception : str):
        """ Add a warning tab to the component from main thread. """
        action = System.Action(
            lambda: ghenv.Component.AddRuntimeMessage(RML.Warning, exception)
        )
        Rhino.RhinoApp.InvokeOnUiThread(action)

    def add_runtime_error(self, exception : str):
        """ Add an error tab to the component from main thread. """
        action = System.Action(
            lambda: ghenv.Component.AddRuntimeMessage(RML.Error, exception)
        )
        Rhino.RhinoApp.InvokeOnUiThread(action)

    def add_runtime_remark(self, exception : str):
        """ Add a blank tab to the component from main thread. """
        action = System.Action(
            lambda: ghenv.Component.AddRuntimeMessage(RML.Remark, exception)
        )
        Rhino.RhinoApp.InvokeOnUiThread(action)

    @property
    def component_enabled(self):
        self._check_if_component_enabled()
        return self._component_enabled

    @property
    def component_on_canvas(self):
        self._check_if_component_on_canvas()
        return self._component_on_canvas

class ClientThread(GHThread):
    """
    A thread to connect to the VSCode server.
    """
    def __init__(self, vscode_server_ip: str, vscode_server_port: int, name: str,
                 queue_msg: queue.Queue = None, lock_queue_msg: threading.Lock = None,
                 event_fire_msg: threading.Event = None):
        super().__init__(name=name)
        self.vscode_server_ip = vscode_server_ip
        self.vscode_server_port = vscode_server_port
        self.is_connected = False
        self.connect_refresh_rate = 1  # seconds
        self.queue_msg = queue_msg
        self.lock_queue_msg = lock_queue_msg
        self.event_fire_msg = event_fire_msg
        self.client_socket = socket.socket(socket.AF_INET, socket.SOCK_STREAM)

    def run(self):
        """ Run the thread. Send the message to the vscode server."""
        while self.component_on_canvas and self.component_enabled:
            try:
                if not self.is_connected:
                    self.connect_to_vscode_server()
                    self.clear_component()
                    self.expire_component_solution()
                    continue

                self.event_fire_msg.wait()
                self.send_message_from_queue()

            except Exception as e:
                self.add_runtime_warning(f"script-sync::Unkown error from run: {str(e)}")
                self.is_connected = False
                self.client_socket = socket.socket(socket.AF_INET, socket.SOCK_STREAM)

        self.client_socket.close()

    def send_message_from_queue(self):
        with self.lock_queue_msg:
            if self.queue_msg and not self.queue_msg.empty():
                msg = self.queue_msg.get()
                self.queue_msg.task_done()
                self.event_fire_msg.set()
                self.event_fire_msg.clear()
                self.client_socket.send(msg)

    def connect_to_vscode_server(self):
        """ Connect to the VSCode server. """
        while self.component_on_canvas and not self.is_connected:
            try:
                self.client_socket.send(b"")
                self.is_connected = True
            except socket.error:
                try:
                    self.client_socket.connect((self.vscode_server_ip, self.vscode_server_port))
                    self.is_connected = True
                except (ConnectionRefusedError, ConnectionResetError, socket.error) as e:
                    self.handle_connection_error(e)
            finally:
                time.sleep(self.connect_refresh_rate)

    def handle_connection_error(self, e):
        error_messages = {
            ConnectionRefusedError: "script-sync::Connection refused by the vscode",
            ConnectionResetError: "script-sync::Connection was forcibly closed by the vscode",
            socket.error: f"script-sync::Error connecting to the vscode: {str(e)}"
        }
        self.add_runtime_warning(error_messages[type(e)])
        self.is_connected = False if type(e) != socket.error or e.winerror != 10056 else True

class FileChangedThread(GHThread):
    """
        A thread to check if the file has changed on disk.
    """
    def __init__(self,
                path : str,
                name : str
                ):
        super().__init__(name=name)
        self.path = path
        self.refresh_rate = 1000  # milliseconds
        self._on_file_changed = threading.Event()

    def run(self):
        """
            Check if the file has changed on disk.
        """
        last_modified = os.path.getmtime(self.path)
        while self.component_on_canvas and not self._on_file_changed.is_set():
            System.Threading.Thread.Sleep(self.refresh_rate)
            last_modified = self.is_file_modified(last_modified)
        self._on_file_changed.clear()
        return

    def stop(self):
        """ Stop the thread. """
        self._on_file_changed.set()

    def is_file_modified(self, last_modified):
        current_modified = os.path.getmtime(self.path)
        if current_modified != last_modified:
            self.expire_component_solution()
            return current_modified
        return last_modified


class ScriptSyncCPy(component):
    def __init__(self):
        super(ScriptSyncCPy, self).__init__()
        self._var_output = []

        self.is_success = False

        self.client_thread_name : str = f"script-sync-client-thread::{ghenv.Component.InstanceGuid}"
        self.vscode_server_ip = "127.0.0.1"
        self.vscode_server_port = 58260
        self.stdout = None
        self.queue_msg = queue.Queue()
        self.queue_msg_lock = threading.Lock()
        self.event_fire_msg = threading.Event()

        self.filechanged_thread_name : str = f"script-sync-fileChanged-thread::{ghenv.Component.InstanceGuid}"
        self.__path_name_table_value = "script-sync::" + "path::" + str(ghenv.Component.InstanceGuid)
        if self.path is None:
            ghenv.Component.Message = "select-script"

    def RemovedFromDocument(self, doc):
        """ Remove the component from the document. """
        if self.client_thread_name in [t.name for t in threading.enumerate()]:
            client_thread = [t for t in threading.enumerate() if t.name == self.client_thread_name][0]
            client_thread.join()
        if self.filechanged_thread_name in [t.name for t in threading.enumerate()]:
            filechanged_thread = [t for t in threading.enumerate() if t.name == self.filechanged_thread_name][0]
            filechanged_thread.join()
        if self.queue_msg is not None:
            self.queue_msg.join()
        if self.queue_msg_lock is not None:
            self.queue_msg_lock.release()
        if self.event_fire_msg is not None:
            self.event_fire_msg.clear()

        # clear the path from the table view
        del self.path

    def init_script_path(self, btn : bool = False):
        """
            Check if the button is pressed and load/change path script.
            
            :param btn: A boolean of the button
        """
        # check if button is pressed
        if btn is True:
            dialog = System.Windows.Forms.OpenFileDialog()
            dialog.Filter = "Python files (*.py)|*.py"
            dialog.Title = "Select a Python file"
            dialog.InitialDirectory = os.path.dirname("")
            dialog.FileName = ""
            dialog.Multiselect = False
            dialog.CheckFileExists = True
            dialog.CheckPathExists = True
            dialog.RestoreDirectory = True
            if dialog.ShowDialog() == System.Windows.Forms.DialogResult.OK:
                self.path = dialog.FileName

        # default init stauts
        if self.path is None:
            raise Exception("script-sync::File not selected")

        # fi file is in table view before
        if not os.path.exists(self.path):
            raise Exception("script-sync::File does not exist")
    
    def reload_all_modules(self, directory):
        for filename in os.listdir(directory):
            if filename.endswith('.py') and filename != '__init__.py':
                module_name = filename[:-3]  # remove '.py' from filename
                if module_name in sys.modules:
                    importlib.reload(sys.modules[module_name])

    def safe_exec(self, path, globals, locals, packages_2_reload):
        """
            Execute Python3 code safely. It redirects the output of the code
            to a string buffer 'stdout' to output to the GH component param.
            It is send to the vscode server.
            
            :param path: The path of the file to execute.
            :param globals: The globals dictionary.
            :param locals: The locals dictionary.
            :param packages_2_reload: The list of packages to reload, this is used for custom packages developement.
            installed on the system via an editable pip installation for example.
        """
        try:
            with open(path, 'r') as f:
                # reload the specifyed packages
                if packages_2_reload is not None:
                    if packages_2_reload.__len__() != 0:
                        for package in packages_2_reload:
                            for key in list(sys.modules.keys()):
                                if package in key:
                                    #check that the package must have the attribute __file__ (to avoid reloading pyd)
                                    if hasattr(sys.modules[key], '__file__'):
                                        importlib.reload(sys.modules[key])

                # add the path and sub directories to  the sys path
                path_dir = os.path.dirname(path)
                sub_dirs = []
                for root, dirs, files in os.walk(path_dir):
                    for d in dirs:
                        sub_dirs.append(os.path.join(root, d))
                sys.path.extend([path_dir] + sub_dirs)

                # reload all the modules also of the sub directories
                for root, dirs, files in os.walk(path_dir):
                    for d in dirs:
                        self.reload_all_modules(os.path.join(root, d))
                self.reload_all_modules(path_dir)

                # refresh the python interpreter
                importlib.invalidate_caches()

                # parse the code
                code = compile(f.read(), path, 'exec')
                output = io.StringIO()

                # empty the queue and event
                with self.queue_msg_lock:
                    while not self.queue_msg.empty():
                        self.queue_msg.get()
                        self.queue_msg.task_done()
                self.event_fire_msg.clear()

                # execute the code
                with contextlib.redirect_stdout(output):
                    exec(code, globals, locals)
                locals["stdout"] = output.getvalue()

                # send the msg to the vscode server
                msg_json = json.dumps({"script_path": path,
                                       "guid": str(ghenv.Component.InstanceGuid),
                                       "msg": output.getvalue()})
                msg_json = msg_json.encode('utf-8')
                self.queue_msg.put(msg_json)
                self.event_fire_msg.set()

                # pass the script variables to the GH component outputs
                outparam = ghenv.Component.Params.Output
                outparam_names = [p.NickName for p in outparam]
                for outp in outparam_names:
                    if outp in locals.keys():
                        self._var_output.append(locals[outp])
                    else:
                        self._var_output.append(None)

                sys.stdout = sys.__stdout__
            return locals

        except Exception as e:

            # send the error message to the vscode server
            err_json = json.dumps({"script_path": path,
                                    "guid": str(ghenv.Component.InstanceGuid),
                                    "msg": "err:" + str(e)})
            err_json = err_json.encode('utf-8')
            self.queue_msg.put(err_json)
            self.event_fire_msg.set()
            
            sys.stdout = sys.__stdout__

            err_msg = f"script-sync::Error in the code: {str(e)}"
            raise Exception(err_msg)

    def RunScript(self,
            btn: bool,
            packages_2_reload: System.Collections.Generic.IList[object]):
        """ This method is called whenever the component has to be recalculated it's the solve main instance. """
        self.is_success = False

        # set the path if button is pressed
        self.init_script_path(btn)

        # file change listener thread
        if self.filechanged_thread_name not in [t.name for t in threading.enumerate()]:
            FileChangedThread(self.path,
                              self.filechanged_thread_name
                              ).start()

        # set up the tcp client to connect to the vscode server
        _ = [print(t.name) for t in threading.enumerate()]
        if self.client_thread_name not in [t.name for t in threading.enumerate()]:
            ClientThread(self.vscode_server_ip,
                        self.vscode_server_port,
                        self.client_thread_name,
                        self.queue_msg,
                        self.queue_msg_lock,
                        self.event_fire_msg
                        ).start()

        # add to the globals all the input parameters of the component (the locals)
        globals().update(locals())

        res = self.safe_exec(self.path, None, globals(), packages_2_reload)
        self.is_success = True
        return

    def AfterRunScript(self):
        """
            This method is called as soon as the component has finished
            its calculation. It is used to load the GHComponent outputs
            with the values created in the script.
        """
        if not self.is_success:
            return
        outparam = [p for p in ghenv.Component.Params.Output]
        outparam_names = [p.NickName for p in outparam]
        
        # TODO: add the conversion to datatree for nested lists and tuples
        for idx, outp in enumerate(outparam):
            # detect if the output is a list
            if type(self._var_output[idx]) == list or type(self._var_output[idx]) == tuple:
                ghenv.Component.Params.Output[idx].VolatileData.Clear()
                ghenv.Component.Params.Output[idx].AddVolatileDataList(gh.Kernel.Data.GH_Path(0), self._var_output[idx])
            else:
                ghenv.Component.Params.Output[idx].VolatileData.Clear()
                ghenv.Component.Params.Output[idx].AddVolatileData(gh.Kernel.Data.GH_Path(0), 0, self._var_output[idx])
        self._var_output.clear()

    @property
    def path(self):
        """ Get the path of the file from the table view to be sticking between the sessions. """
        table_value = ghenv.Component.OnPingDocument().ValueTable.GetValue(
            self.__path_name_table_value, "not_found"
        )
        if table_value != "not_found":
            return table_value
        else:
            return None

    @path.setter
    def path(self, path : str):
        """ Set the path of the file to the table view to be sticking between the sessions. """
        ghenv.Component.OnPingDocument().ValueTable.SetValue(self.__path_name_table_value, path)

        script_name = os.path.basename(path)
        ghenv.Component.Message = f"{script_name}"

        if self.filechanged_thread_name in [t.name for t in threading.enumerate()]:
            _ = [t for t in threading.enumerate() if t.name == self.filechanged_thread_name][0].stop()

    @path.deleter
    def path(self):
        """ Delete the path of the file from the table view if the object is erased. """
        ghenv.Component.OnPingDocument().ValueTable.DeleteValue(self.__path_name_table_value)
# ---------- end scsy_cpy ----------
scsy_cpy_2 = ScriptSyncCpython(btn=button, i_reset=reset)  # -> stdout, o_index; inputs btn: Boolean, packages_2_reload: list of String, i_reset: Boolean; disabled
#   port btn: Connect a button to open a file dialog to select a cpython file to run.
#   port packages_2_reload: Pass a list with the name of the custom packages you want to reload. This function is useful if you are developing a i.e. PyPI package and you want to reload the submodules after you modified something. The function will reload the package and all its submodules. If you want to reload the package and all its submodules, just pass the package name. If you want to reload only a submodule, pass the package name and the submodule name separated by a dot. If you want to reload multiple submodules, pass the package
#   port i_reset: A generic x input.
#   port stdout: The redirected standard output of the component scriptsync.
#   port o_index: Generic example output of the component
# ---------- scsy_cpy_2: Python ----------
from ghpythonlib.componentbase import executingcomponent as component

import System
import System.Drawing
import System.Windows.Forms
import Rhino
import Grasshopper
import Grasshopper as gh
from Grasshopper.Kernel import GH_RuntimeMessageLevel as RML
import sys
import os
import time

import contextlib
import io

import abc
import socket
import threading
import queue
import json

import importlib
import sys


class GHThread(threading.Thread, metaclass=abc.ABCMeta):
    """
        A base class for Grasshopper threads.
    """
    def __init__(self, name : str):
        super().__init__(name=name, daemon=False)
        self._component_on_canvas = True
        self._component_enabled = True

    @abc.abstractmethod
    def run(self):
        """ Run the thread. """
        pass

    def _check_if_component_on_canvas(self):
        """ Check if the component is on canvas from thread. """
        def __check_if_component_on_canvas():
            if ghenv.Component.OnPingDocument() is None:
                self._component_on_canvas = False
                return False
            else:
                self._component_on_canvas = True
                return True
        action = System.Action(__check_if_component_on_canvas)
        Rhino.RhinoApp.InvokeOnUiThread(action)

    def _check_if_component_enabled(self):
        """ Check if the component is enabled from thread. """
        def __check_if_component_enabled():
            if ghenv.Component.Locked:
                self._component_enabled = False
            else:
                self._component_enabled = True
        action = System.Action(__check_if_component_enabled)
        Rhino.RhinoApp.InvokeOnUiThread(action)

    def expire_component_solution(self):
        """ Fire the recalculation of the component solution from thread. """
        def __expire_component_solution():
            ghenv.Component.Params.Output[0].ClearData()  # clear the output
            ghenv.Component.ExpireSolution(True)  # expire the component
        action = System.Action(__expire_component_solution)
        Rhino.RhinoApp.InvokeOnUiThread(action)

    def clear_component(self):
        """ Clear the component from thread. """
        def __clear_component():
            ghenv.Component.ClearData()
        action = System.Action(__clear_component)
        Rhino.RhinoApp.InvokeOnUiThread(action)

    def add_runtime_warning(self, exception : str):
        """ Add a warning tab to the component from main thread. """
        action = System.Action(
            lambda: ghenv.Component.AddRuntimeMessage(RML.Warning, exception)
        )
        Rhino.RhinoApp.InvokeOnUiThread(action)

    def add_runtime_error(self, exception : str):
        """ Add an error tab to the component from main thread. """
        action = System.Action(
            lambda: ghenv.Component.AddRuntimeMessage(RML.Error, exception)
        )
        Rhino.RhinoApp.InvokeOnUiThread(action)

    def add_runtime_remark(self, exception : str):
        """ Add a blank tab to the component from main thread. """
        action = System.Action(
            lambda: ghenv.Component.AddRuntimeMessage(RML.Remark, exception)
        )
        Rhino.RhinoApp.InvokeOnUiThread(action)

    @property
    def component_enabled(self):
        self._check_if_component_enabled()
        return self._component_enabled

    @property
    def component_on_canvas(self):
        self._check_if_component_on_canvas()
        return self._component_on_canvas

class ClientThread(GHThread):
    """
    A thread to connect to the VSCode server.
    """
    def __init__(self, vscode_server_ip: str, vscode_server_port: int, name: str,
                 queue_msg: queue.Queue = None, lock_queue_msg: threading.Lock = None,
                 event_fire_msg: threading.Event = None):
        super().__init__(name=name)
        self.vscode_server_ip = vscode_server_ip
        self.vscode_server_port = vscode_server_port
        self.is_connected = False
        self.connect_refresh_rate = 1  # seconds
        self.queue_msg = queue_msg
        self.lock_queue_msg = lock_queue_msg
        self.event_fire_msg = event_fire_msg
        self.client_socket = socket.socket(socket.AF_INET, socket.SOCK_STREAM)

    def run(self):
        """ Run the thread. Send the message to the vscode server."""
        while self.component_on_canvas and self.component_enabled:
            try:
                if not self.is_connected:
                    self.connect_to_vscode_server()
                    self.clear_component()
                    self.expire_component_solution()
                    continue

                self.event_fire_msg.wait()
                self.send_message_from_queue()

            except Exception as e:
                self.add_runtime_warning(f"script-sync::Unkown error from run: {str(e)}")
                self.is_connected = False
                self.client_socket = socket.socket(socket.AF_INET, socket.SOCK_STREAM)

        self.client_socket.close()

    def send_message_from_queue(self):
        with self.lock_queue_msg:
            if self.queue_msg and not self.queue_msg.empty():
                msg = self.queue_msg.get()
                self.queue_msg.task_done()
                self.event_fire_msg.set()
                self.event_fire_msg.clear()
                self.client_socket.send(msg)

    def connect_to_vscode_server(self):
        """ Connect to the VSCode server. """
        while self.component_on_canvas and not self.is_connected:
            try:
                self.client_socket.send(b"")
                self.is_connected = True
            except socket.error:
                try:
                    self.client_socket.connect((self.vscode_server_ip, self.vscode_server_port))
                    self.is_connected = True
                except (ConnectionRefusedError, ConnectionResetError, socket.error) as e:
                    self.handle_connection_error(e)
            finally:
                time.sleep(self.connect_refresh_rate)

    def handle_connection_error(self, e):
        error_messages = {
            ConnectionRefusedError: "script-sync::Connection refused by the vscode",
            ConnectionResetError: "script-sync::Connection was forcibly closed by the vscode",
            socket.error: f"script-sync::Error connecting to the vscode: {str(e)}"
        }
        self.add_runtime_warning(error_messages[type(e)])
        self.is_connected = False if type(e) != socket.error or e.winerror != 10056 else True

class FileChangedThread(GHThread):
    """
        A thread to check if the file has changed on disk.
    """
    def __init__(self,
                path : str,
                name : str
                ):
        super().__init__(name=name)
        self.path = path
        self.refresh_rate = 1000  # milliseconds
        self._on_file_changed = threading.Event()

    def run(self):
        """
            Check if the file has changed on disk.
        """
        last_modified = os.path.getmtime(self.path)
        while self.component_on_canvas and not self._on_file_changed.is_set():
            System.Threading.Thread.Sleep(self.refresh_rate)
            last_modified = self.is_file_modified(last_modified)
        self._on_file_changed.clear()
        return

    def stop(self):
        """ Stop the thread. """
        self._on_file_changed.set()

    def is_file_modified(self, last_modified):
        current_modified = os.path.getmtime(self.path)
        if current_modified != last_modified:
            self.expire_component_solution()
            return current_modified
        return last_modified


class ScriptSyncCPy(component):
    def __init__(self):
        super(ScriptSyncCPy, self).__init__()
        self._var_output = []

        self.is_success = False

        self.client_thread_name : str = f"script-sync-client-thread::{ghenv.Component.InstanceGuid}"
        self.vscode_server_ip = "127.0.0.1"
        self.vscode_server_port = 58260
        self.stdout = None
        self.queue_msg = queue.Queue()
        self.queue_msg_lock = threading.Lock()
        self.event_fire_msg = threading.Event()

        self.filechanged_thread_name : str = f"script-sync-fileChanged-thread::{ghenv.Component.InstanceGuid}"
        self.__path_name_table_value = "script-sync::" + "path::" + str(ghenv.Component.InstanceGuid)
        if self.path is None:
            ghenv.Component.Message = "select-script"

    def RemovedFromDocument(self, doc):
        """ Remove the component from the document. """
        if self.client_thread_name in [t.name for t in threading.enumerate()]:
            client_thread = [t for t in threading.enumerate() if t.name == self.client_thread_name][0]
            client_thread.join()
        if self.filechanged_thread_name in [t.name for t in threading.enumerate()]:
            filechanged_thread = [t for t in threading.enumerate() if t.name == self.filechanged_thread_name][0]
            filechanged_thread.join()
        if self.queue_msg is not None:
            self.queue_msg.join()
        if self.queue_msg_lock is not None:
            self.queue_msg_lock.release()
        if self.event_fire_msg is not None:
            self.event_fire_msg.clear()

        # clear the path from the table view
        del self.path

    def init_script_path(self, btn : bool = False):
        """
            Check if the button is pressed and load/change path script.
            
            :param btn: A boolean of the button
        """
        # check if button is pressed
        if btn is True:
            dialog = System.Windows.Forms.OpenFileDialog()
            dialog.Filter = "Python files (*.py)|*.py"
            dialog.Title = "Select a Python file"
            dialog.InitialDirectory = os.path.dirname("")
            dialog.FileName = ""
            dialog.Multiselect = False
            dialog.CheckFileExists = True
            dialog.CheckPathExists = True
            dialog.RestoreDirectory = True
            if dialog.ShowDialog() == System.Windows.Forms.DialogResult.OK:
                self.path = dialog.FileName

        # default init stauts
        if self.path is None:
            raise Exception("script-sync::File not selected")

        # fi file is in table view before
        if not os.path.exists(self.path):
            raise Exception("script-sync::File does not exist")
    
    def reload_all_modules(self, directory):
        for filename in os.listdir(directory):
            if filename.endswith('.py') and filename != '__init__.py':
                module_name = filename[:-3]  # remove '.py' from filename
                if module_name in sys.modules:
                    importlib.reload(sys.modules[module_name])

    def safe_exec(self, path, globals, locals, packages_2_reload):
        """
            Execute Python3 code safely. It redirects the output of the code
            to a string buffer 'stdout' to output to the GH component param.
            It is send to the vscode server.
            
            :param path: The path of the file to execute.
            :param globals: The globals dictionary.
            :param locals: The locals dictionary.
            :param packages_2_reload: The list of packages to reload, this is used for custom packages developement.
            installed on the system via an editable pip installation for example.
        """
        try:
            with open(path, 'r') as f:
                # reload the specifyed packages
                if packages_2_reload is not None:
                    if packages_2_reload.__len__() != 0:
                        for package in packages_2_reload:
                            for key in list(sys.modules.keys()):
                                if package in key:
                                    #check that the package must have the attribute __file__ (to avoid reloading pyd)
                                    if hasattr(sys.modules[key], '__file__'):
                                        importlib.reload(sys.modules[key])

                # add the path and sub directories to  the sys path
                path_dir = os.path.dirname(path)
                sub_dirs = []
                for root, dirs, files in os.walk(path_dir):
                    for d in dirs:
                        sub_dirs.append(os.path.join(root, d))
                sys.path.extend([path_dir] + sub_dirs)

                # reload all the modules also of the sub directories
                for root, dirs, files in os.walk(path_dir):
                    for d in dirs:
                        self.reload_all_modules(os.path.join(root, d))
                self.reload_all_modules(path_dir)

                # refresh the python interpreter
                importlib.invalidate_caches()

                # parse the code
                code = compile(f.read(), path, 'exec')
                output = io.StringIO()

                # empty the queue and event
                with self.queue_msg_lock:
                    while not self.queue_msg.empty():
                        self.queue_msg.get()
                        self.queue_msg.task_done()
                self.event_fire_msg.clear()

                # execute the code
                with contextlib.redirect_stdout(output):
                    exec(code, globals, locals)
                locals["stdout"] = output.getvalue()

                # send the msg to the vscode server
                msg_json = json.dumps({"script_path": path,
                                       "guid": str(ghenv.Component.InstanceGuid),
                                       "msg": output.getvalue()})
                msg_json = msg_json.encode('utf-8')
                self.queue_msg.put(msg_json)
                self.event_fire_msg.set()

                # pass the script variables to the GH component outputs
                outparam = ghenv.Component.Params.Output
                outparam_names = [p.NickName for p in outparam]
                for outp in outparam_names:
                    if outp in locals.keys():
                        self._var_output.append(locals[outp])
                    else:
                        self._var_output.append(None)

                sys.stdout = sys.__stdout__
            return locals

        except Exception as e:

            # send the error message to the vscode server
            err_json = json.dumps({"script_path": path,
                                    "guid": str(ghenv.Component.InstanceGuid),
                                    "msg": "err:" + str(e)})
            err_json = err_json.encode('utf-8')
            self.queue_msg.put(err_json)
            self.event_fire_msg.set()
            
            sys.stdout = sys.__stdout__

            err_msg = f"script-sync::Error in the code: {str(e)}"
            raise Exception(err_msg)

    def RunScript(self,
            btn: bool,
            packages_2_reload: System.Collections.Generic.IList[str],
            i_reset: bool):
        """ This method is called whenever the component has to be recalculated it's the solve main instance. """
        self.is_success = False

        # set the path if button is pressed
        self.init_script_path(btn)

        # file change listener thread
        if self.filechanged_thread_name not in [t.name for t in threading.enumerate()]:
            FileChangedThread(self.path,
                              self.filechanged_thread_name
                              ).start()

        # set up the tcp client to connect to the vscode server
        _ = [print(t.name) for t in threading.enumerate()]
        if self.client_thread_name not in [t.name for t in threading.enumerate()]:
            ClientThread(self.vscode_server_ip,
                        self.vscode_server_port,
                        self.client_thread_name,
                        self.queue_msg,
                        self.queue_msg_lock,
                        self.event_fire_msg
                        ).start()

        # add to the globals all the input parameters of the component (the locals)
        globals().update(locals())

        res = self.safe_exec(self.path, None, globals(), packages_2_reload)
        self.is_success = True
        return

    def AfterRunScript(self):
        """
            This method is called as soon as the component has finished
            its calculation. It is used to load the GHComponent outputs
            with the values created in the script.
        """
        if not self.is_success:
            return
        outparam = [p for p in ghenv.Component.Params.Output]
        outparam_names = [p.NickName for p in outparam]
        
        # TODO: add the conversion to datatree for nested lists and tuples
        for idx, outp in enumerate(outparam):
            # detect if the output is a list
            if type(self._var_output[idx]) == list or type(self._var_output[idx]) == tuple:
                ghenv.Component.Params.Output[idx].VolatileData.Clear()
                ghenv.Component.Params.Output[idx].AddVolatileDataList(gh.Kernel.Data.GH_Path(0), self._var_output[idx])
            else:
                ghenv.Component.Params.Output[idx].VolatileData.Clear()
                ghenv.Component.Params.Output[idx].AddVolatileData(gh.Kernel.Data.GH_Path(0), 0, self._var_output[idx])
        self._var_output.clear()

    @property
    def path(self):
        """ Get the path of the file from the table view to be sticking between the sessions. """
        table_value = ghenv.Component.OnPingDocument().ValueTable.GetValue(
            self.__path_name_table_value, "not_found"
        )
        if table_value != "not_found":
            return table_value
        else:
            return None

    @path.setter
    def path(self, path : str):
        """ Set the path of the file to the table view to be sticking between the sessions. """
        ghenv.Component.OnPingDocument().ValueTable.SetValue(self.__path_name_table_value, path)

        script_name = os.path.basename(path)
        ghenv.Component.Message = f"{script_name}"

        if self.filechanged_thread_name in [t.name for t in threading.enumerate()]:
            _ = [t for t in threading.enumerate() if t.name == self.filechanged_thread_name][0].stop()

    @path.deleter
    def path(self):
        """ Delete the path of the file from the table view if the object is erased. """
        ghenv.Component.OnPingDocument().ValueTable.DeleteValue(self.__path_name_table_value)
# ---------- end scsy_cpy_2 ----------

# ---- group: Tightness can change
number_slider = Slider(1.1, range=1.1..2.1)

# ---- group: Distance from centers
number_slider_2 = Slider(4, range=0..4)

# ----
py3 = Python3Script()  # -> out, simplify(o_combinations)
# ---------- py3: Python ----------
#! python3


#values min, max of the domain of the parameters to vary
VAL_DICT = {
    "seem_start" : (0.0, 1.0),
    "scale_f" : (1.0, 1.3),
    "thickness" : (0.4, 1.8),
    "number_ctrl_pts" : (7, 20),
    "dist_from_centers" : (0.0, 4.0),
    "tightness" : (1.1, 2.1)
}

if __name__ == "__main__":
    print("Shuffler is running...")

    o_seem_start = 0.0
    o_scale_f = 1.0
    o_thickness = 0.4
    o_number_ctrl_pts = 7
    o_dist_from_centers = 0.0
    o_tightness = 1.1

    o_combinations = []

    import random
    
    # create a unique and random combinations for each day of the year and output a list of list of values (stay within the domain)
    seem_start_values = []
    for i in range(365):
        o_seem_start = random.uniform(VAL_DICT["seem_start"][0], VAL_DICT["seem_start"][1])
        o_scale_f = random.uniform(VAL_DICT["scale_f"][0], VAL_DICT["scale_f"][1])
        o_thickness = random.uniform(VAL_DICT["thickness"][0], VAL_DICT["thickness"][1])
        o_number_ctrl_pts = random.randint(VAL_DICT["number_ctrl_pts"][0], VAL_DICT["number_ctrl_pts"][1])
        o_dist_from_centers = random.uniform(VAL_DICT["dist_from_centers"][0], VAL_DICT["dist_from_centers"][1])
        o_tightness = random.uniform(VAL_DICT["tightness"][0], VAL_DICT["tightness"][1])

        o_combinations.append([o_seem_start, o_scale_f, o_thickness, o_number_ctrl_pts, o_dist_from_centers, o_tightness])

    import ghpythonlib.treehelpers as th
    o_combinations = th.list_to_tree(o_combinations)
# ---------- end py3 ----------

# ---- group: seem_start
number_slider_3 = Slider(0, range=0..1)

# ---- group: Scale it up
number_slider_4 = Slider(1, range=1..1.3)

# ---- group: Potential thickness to change
number_slider_5 = Slider(1, range=0.4..1.8)

# ---- group: Possiblee between 20 and 40
number_slider_6 = Slider(20, range=7..20)

# ----
branch = TreeBranch(Tree=py3.o_combinations, Path=Slider(359, range=0..359), MaintainPaths=True)
panel = Panel(scsy_cpy_2.o_index)

# ---- group: IN (internalized)
geo = Geometry(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)

# ---- group: seem_start
num = Number(number_slider_3)

# ---- group: scale_f
num_2 = Number(number_slider_4)

# ---- group: thickness
num_3 = Number(number_slider_5)

# ---- group: tightness
num_4 = Number(number_slider)

# ---- group: number_ctrl_pts
num_5 = Number(number_slider_6)

# ---- group: dist_from_centers
num_6 = Number(number_slider_2)

# ----
panel_2 = Panel(scsy_cpy_2.stdout)
item = ListItem(List=branch, Index=0, Wrap=True)  # -> Item, Item1, Item2, Item3, Item4, Item5

# ---- group: +_s
geo_2 = Geometry(geo)

# ---- group: seem_start
num_7 = Number(item.Item)

num_8 = Number(num_7)

# ---- group: scale_f
num_9 = Number(item.Item1)

# ---- group: thickness
num_10 = Number(item.Item2)

# ---- group: number_ctrl_pts
num_11 = Number(item.Item3)

# ---- group: dist_from_centers
num_12 = Number(item.Item4)

# ---- group: tightness
num_13 = Number(item.Item5)

# ----
# convexhull + smooth
explode = Explode(Curve=geo_2, Recursive=True)  # -> Segments, flatten(Vertices)
hull = ConvexHull(Points=explode.Vertices, Plane=PlaneXY(0, 0, 0))  # -> Hull, HullZ, Indices
seam = Seam(Curve=reparameterize(hull.Hull), Seam=num_8)
explode_2 = Explode(Curve=seam, Recursive=True)  # -> Segments, flatten(Vertices)
nurbs = NurbsCurve(Vertices=explode_2.Vertices, Degree=3, Periodic=False)  # -> Curve, Length, Domain

panel_3 = Panel(scsy_cpy.o_combinations)
panel_4 = Panel(scsy_cpy.o_tree)

# ---- group: spins_smooths
geo_3 = Geometry(nurbs.Curve)

# ---- group: scale_f
num_14 = Number(num_9)

# ---- group: spins_smooths
geo_4 = Geometry(geo_3)

# ----
panel_5 = Panel(py3.o_combinations)
panel_6 = Panel(py3.out)

# ----
# scaler
area = Area(Geometry=geo_4)  # -> Area, Centroid
scale = Scale(Geometry=geo_4, Center=area.Centroid, Factor=num_14)  # -> Geometry, Transform

# ---- group: spins_scaled
geo_5 = Geometry(scale.Geometry)

# ---- group: dist_from_centers
num_15 = Number(num_12)

# ---- group: tightness
num_16 = Number(num_13)

# ---- group: spins_scaled
geo_6 = Geometry(geo_5)

# ---- group: number_ctrl_pts
num_17 = Number(num_11)

# ----
# noiser
cluster = Cluster(geo=geo_6, N=num_17, A=num_15, B=num_16, S=2)

# ---- group: spins
geo_7 = Geometry(cluster)

geo_8 = Geometry(geo_7)

# ---- group: thickness
num_18 = Number(num_10)

# ----
# haatch & preview
panel_7 = Panel("2")
roundd = RoundToDecimalPlace(NumberX=num_18, DecimalPlace=panel_7, RoundType=0)  # -> Rounded, Difference
neg = Negative(Value=roundd.Rounded)
xy = XYPlane(Origin=Point(0, 0, 0))
merge = Merge(Data1=roundd.Rounded, Data2=neg)
offset = OffsetCurve(Curve=geo_8, Distance=merge, Plane=xy, Corners=0)  # -> simplify(Curve)
trim = TrimTree(Tree=offset, Depth=1)

# ---- group: spins_offsets
geo_9 = Geometry(trim)

# coloring
geo_10 = Geometry(trim)

geo_11 = Geometry(trim)

geo_12 = Geometry(geo_11)

# ----
geo_13 = Geometry(geo_12)
loft = Loft(Curves=geo_13, Options={Adjust=False, Closed=False, LoftEnds=0, LoftSimp=0, LoftType=0, Rebuild=10, Refit=0.01})
mesh = Mesh(loft)
bang = ExplodeTree(Data=loft)  # -> Branch0, Branch1

# ---- group: Get diff area / gt
geo_14 = Geometry(bang.Branch0)

# ---- group: Get diff area
item_2 = ListItem(List=geo_11, Index=0, Wrap=True)
bang_2 = ExplodeTree(Data=item_2)  # -> Branch0, Branch1
rint = RegionIntersection(CurvesA=bang_2.Branch0, CurvesB=bang_2.Branch1)
merge_2 = Merge(Data1=geo_14, Data2=rint)  # -> simplify(flatten(Result))
area_2 = Area(Geometry=merge_2)  # -> Area, Centroid
item_3 = ListItem(List=area_2.Area, Index=0, Wrap=True)  # -> Item, Item1

# ----
Y = UnitY(Factor=Slider(19, range=0..100))
splitmul = SplitBrepMultiple(Brep=bang.Branch0, Cutters=bang.Branch1)
move = Move(Geometry=splitmul, Motion=Y)  # -> Geometry, Transform
item_4 = ListItem(List=move.Geometry, Index=Slider(0, range=0..3), Wrap=True)  # -> Item, Item1

# ---- group: Get diff area / gt_area
num_19 = Number(item_3.Item)

# ----
area_3 = Area(Geometry=[item_4.Item, item_4.Item1])  # -> Area, Centroid
panel_8 = Panel(move.Geometry)

# ---- group: colorer / gt_area
num_20 = Number(num_19)

# ----
ma = MassAddition(Input=flatten(area_3.Area))  # -> Result, PartialResults

# ---- group: Get diff area / est_area
num_21 = Number(ma.Result)

# ---- group: colorer / est_area
num_22 = Number(num_21)

# ---- group: colorer
py3_2 = Python3Script(i_gt_area=num_20, i_est_area=num_22)  # -> out, o_clr; inputs i_gt_area: Double, i_est_area: Double
# ---------- py3_2: Python ----------
#! python3
#r: matplotlib==3.4.3

import os

import Rhino
import Rhino.Geometry as rg

import colorsys
import System


def get_diff_color(est_area, gt_area):
    # Calculate the ratio of estimated area to ground truth area
    ratio = est_area / gt_area if gt_area != 0 else 1

    # Clamp the ratio between 0 and 1
    ratio = max(0, min(ratio, 1))

    # Generate a color that transitions from green to red based on the ratio
    # In the HSV color model, green is at hue = 2/3 and red is at hue = 0
    hue = 2 / 3 * ratio

    # Convert the HSV color to RGB
    r, g, b = colorsys.hsv_to_rgb(hue, 1, 1)
    g, r, b = b, g, r  # Corrected order

    # Convert the RGB color to a System.Drawing.Color
    color = System.Drawing.Color.FromArgb(int(255 * r), int(255 * g), int(255 * b))  # Corrected order

    return color

clr = get_diff_color(i_est_area, i_gt_area)
o_clr = clr
# ---------- end py3_2 ----------
scsy_cpy_3 = ScriptSyncCpython(btn=Button(), i_gt_area=num_20, i_est_area=num_22)  # -> stdout, o_clr; inputs btn: Boolean, packages_2_reload: list of String, i_gt_area: Double, i_est_area: Double
#   port btn: Connect a button to open a file dialog to select a cpython file to run.
#   port packages_2_reload: Pass a list with the name of the custom packages you want to reload. This function is useful if you are developing a i.e. PyPI package and you want to reload the submodules after you modified something. The function will reload the package and all its submodules. If you want to reload the package and all its submodules, just pass the package name. If you want to reload only a submodule, pass the package name and the submodule name separated by a dot. If you want to reload multiple submodules, pass the package
#   port stdout: The redirected standard output of the component scriptsync.
#   port o_clr: Generic example output of the component
# ---------- scsy_cpy_3: Python ----------
from ghpythonlib.componentbase import executingcomponent as component

import System
import System.Drawing
import System.Windows.Forms
import Rhino
import Grasshopper
import Grasshopper as gh
from Grasshopper.Kernel import GH_RuntimeMessageLevel as RML
import sys
import os
import time

import contextlib
import io

import abc
import socket
import threading
import queue
import json

import importlib
import sys


class GHThread(threading.Thread, metaclass=abc.ABCMeta):
    """
        A base class for Grasshopper threads.
    """
    def __init__(self, name : str):
        super().__init__(name=name, daemon=False)
        self._component_on_canvas = True
        self._component_enabled = True

    @abc.abstractmethod
    def run(self):
        """ Run the thread. """
        pass

    def _check_if_component_on_canvas(self):
        """ Check if the component is on canvas from thread. """
        def __check_if_component_on_canvas():
            if ghenv.Component.OnPingDocument() is None:
                self._component_on_canvas = False
                return False
            else:
                self._component_on_canvas = True
                return True
        action = System.Action(__check_if_component_on_canvas)
        Rhino.RhinoApp.InvokeOnUiThread(action)

    def _check_if_component_enabled(self):
        """ Check if the component is enabled from thread. """
        def __check_if_component_enabled():
            if ghenv.Component.Locked:
                self._component_enabled = False
            else:
                self._component_enabled = True
        action = System.Action(__check_if_component_enabled)
        Rhino.RhinoApp.InvokeOnUiThread(action)

    def expire_component_solution(self):
        """ Fire the recalculation of the component solution from thread. """
        def __expire_component_solution():
            ghenv.Component.Params.Output[0].ClearData()  # clear the output
            ghenv.Component.ExpireSolution(True)  # expire the component
        action = System.Action(__expire_component_solution)
        Rhino.RhinoApp.InvokeOnUiThread(action)

    def clear_component(self):
        """ Clear the component from thread. """
        def __clear_component():
            ghenv.Component.ClearData()
        action = System.Action(__clear_component)
        Rhino.RhinoApp.InvokeOnUiThread(action)

    def add_runtime_warning(self, exception : str):
        """ Add a warning tab to the component from main thread. """
        action = System.Action(
            lambda: ghenv.Component.AddRuntimeMessage(RML.Warning, exception)
        )
        Rhino.RhinoApp.InvokeOnUiThread(action)

    def add_runtime_error(self, exception : str):
        """ Add an error tab to the component from main thread. """
        action = System.Action(
            lambda: ghenv.Component.AddRuntimeMessage(RML.Error, exception)
        )
        Rhino.RhinoApp.InvokeOnUiThread(action)

    def add_runtime_remark(self, exception : str):
        """ Add a blank tab to the component from main thread. """
        action = System.Action(
            lambda: ghenv.Component.AddRuntimeMessage(RML.Remark, exception)
        )
        Rhino.RhinoApp.InvokeOnUiThread(action)

    @property
    def component_enabled(self):
        self._check_if_component_enabled()
        return self._component_enabled

    @property
    def component_on_canvas(self):
        self._check_if_component_on_canvas()
        return self._component_on_canvas

class ClientThread(GHThread):
    """
    A thread to connect to the VSCode server.
    """
    def __init__(self, vscode_server_ip: str, vscode_server_port: int, name: str,
                 queue_msg: queue.Queue = None, lock_queue_msg: threading.Lock = None,
                 event_fire_msg: threading.Event = None):
        super().__init__(name=name)
        self.vscode_server_ip = vscode_server_ip
        self.vscode_server_port = vscode_server_port
        self.is_connected = False
        self.connect_refresh_rate = 1  # seconds
        self.queue_msg = queue_msg
        self.lock_queue_msg = lock_queue_msg
        self.event_fire_msg = event_fire_msg
        self.client_socket = socket.socket(socket.AF_INET, socket.SOCK_STREAM)

    def run(self):
        """ Run the thread. Send the message to the vscode server."""
        while self.component_on_canvas and self.component_enabled:
            try:
                if not self.is_connected:
                    self.connect_to_vscode_server()
                    self.clear_component()
                    self.expire_component_solution()
                    continue

                self.event_fire_msg.wait()
                self.send_message_from_queue()

            except Exception as e:
                self.add_runtime_warning(f"script-sync::Unkown error from run: {str(e)}")
                self.is_connected = False
                self.client_socket = socket.socket(socket.AF_INET, socket.SOCK_STREAM)

        self.client_socket.close()

    def send_message_from_queue(self):
        with self.lock_queue_msg:
            if self.queue_msg and not self.queue_msg.empty():
                msg = self.queue_msg.get()
                self.queue_msg.task_done()
                self.event_fire_msg.set()
                self.event_fire_msg.clear()
                self.client_socket.send(msg)

    def connect_to_vscode_server(self):
        """ Connect to the VSCode server. """
        while self.component_on_canvas and not self.is_connected:
            try:
                self.client_socket.send(b"")
                self.is_connected = True
            except socket.error:
                try:
                    self.client_socket.connect((self.vscode_server_ip, self.vscode_server_port))
                    self.is_connected = True
                except (ConnectionRefusedError, ConnectionResetError, socket.error) as e:
                    self.handle_connection_error(e)
            finally:
                time.sleep(self.connect_refresh_rate)

    def handle_connection_error(self, e):
        error_messages = {
            ConnectionRefusedError: "script-sync::Connection refused by the vscode",
            ConnectionResetError: "script-sync::Connection was forcibly closed by the vscode",
            socket.error: f"script-sync::Error connecting to the vscode: {str(e)}"
        }
        self.add_runtime_warning(error_messages[type(e)])
        self.is_connected = False if type(e) != socket.error or e.winerror != 10056 else True

class FileChangedThread(GHThread):
    """
        A thread to check if the file has changed on disk.
    """
    def __init__(self,
                path : str,
                name : str
                ):
        super().__init__(name=name)
        self.path = path
        self.refresh_rate = 1000  # milliseconds
        self._on_file_changed = threading.Event()

    def run(self):
        """
            Check if the file has changed on disk.
        """
        last_modified = os.path.getmtime(self.path)
        while self.component_on_canvas and not self._on_file_changed.is_set():
            System.Threading.Thread.Sleep(self.refresh_rate)
            last_modified = self.is_file_modified(last_modified)
        self._on_file_changed.clear()
        return

    def stop(self):
        """ Stop the thread. """
        self._on_file_changed.set()

    def is_file_modified(self, last_modified):
        current_modified = os.path.getmtime(self.path)
        if current_modified != last_modified:
            self.expire_component_solution()
            return current_modified
        return last_modified


class ScriptSyncCPy(component):
    def __init__(self):
        super(ScriptSyncCPy, self).__init__()
        self._var_output = []

        self.is_success = False

        self.client_thread_name : str = f"script-sync-client-thread::{ghenv.Component.InstanceGuid}"
        self.vscode_server_ip = "127.0.0.1"
        self.vscode_server_port = 58260
        self.stdout = None
        self.queue_msg = queue.Queue()
        self.queue_msg_lock = threading.Lock()
        self.event_fire_msg = threading.Event()

        self.filechanged_thread_name : str = f"script-sync-fileChanged-thread::{ghenv.Component.InstanceGuid}"
        self.__path_name_table_value = "script-sync::" + "path::" + str(ghenv.Component.InstanceGuid)
        if self.path is None:
            ghenv.Component.Message = "select-script"

    def RemovedFromDocument(self, doc):
        """ Remove the component from the document. """
        if self.client_thread_name in [t.name for t in threading.enumerate()]:
            client_thread = [t for t in threading.enumerate() if t.name == self.client_thread_name][0]
            client_thread.join()
        if self.filechanged_thread_name in [t.name for t in threading.enumerate()]:
            filechanged_thread = [t for t in threading.enumerate() if t.name == self.filechanged_thread_name][0]
            filechanged_thread.join()
        if self.queue_msg is not None:
            self.queue_msg.join()
        if self.queue_msg_lock is not None:
            self.queue_msg_lock.release()
        if self.event_fire_msg is not None:
            self.event_fire_msg.clear()

        # clear the path from the table view
        del self.path

    def init_script_path(self, btn : bool = False):
        """
            Check if the button is pressed and load/change path script.
            
            :param btn: A boolean of the button
        """
        # check if button is pressed
        if btn is True:
            dialog = System.Windows.Forms.OpenFileDialog()
            dialog.Filter = "Python files (*.py)|*.py"
            dialog.Title = "Select a Python file"
            dialog.InitialDirectory = os.path.dirname("")
            dialog.FileName = ""
            dialog.Multiselect = False
            dialog.CheckFileExists = True
            dialog.CheckPathExists = True
            dialog.RestoreDirectory = True
            if dialog.ShowDialog() == System.Windows.Forms.DialogResult.OK:
                self.path = dialog.FileName

        # default init stauts
        if self.path is None:
            raise Exception("script-sync::File not selected")

        # fi file is in table view before
        if not os.path.exists(self.path):
            raise Exception("script-sync::File does not exist")
    
    def reload_all_modules(self, directory):
        for filename in os.listdir(directory):
            if filename.endswith('.py') and filename != '__init__.py':
                module_name = filename[:-3]  # remove '.py' from filename
                if module_name in sys.modules:
                    importlib.reload(sys.modules[module_name])

    def safe_exec(self, path, globals, locals, packages_2_reload):
        """
            Execute Python3 code safely. It redirects the output of the code
            to a string buffer 'stdout' to output to the GH component param.
            It is send to the vscode server.
            
            :param path: The path of the file to execute.
            :param globals: The globals dictionary.
            :param locals: The locals dictionary.
            :param packages_2_reload: The list of packages to reload, this is used for custom packages developement.
            installed on the system via an editable pip installation for example.
        """
        try:
            with open(path, 'r') as f:
                # reload the specifyed packages
                if packages_2_reload is not None:
                    if packages_2_reload.__len__() != 0:
                        for package in packages_2_reload:
                            for key in list(sys.modules.keys()):
                                if package in key:
                                    #check that the package must have the attribute __file__ (to avoid reloading pyd)
                                    if hasattr(sys.modules[key], '__file__'):
                                        importlib.reload(sys.modules[key])

                # add the path and sub directories to  the sys path
                path_dir = os.path.dirname(path)
                sub_dirs = []
                for root, dirs, files in os.walk(path_dir):
                    for d in dirs:
                        sub_dirs.append(os.path.join(root, d))
                sys.path.extend([path_dir] + sub_dirs)

                # reload all the modules also of the sub directories
                for root, dirs, files in os.walk(path_dir):
                    for d in dirs:
                        self.reload_all_modules(os.path.join(root, d))
                self.reload_all_modules(path_dir)

                # refresh the python interpreter
                importlib.invalidate_caches()

                # parse the code
                code = compile(f.read(), path, 'exec')
                output = io.StringIO()

                # empty the queue and event
                with self.queue_msg_lock:
                    while not self.queue_msg.empty():
                        self.queue_msg.get()
                        self.queue_msg.task_done()
                self.event_fire_msg.clear()

                # execute the code
                with contextlib.redirect_stdout(output):
                    exec(code, globals, locals)
                locals["stdout"] = output.getvalue()

                # send the msg to the vscode server
                msg_json = json.dumps({"script_path": path,
                                       "guid": str(ghenv.Component.InstanceGuid),
                                       "msg": output.getvalue()})
                msg_json = msg_json.encode('utf-8')
                self.queue_msg.put(msg_json)
                self.event_fire_msg.set()

                # pass the script variables to the GH component outputs
                outparam = ghenv.Component.Params.Output
                outparam_names = [p.NickName for p in outparam]
                for outp in outparam_names:
                    if outp in locals.keys():
                        self._var_output.append(locals[outp])
                    else:
                        self._var_output.append(None)

                sys.stdout = sys.__stdout__
            return locals

        except Exception as e:

            # send the error message to the vscode server
            err_json = json.dumps({"script_path": path,
                                    "guid": str(ghenv.Component.InstanceGuid),
                                    "msg": "err:" + str(e)})
            err_json = err_json.encode('utf-8')
            self.queue_msg.put(err_json)
            self.event_fire_msg.set()
            
            sys.stdout = sys.__stdout__

            err_msg = f"script-sync::Error in the code: {str(e)}"
            raise Exception(err_msg)

    def RunScript(self,
            btn: bool,
            packages_2_reload: System.Collections.Generic.IList[str],
            i_gt_area: float,
            i_est_area: float):
        """ This method is called whenever the component has to be recalculated it's the solve main instance. """
        self.is_success = False

        # set the path if button is pressed
        self.init_script_path(btn)

        # file change listener thread
        if self.filechanged_thread_name not in [t.name for t in threading.enumerate()]:
            FileChangedThread(self.path,
                              self.filechanged_thread_name
                              ).start()

        # set up the tcp client to connect to the vscode server
        _ = [print(t.name) for t in threading.enumerate()]
        if self.client_thread_name not in [t.name for t in threading.enumerate()]:
            ClientThread(self.vscode_server_ip,
                        self.vscode_server_port,
                        self.client_thread_name,
                        self.queue_msg,
                        self.queue_msg_lock,
                        self.event_fire_msg
                        ).start()

        # add to the globals all the input parameters of the component (the locals)
        globals().update(locals())

        res = self.safe_exec(self.path, None, globals(), packages_2_reload)
        self.is_success = True
        return

    def AfterRunScript(self):
        """
            This method is called as soon as the component has finished
            its calculation. It is used to load the GHComponent outputs
            with the values created in the script.
        """
        if not self.is_success:
            return
        outparam = [p for p in ghenv.Component.Params.Output]
        outparam_names = [p.NickName for p in outparam]
        
        # TODO: add the conversion to datatree for nested lists and tuples
        for idx, outp in enumerate(outparam):
            # detect if the output is a list
            if type(self._var_output[idx]) == list or type(self._var_output[idx]) == tuple:
                ghenv.Component.Params.Output[idx].VolatileData.Clear()
                ghenv.Component.Params.Output[idx].AddVolatileDataList(gh.Kernel.Data.GH_Path(0), self._var_output[idx])
            else:
                ghenv.Component.Params.Output[idx].VolatileData.Clear()
                ghenv.Component.Params.Output[idx].AddVolatileData(gh.Kernel.Data.GH_Path(0), 0, self._var_output[idx])
        self._var_output.clear()

    @property
    def path(self):
        """ Get the path of the file from the table view to be sticking between the sessions. """
        table_value = ghenv.Component.OnPingDocument().ValueTable.GetValue(
            self.__path_name_table_value, "not_found"
        )
        if table_value != "not_found":
            return table_value
        else:
            return None

    @path.setter
    def path(self, path : str):
        """ Set the path of the file to the table view to be sticking between the sessions. """
        ghenv.Component.OnPingDocument().ValueTable.SetValue(self.__path_name_table_value, path)

        script_name = os.path.basename(path)
        ghenv.Component.Message = f"{script_name}"

        if self.filechanged_thread_name in [t.name for t in threading.enumerate()]:
            _ = [t for t in threading.enumerate() if t.name == self.filechanged_thread_name][0].stop()

    @path.deleter
    def path(self):
        """ Delete the path of the file from the table view if the object is erased. """
        ghenv.Component.OnPingDocument().ValueTable.DeleteValue(self.__path_name_table_value)
# ---------- end scsy_cpy_3 ----------

# ---- group: colorer / clr
data = Data(scsy_cpy_3.o_clr)

# ---- group: colorer (continued)
merge_3 = Merge(Data1=data, Data2=ColourSwatch(SwatchColor=RGB(153, 153, 153)))

# ---- group: colorer / clrs
data_2 = Data(merge_3)

# ---- group: clrs
data_3 = Data(data_2)

# ----
# hatch & preview
geo_15 = Geometry(geo_10)
hatch = DefineHatch(Curve=geo_15, Pattern="Solid", Rotation=0, Scale=1)  # -> flatten(Hatch)
preview = CustomPreview(Geometry=hatch, Material=data_3)

# ==== cluster Cluster
geo = ClusterInput()
geo_2 = Geometry(geo)
N = ClusterInput()
divide = DivideCurve(Curve=geo_2, Count=N, Kinks=False)  # -> Points, Tangents, Parameters
py3 = Python3Script(i_list=divide.Tangents)  # -> out, o_list_p, o_list_np; inputs i_list: list
# ---------- py3: Python ----------
#! python3

o_list_p = []
o_list_np = []

for idx, item in enumerate(i_list):
    if idx % 2 == 0:
        o_list_p.append(item)
        continue
    o_list_np.append(item)
# ---------- end py3 ----------
A = ClusterInput()
B = ClusterInput()
S = ClusterInput()
Z = UnitZ(Factor=1)
dom = ConstructDomain(DomainStart=A, DomainEnd=B)
lng = ListLength(List=divide.Tangents)
entwine = Entwine(Branch00=py3.o_list_p, Branch01=py3.o_list_np, FlattenInputs=True)
merge = Merge(Data1="90", Data2="-90")  # -> graft(Result)
random = Random(Range=dom, Number=lng, Seed=S)
vrot = Rotate(Vector=entwine, Axis=Z, Angle=degrees(merge))
amp = Amplitude(Vector=vrot, Amplitude=random)
geo_3 = Geometry(divide.Points)
move = Move(Geometry=geo_3, Motion=amp)  # -> Geometry, Transform
nurbs = NurbsCurve(Vertices=move.Geometry, Degree=3, Periodic=invert(False))  # -> simplify(Curve), Length, Domain
geo_4 = Geometry(nurbs.Curve)
geo_5 = ClusterOutput(geo_4)
