# Grasshopper definition subtractive_gh_v1.ghx (Grasshopper 1.0.8)
# plug-ins: RhinoCodePluginGH

# ----
# Subtractive evaluation
# The current gh script illustrates the evaluation of the accuracy
#  on a single beam. The final outcome will be accuracy values
#  in respect to the position of hte joint on the beam (is my joint
#  well placed?), and the joint's quality itself (is my joint well
# machined?).
# Legend:
# Preview
# Set-up
# Input
# Before you start
# Pipeline
# Before starting working, drop this component
# and be sure that diffcheck has been installed
# correctly! If it raises no error, you are good to go!
# Output
dft = DFTester()  # -> o_is_imported
#   port o_is_imported: True if the import of the diffCheck bindings is successfull.
# ---------- dft: Python ----------
"""This component is testing diffCheck imports and bindings."""
#! python3


from ghpythonlib.componentbase import executingcomponent as component

from Grasshopper.Kernel import GH_RuntimeMessageLevel as RML

import diffCheck
import diffCheck.df_cvt_bindings
import diffCheck.df_util
from diffCheck import diffcheck_bindings

class DFTester(component):
    def RunScript(self):
        # version
        ghenv.Component.Message = f"diffCheck v: {diffCheck.__version__}"  # noqa: F821

        # bindings
        is_binding_imported = diffcheck_bindings.dfb_test.test()
        if not is_binding_imported:
            ghenv.Component.AddRuntimeMessage(RML.Warning, "Bindings not imported.")  # noqa: F821
        else:
            ghenv.Component.AddRuntimeMessage(RML.Remark, "Bindings imported.")  # noqa: F821
        print(f"diffCheck test: {diffCheck.df_cvt_bindings.test_bindings()}")

        # workspace unit
        scalef = diffCheck.df_util.get_doc_2_meters_unitf()
        if scalef != 1.0:
            ghenv.Component.AddRuntimeMessage(RML.Warning, "Workspace unit is not in meters.")  # noqa: F821
        else:
            ghenv.Component.AddRuntimeMessage(RML.Remark, "Workspace unit is in meters.")  # noqa: F821

        return is_binding_imported
# ---------- end dft ----------

# ----
# Export csv!
button = Button()

# ---- group: Scan
# Inputs
# Here goes the 2 inputs of the system:
# - the model as breps
# - the scan of the real structure
geo = Geometry(<pointcloud referenced from the Rhino model>)

# ---- group: CAD model - square section
brep = Brep(<brep referenced from the Rhino model>)

# ---- group: CAD model - round section
brep_2 = Brep(<brep referenced from the Rhino model>)

# ----
# Build DFAssembly
# Here we convert the model of our structure into
# the internal datatype of diffcheck, DFAssembly.
# This component detects the joints and their faces.
toggle = BooleanToggle(False)
brep_3 = Brep(brep)
dfbuildassembly = DFBuildAssembly(i_assembly_name="CNC_log", i_breps=brep_3, i_is_roundwood=toggle)  # -> o_assembly; inputs i_assembly_name: String, i_breps: list of Brep, i_is_roundwood: Boolean
#   port i_assembly_name: The name of the assembly to export.
#   port i_breps: The breps of the structure.
#   port i_is_roundwood: Whether the beams are of roundwood type or not.
#   port o_assembly: The create DFAssembly object representing the timber elements.
# ---------- dfbuildassembly: Python ----------
"""This component parse a series of breps representing a timber structure or a timber elements into a DFAssembly object."""
#! python3

import System
import typing

import Rhino

from ghpythonlib.componentbase import executingcomponent as component

from diffCheck.df_geometries import DFBeam, DFAssembly


class DFBuildAssembly(component):
    def RunScript(self,
            i_assembly_name: str,
            i_breps: System.Collections.Generic.List[Rhino.Geometry.Brep],
            i_is_roundwood: bool):
        beams: typing.List[DFBeam] = []

        if i_assembly_name is None or i_breps is None:
            return None

        if i_is_roundwood is None:
            i_is_roundwood = False

        for brep in i_breps:
            beam = DFBeam.from_brep_face(brep, i_is_roundwood)
            beams.append(beam)

        o_assembly = DFAssembly(beams, i_assembly_name)

        return o_assembly
# ---------- end dfbuildassembly ----------

# ---- group: DFAssembly
data = Data(dfbuildassembly)

# ---- group: CAD model
brep_4 = Brep(brep_3)

# ----
data_2 = Data(data)

# ---- group: Obtain model's cloud
brep_5 = Brep(brep_4)
num = Number(Slider(10000, range=0..10000))
dfbreptocloud = DFBrepToCloud(i_breps=brep_5, i_num_points=num)  # -> o_pointcloud; inputs i_breps: list of Brep, i_num_points: Int32
#   port i_breps: The breps to convert to point cloud.
#   port i_num_points: The number of points in the new point cloud.
#   port o_pointcloud: The generated point cloud.
# ---------- dfbreptocloud: Python ----------
"""Create unique point cloud from list of breps."""
#! python3

import Rhino
from ghpythonlib.componentbase import executingcomponent as component
from Grasshopper.Kernel import GH_RuntimeMessageLevel as RML

from diffCheck import df_cvt_bindings
import System


class DFBrepToCloud(component):
    def RunScript(self,
            i_breps: System.Collections.Generic.List[Rhino.Geometry.Brep],
            i_num_points: int):
        self.meshing_parameters = Rhino.Geometry.MeshingParameters.DefaultAnalysisMesh

        mesh_versions = []

        if i_breps is None or i_num_points is None:
            return None

        for i_brep in i_breps:
            if not isinstance(i_brep, Rhino.Geometry.Brep):
                self.AddRuntimeMessage(RML.Warning, "Please provide a brep to convert to a cloud")
                return None
            meshes = Rhino.Geometry.Mesh.CreateFromBrep(i_brep, self.meshing_parameters)
            for mesh in meshes:
                mesh_versions.append(mesh)

        unified_mesh = mesh_versions[0]
        unified_mesh.Append(mesh_versions)
        unified_mesh.Faces.ConvertQuadsToTriangles()
        df_mesh = df_cvt_bindings.cvt_rhmesh_2_dfmesh(unified_mesh)
        df_cloud = df_mesh.sample_points_uniformly(i_num_points)
        rgpoints = [Rhino.Geometry.Point3d(pt[0], pt[1], pt[2]) for pt in df_cloud.points]
        rh_cloud = Rhino.Geometry.PointCloud(rgpoints)
        print(rh_cloud)
        return [rh_cloud]
# ---------- end dfbreptocloud ----------
geo_2 = Geometry(dfbreptocloud)

# ---- group: Reduce scan size
# The first step consists in alligning to the best
# tolerance the scan to the model (aka registration).
number_slider = Slider(0.01, range=0..1)
geo_3 = Geometry(geo)
num_2 = Number(number_slider)
voxeldown = DFCloudVoxelDownsample(i_cloud=geo_3, i_voxel_size=num_2)  # -> o_cloud; inputs i_cloud: PointCloud, i_voxel_size: Double
#   port i_cloud: The point cloud to reduce the size.
#   port i_voxel_size: The size of the voxel.
#   port o_cloud: The downsampled cloud.
# ---------- voxeldown: Python ----------
"""Downsample a point cloud using a voxel grid filter."""
#! python3


import Rhino
from ghpythonlib.componentbase import executingcomponent as component


from diffCheck import df_cvt_bindings

class DFCloudVoxelDownsample(component):
    def RunScript(self, i_cloud: Rhino.Geometry.PointCloud, i_voxel_size: float) -> Rhino.Geometry.PointCloud:
        df_cloud = df_cvt_bindings.cvt_rhcloud_2_dfcloud(i_cloud)
        df_cloud.voxel_downsample(i_voxel_size)
        o_cloud = df_cvt_bindings.cvt_dfcloud_2_rhcloud(df_cloud)

        return [o_cloud]
# ---------- end voxeldown ----------
geo_4 = Geometry(voxeldown)

# ----
# Assembly preview
# Use this component to inspect the elements
# of an assembly, beams or joints.
data_3 = Data(data)
# Registration
show_joints = BooleanToggle(True)
dfpreviewassembly = DFPreviewAssembly(i_assembly=data_3, i_are_joints_visible=show_joints)  # inputs i_are_joints_visible: Boolean
#   port i_assembly: The DFAssembly object to preview.
#   port i_are_joints_visible: Show the joints' identifiers widgets.
# ---------- dfpreviewassembly: Python ----------
#! python3

import System

import typing

import Rhino.Geometry as rg

from ghpythonlib.componentbase import executingcomponent as component
import Grasshopper as gh
from Grasshopper.Kernel import GH_RuntimeMessageLevel as RML

import diffCheck
from diffCheck.df_geometries import DFAssembly
import diffCheck.diffcheck_bindings
import diffCheck.df_util

import numpy as np


def add_bool_toggle(self,
    nickname: str,
    indx: int,
    X_param_coord: float,
    Y_param_coord: float,
    X_offset: int=87
    ) -> None:
    """
        Adds a boolean toggle to the component input

        :param nickname: the nickname of the value list
        :param indx: the index of the input parameter
        :param X_param_coord: the x coordinate of the input parameter
        :param Y_param_coord: the y coordinate of the input parameter
        :param X_offset: the offset of the value list from the input parameter
    """
    param = ghenv.Component.Params.Input[indx]  # noqa: F821
    if param.SourceCount == 0:
        toggle = gh.Kernel.Special.GH_BooleanToggle()
        toggle.NickName = nickname
        toggle.Description = "Toggle the value to use with DFVizSettings"
        toggle.CreateAttributes()
        toggle.Attributes.Pivot = System.Drawing.PointF(
            X_param_coord - (toggle.Attributes.Bounds.Width) - X_offset,
            Y_param_coord - (toggle.Attributes.Bounds.Height / 2 + 0.1)
            )
        toggle.Attributes.ExpireLayout()
        gh.Instances.ActiveCanvas.Document.AddObject(toggle, False)
        ghenv.Component.Params.Input[indx].AddSource(toggle)  # noqa: F821

class DFPreviewAssembly(component):
    def __init__(self):
        super(DFPreviewAssembly, self).__init__()
        self._dfassembly = None
        self._joint_rnd_clr = None

        ghenv.Component.ExpireSolution(True)  # noqa: F821
        ghenv.Component.Attributes.PerformLayout()  # noqa: F821
        params = getattr(ghenv.Component.Params, "Input")  # noqa: F821
        for j in range(len(params)):
            Y_cord = params[j].Attributes.InputGrip.Y + 1
            X_cord = params[j].Attributes.Pivot.X + 20
            input_indx = j
            if "i_are_joints_visible" == params[j].NickName:
                add_bool_toggle(
                    ghenv.Component,  # noqa: F821
                    "show_joints",
                    input_indx, X_cord, Y_cord)


    def RunScript(self, i_assembly, i_are_joints_visible: bool):
        if i_assembly is None:
            return None
        if i_are_joints_visible is None:
            i_are_joints_visible = False

        self._dfassembly = i_assembly

        self._joint_rnd_clr = [System.Drawing.Color.FromArgb(
            System.Convert.ToInt32(255 * np.random.rand()),
            System.Convert.ToInt32(255 * np.random.rand()),
            System.Convert.ToInt32(255 * np.random.rand())) for _ in range(len(self._dfassembly.beams))]

        self._are_joints_visible = i_are_joints_visible

        return None

    # Preview overrides
    def DrawViewportWires(self, args):
        if self._dfassembly is None:
            return
        for beam in self._dfassembly.beams:
            #######################################
            ## DFBeams
            #######################################
            if len(self._dfassembly.beams) > 1:
                # beams' obb
                df_cloud = diffCheck.diffcheck_bindings.dfb_geometry.DFPointCloud()
                vertices_pt3d_rh : typing.List[rg.Point3d] = [vertex.to_rg_point3d() for vertex in beam.vertices]
                df_cloud.points = [np.array([vertex.X, vertex.Y, vertex.Z]).reshape(3, 1) for vertex in vertices_pt3d_rh]
                obb: rg.Brep = diffCheck.df_cvt_bindings.cvt_dfOBB_2_rhbrep(df_cloud.get_tight_bounding_box())
                # args.Display.DrawBrepWires(obb, System.Drawing.Color.Red)  ## keep for debugging

                # axis arrow
                obb_faces = obb.Faces
                obb_faces = sorted(obb_faces, key=lambda face: rg.AreaMassProperties.Compute(face).Area)
                obb_endfaces = obb_faces[:2]
                beam_axis = rg.Line(obb_endfaces[0].GetBoundingBox(True).Center, obb_endfaces[1].GetBoundingBox(True).Center)
                extension_length = 0.5 * diffCheck.df_util.get_doc_2_meters_unitf()
                beam_axis.Extend(extension_length, extension_length)
                args.Display.DrawArrow(beam_axis, System.Drawing.Color.Magenta)

                # beam assembly index
                anchor_pt: rg.Point3d = beam_axis.From - beam_axis.UnitTangent * 0.5 * extension_length
                args.Display.Draw2dText(
                    str(beam.index_assembly),
                    System.Drawing.Color.Violet,
                    anchor_pt,
                    True, 18)

            #######################################
            ## DFJoints
            #######################################
            if self._are_joints_visible:
                for idx_joint, joint in enumerate(beam.joints):
                    joint_faces = joint.faces
                    for idx_face, face in enumerate(joint_faces):
                        clr: System.Drawing.Color = System.Drawing.Color.Magenta
                        if len(self._dfassembly.beams) > 1:
                            clr = self._joint_rnd_clr[idx_joint]

                        face_center = face.to_brep_face().GetBoundingBox(False).Center
                        args.Display.DrawPoint(face_center, clr)

                        vector_face_center_2_beam_center = face_center - beam.center
                        vector_face_center_2_beam_center.Unitize()
                        vector_face_center_2_beam_center *= 0.4 * 0.5 * diffCheck.df_util.get_doc_2_meters_unitf()

                        ln = rg.Line(face_center, face_center + vector_face_center_2_beam_center)
                        args.Display.DrawDottedLine(ln, clr)

                        ghenv.Component.AddRuntimeMessage(RML.Remark, "legend joint naming: the beam index - the joint index - the face index by list order")  # noqa: F821
                        name_face_joint: str = f"{beam.index_assembly}-{joint.id}-{idx_face}"
                        args.Display.Draw2dText(
                            name_face_joint,
                            clr,
                            ln.To,
                            True, 18)
# ---------- end dfpreviewassembly ----------

# ---- group: Normal estimation
merge = Merge(Data1=geo_4, Data2=geo_2)
dfcnormestim = DFCloudNormalEstimator(i_cloud=merge, i_knn=Slider(30, range=0..100))  # -> o_cloud; inputs i_cloud: PointCloud, i_knn: Int32, i_radius: Int32, i_switch_mode: Boolean
#   port i_cloud: The point cloud to evaluate.
#   port i_knn: The knn search value (by default 100).
#   port i_radius: The radius search. If value is provided the search will be hybrid.
#   port i_switch_mode: Switch between Open3d (true) or Cilantro (false) library. Default is Open3d.
#   port o_cloud: The cloud with normals computed.
# ---------- dfcnormestim: Python ----------
"""Evaluate the normals of a point cloud."""
#! python3

import Rhino
from ghpythonlib.componentbase import executingcomponent as component

from diffCheck import df_cvt_bindings

class DFCloudNormalEstimator(component):
    def RunScript(self,
            i_cloud: Rhino.Geometry.PointCloud,
            i_knn: int,
            i_radius: int,
            i_switch_mode: bool):
        o_cloud = Rhino.Geometry.PointCloud()

        df_cloud = df_cvt_bindings.cvt_rhcloud_2_dfcloud(i_cloud)

        if i_knn is None:
            i_knn = 100

        if i_switch_mode is None:
            i_switch_mode = False

        df_cloud.estimate_normals(
            use_cilantro_evaluator=i_switch_mode,
            knn=i_knn,
            search_radius=i_radius
            )

        o_cloud = df_cvt_bindings.cvt_dfcloud_2_rhcloud(df_cloud)

        return o_cloud
# ---------- end dfcnormestim ----------

# ----
data_4 = Data(data_2)

# ---- group: DFAssembly
data_5 = Data(data_4)

# ---- group: Directory to export
path = FilePath("C:\Users\andre\Downloads\diffcheck_subtractive\__out\")

# ---- group: Registration
item = ListItem(List=dfcnormestim, Index=0, Wrap=True)  # -> Item, Item1

# ---- group: Registration / Cloud Scan
geo_5 = Geometry(item.Item)

# ---- group: Registration / Cloud CAD
geo_6 = Geometry(item.Item1)

# ---- group: Registration (continued)
ransacgreg = RANSACGlobalRegistration(i_cloud_source=geo_5, i_cloud_target=geo_6)  # -> o_x_form; inputs i_cloud_source: PointCloud, i_cloud_target: PointCloud, i_radius_kd_search: Double, i_neighbours_kd_search: Int32, i_max_corrspondence_dist: Double, is_t_estimate_pt2pt: Boolean, i_ransac_n: Int32, i_checker_dist: Double, i_similarity_threshold: Double, i_max_iterations: Int32, i_confidence_threshold: Double
#   port i_cloud_source: The source point cloud.
#   port i_cloud_target: The target cloud.
#   port i_radius_kd_search: The radius used to search for neighbors in the KDTree.it is expressed relative to the point cloud size (0.01 means radiusKDTreeSearch = 1% of maxSize(pointCloud). It is used for the calculation of FPFHFeatures.
#   port i_neighbours_kd_search: The maximum number of neighbors to search for in the KDTree. It is used for the calculation of FPFHFeatures. A higher value will result in heavier computation but potentially more precise.
#   port i_max_corrspondence_dist: The maximum distance between correspondences. A higher value will result in more correspondences, but potentially include wrong ones.
#   port is_t_estimate_pt2pt: If true it deforms the cloud to match. The transformation estimation method to use. By default, it uses a point to point transformation estimation. If true it will scale and deform the cloud.
#   port i_ransac_n: The number of points to sample in the source point cloud. A higher value can result in a more precise transformation, but will take more time to compute.
#   port i_checker_dist: The maximum distance between correspondances in the FPFH space before testing a RanSaC model. It is exprimed in relative values (it is scaled by the size of the bounding box of the poinnt cloud).
#   port i_similarity_threshold: The threshold for the ransac check based on edge length to consider a model as inlier. A higher value will be stricter, discarding more ransac models.
#   port i_max_iterations: The maximum number of iterations to run the Ransac algorithm. A higher value will take more time to compute but increases the chances of finding a good transformation.
#   port i_confidence_threshold: The threshold for the convergence criteria of the ransac models. A higher value will be stricter, discarding more ransac models.
#   port o_x_form: The computed transformation.
# ---------- ransacgreg: Python ----------
"""Register two point clouds together with a feature matching based on RANSAC."""
#! python3


import Rhino
from ghpythonlib.componentbase import executingcomponent as component

from Grasshopper.Kernel import GH_RuntimeMessageLevel as RML

from diffCheck import diffcheck_bindings
from diffCheck import df_cvt_bindings


class DFRANSACGlobalRegistration(component):
    def RunScript(self,
            i_cloud_source: Rhino.Geometry.PointCloud,
            i_cloud_target: Rhino.Geometry.PointCloud,
            i_radius_kd_search: float,
            i_neighbours_kd_search: int,
            i_max_corrspondence_dist: float,
            is_t_estimate_pt2pt: bool,
            i_ransac_n: int,
            i_checker_dist: float,
            i_similarity_threshold: float,
            i_max_iterations: int,
            i_confidence_threshold: float) -> Rhino.Geometry.Transform:
        if i_cloud_source is None or i_cloud_target is None:
            ghenv.Component.AddRuntimeMessage(RML.Warning, "Please provide both objects of type point clouds to align")  # noqa: F821
            return None
        if not i_cloud_source.ContainsNormals or not i_cloud_target.ContainsNormals:
            ghenv.Component.AddRuntimeMessage(RML.Error, "Please compute cloud's normals with a component before")  # noqa: F821

        # set default values
        if i_radius_kd_search is None:
            i_radius_kd_search = 1
        if i_neighbours_kd_search is None:
            i_neighbours_kd_search = 50
        if i_max_corrspondence_dist is None:
            i_max_corrspondence_dist = 0.5
        if is_t_estimate_pt2pt is None:
            is_t_estimate_pt2pt = False
        if i_ransac_n is None:
            i_ransac_n = 3
        if i_checker_dist is None:
            i_checker_dist = 0.5
        if i_similarity_threshold is None:
            i_similarity_threshold = 1.5
        if i_max_iterations is None:
            i_max_iterations = 5000
        if i_confidence_threshold is None:
            i_confidence_threshold = 0.999

        # conversion
        df_cloud_source = df_cvt_bindings.cvt_rhcloud_2_dfcloud(i_cloud_source)
        df_cloud_target = df_cvt_bindings.cvt_rhcloud_2_dfcloud(i_cloud_target)

        # fast registration
        df_xform = diffcheck_bindings.dfb_registrations.DFGlobalRegistrations.O3DRansacOnFeatureMatching(
            source=df_cloud_source,
            target=df_cloud_target,
            voxelize=False,  # set as default
            voxel_size=0.1,  # set as default
            radius_kd_tree_search=i_radius_kd_search,
            max_neighbor_kd_tree_search=i_neighbours_kd_search,
            max_correspondence_distance=i_max_corrspondence_dist,
            is_t_estimate_pt2pt=is_t_estimate_pt2pt,
            ransac_n=i_ransac_n,
            correspondence_checker_distance=i_checker_dist,
            similarity_threshold=i_similarity_threshold,
            ransac_max_iteration=i_max_iterations,
            ransac_confidence_threshold=i_confidence_threshold
        )
        print("-------------------")
        print("Estimated transformation matrix:")
        print(df_xform.transformation_matrix)
        print("-------------------")

        # cvt df xform to rhino xform
        df_xform_matrix = df_xform.transformation_matrix
        rh_form = Rhino.Geometry.Transform()
        for i in range(4):
            for j in range(4):
                rh_form[i, j] = df_xform_matrix[i, j]
        if rh_form == Rhino.Geometry.Transform.Identity:
            ghenv.Component.AddRuntimeMessage(RML.Warning, "The transformation matrix is identity, no transformation is applied")  # noqa: F821
            return None

        o_x_form = rh_form

        return o_x_form
# ---------- end ransacgreg ----------
geo_7 = Geometry(geo_5)
geo_8 = Geometry(geo_6)
geo_9 = Geometry(geo_7)
transform = Transform(ransacgreg)
geo_10 = Geometry(geo_8)
transform_2 = Transform(Geometry=geo_9, Transform=transform)
icp = ICPRegistration(i_cloud_source=transform_2, i_cloud_target=geo_10)  # -> o_x_form; inputs i_use_generalized_icp: Boolean, i_cloud_source: PointCloud, i_cloud_target: PointCloud, i_max_corrspondence_dist: Double, i_max_iteration: Int32, is_t_estimate_pt2pt: Boolean, i_use_point_to_plane: Boolean
#   port i_use_generalized_icp: Insert a toggle. If set to true, it will use the generalized ICP algorithm. If false, it will use the standard ICP algorithm.
#   port i_cloud_source: The source point cloud.
#   port i_cloud_target: The target cloud.
#   port i_max_corrspondence_dist: Maximum relative correspondence distance. 0.01 means 1% of the bounding box diagonal.
#   port i_max_iteration: Maximum number of ICP iterations to use in the p2p transformation estimation.
#   port is_t_estimate_pt2pt: (NB: only valid for ICP generalized) If true it deforms the cloud to match. The transformation estimation method to use. By default, it uses a point to point transformation estimation. If true it will scale and deform the cloud.
#   port i_use_point_to_plane: (NB: only valid for ICP generalized) Use point-to-plane ICP instead of point-to-point. This replaces the p2p with the point-to-plane transformation estimation.
#   port o_x_form: The computed transformation.
# ---------- icp: Python ----------
"""Use this to refine a registration between two point clouds."""
#! python3


import Rhino
from ghpythonlib.componentbase import executingcomponent as component

from Grasshopper.Kernel import GH_RuntimeMessageLevel as RML

from diffCheck import diffcheck_bindings
from diffCheck import df_cvt_bindings


class DFICPRegistration(component):
    def RunScript(self,
            i_use_generalized_icp: bool,
            i_cloud_source: Rhino.Geometry.PointCloud,
            i_cloud_target: Rhino.Geometry.PointCloud,
            i_max_corrspondence_dist: float,
            i_max_iteration: int,
            is_t_estimate_pt2pt: bool,
            i_use_point_to_plane: bool) -> Rhino.Geometry.Transform:
        if i_cloud_source is None or i_cloud_target is None:
            ghenv.Component.AddRuntimeMessage(RML.Warning, "Please provide both objects of type point clouds to align")  # noqa: F821
            return None
        if not i_cloud_source.ContainsNormals or not i_cloud_target.ContainsNormals:
            ghenv.Component.AddRuntimeMessage(RML.Error, "Please compute cloud's normals with a component before")  # noqa: F821

        # set default values
        if i_use_generalized_icp is None:
            i_use_generalized_icp = True
        if i_max_corrspondence_dist is None:
            i_max_corrspondence_dist = 5
        if i_max_iteration is None:
            i_max_iteration = 50

        # conversion
        df_cloud_source = df_cvt_bindings.cvt_rhcloud_2_dfcloud(i_cloud_source)
        df_cloud_target = df_cvt_bindings.cvt_rhcloud_2_dfcloud(i_cloud_target)

        # fast registration
        # these are the only hardcoded values since it will get the best result
        RELATIVE_FITNESS = 1e-6
        RELATIVE_RMSE = 1e-6

        df_xform = None
        if i_use_generalized_icp:
            df_xform = diffcheck_bindings.dfb_registrations.DFRefinedRegistration.O3DGeneralizedICP(
                source=df_cloud_source,
                target=df_cloud_target,
                max_correspondence_distance=i_max_corrspondence_dist,
                max_iteration=i_max_iteration,
                relative_fitness=RELATIVE_FITNESS,
                relative_rmse=RELATIVE_RMSE
            )
        else:
            df_xform = diffcheck_bindings.dfb_registrations.DFRefinedRegistration.O3DICP(
                source=df_cloud_source,
                target=df_cloud_target,
                max_correspondence_distance=i_max_corrspondence_dist,
                is_t_estimate_pt2pt=is_t_estimate_pt2pt,
                relative_fitness=RELATIVE_FITNESS,
                relative_rmse=RELATIVE_RMSE,
                max_iteration=i_max_iteration,
                use_point_to_plane=i_use_point_to_plane
            )
        print("-------------------")
        print("Estimated transformation matrix:")
        print(df_xform.transformation_matrix)
        print("-------------------")

        # cvt df xform to rhino xform
        df_xform_matrix = df_xform.transformation_matrix
        rh_form = Rhino.Geometry.Transform()
        for i in range(4):
            for j in range(4):
                rh_form[i, j] = df_xform_matrix[i, j]
        if rh_form == Rhino.Geometry.Transform.Identity:
            ghenv.Component.AddRuntimeMessage(RML.Warning, "The transformation matrix is identity, no transformation is applied")  # noqa: F821
            return None

        o_x_form = rh_form

        return o_x_form
# ---------- end icp ----------
geo_11 = Geometry(transform_2)
geo_12 = Geometry(geo_10)
geo_13 = Geometry(geo_11)
transform_3 = Transform(icp)
transform_4 = Transform(Geometry=geo_13, Transform=transform_3)

# ---- group: Cloud Scan xform
geo_14 = Geometry(transform_4)

geo_15 = Geometry(geo_14)

# ---- group: Cloud Brep
geo_16 = Geometry(geo_12)

# ----
# Xform cloud preview
# A simple gh preview to verify that the cloud has
#  been correctly transformed and alligned to the
#  brep.
preview = CustomPreview(
    Geometry=geo_15,
    Material={diffuse=RGB(221, 160, 221), emission=RGB(66, 48, 66), shine=0.5, specular=RGB(255, 255, 255), transparency=0})

# ---- group: Cloud Scan xform
geo_17 = Geometry(geo_14)

# ----
# Segmentation
# Once the scan and the model are alligned, we
# need to segment the parts of the scan that
# interest us for the evaluation. In this case we
# would like  the cloud segment corresponding to
# each face of each joint of the beam.
number_slider_2 = Slider(0.2, range=0..1)
num_3 = Number(Slider(5, range=0..360))
num_4 = Number(Slider(1, range=0..10))
num_5 = Number(number_slider_2)
dfcnorseg = DFNormalSegmentator(i_cloud=geo_17, i_normal_threshold_degree=num_3)  # -> o_clouds; inputs i_cloud: PointCloud, i_normal_threshold_degree: Double, i_min_cluster_size: Int32, i_use_knn_neighborhood: Boolean, i_knn_neighborhood_size: Int32, i_radius_neighborhood_size: Double
#   port i_cloud: The point cloud to reduce the size.
#   port i_normal_threshold_degree: The normal threshold in degrees (under that it consider to the same cluster).
#   port i_min_cluster_size: The smallest cluster allowed.
#   port i_use_knn_neighborhood: If true use knn, otherwise radius search.
#   port i_knn_neighborhood_size: The knn size.
#   port i_radius_neighborhood_size: The size of the radius.
#   port o_clouds: The segmented clouds.
# ---------- dfcnorseg: Python ----------
"""Cluster a point cloud based on normals."""
#! python3


import Rhino
from ghpythonlib.componentbase import executingcomponent as component


from diffCheck.diffcheck_bindings import dfb_segmentation

from diffCheck import df_cvt_bindings


class DFCloudNormalSegmentator(component):
    def RunScript(self,
            i_cloud: Rhino.Geometry.PointCloud,
            i_normal_threshold_degree: float,
            i_min_cluster_size: int,
            i_use_knn_neighborhood: bool,
            i_knn_neighborhood_size: int,
            i_radius_neighborhood_size: float) -> Rhino.Geometry.PointCloud:
        o_clusters = []
        df_cloud = df_cvt_bindings.cvt_rhcloud_2_dfcloud(i_cloud)

        if i_normal_threshold_degree is None:
            i_normal_threshold_degree = 20
        if i_min_cluster_size is None:
            i_min_cluster_size = 10
        if i_use_knn_neighborhood is None:
            i_use_knn_neighborhood = True
        if i_knn_neighborhood_size is None:
            i_knn_neighborhood_size = 30
        if i_radius_neighborhood_size is None:
            i_radius_neighborhood_size = 0.1

        o_clusters = dfb_segmentation.DFSegmentation.segment_by_normal(
            point_cloud=df_cloud,

            normal_threshold_degree=i_normal_threshold_degree,
            min_cluster_size=i_min_cluster_size,
            use_knn_neighborhood=i_use_knn_neighborhood,
            knn_neighborhood_size=i_knn_neighborhood_size,
            radius_neighborhood_size=i_radius_neighborhood_size
        )

        return [df_cvt_bindings.cvt_dfcloud_2_rhcloud(cluster) for cluster in o_clusters]
# ---------- end dfcnorseg ----------
num_6 = Number(num_4)
dfremovestatisticaloutliers = DFRemoveStatisticalOutliers(i_cloud=dfcnorseg, i_knn="20", i_ratio=num_6)  # -> o_cloud; inputs i_cloud: PointCloud, i_knn: Int32, i_ratio: Double
#   port i_cloud: The cloud from which statistical outliers should be removed.
#   port i_knn: The number of neighbors to consider when detecting statistical outliers.
#   port i_ratio: The standard deviation threshold for the detection of statistical outliers.
#   port o_cloud: The new cloud with outliers removed.
# ---------- dfremovestatisticaloutliers: Python ----------
"""Remove statistical outliers from a point cloud."""
#! python3

import Rhino
from ghpythonlib.componentbase import executingcomponent as component

import diffCheck.df_cvt_bindings as cvt

class DFRemoveStatisticalOutliers(component):
    def RunScript(self,
            i_cloud: Rhino.Geometry.PointCloud,
            i_knn: int,
            i_ratio: float):
        if i_cloud is None or i_ratio is None or i_knn is None:
            return None

        df_cloud = cvt.cvt_rhcloud_2_dfcloud(i_cloud)
        df_cloud.remove_statistical_outliers(nb_neighbors=i_knn, std_ratio=i_ratio)
        o_cloud = cvt.cvt_dfcloud_2_rhcloud(df_cloud)

        return o_cloud
# ---------- end dfremovestatisticaloutliers ----------
num_7 = Number(num_5)
data_6 = Data(data_5)
dfjointsegmentator = DFJointSegmentator(i_clusters=dfremovestatisticaloutliers, i_assembly=data_6, i_angle_threshold=num_7)  # -> o_joint_face_segments, o_joint_segments, o_reference_point_clouds; inputs i_clusters: list of PointCloud, i_angle_threshold: Double, i_distance_threshold: Double, i_correspondence_distance: Double, i_joint_displacement_tolerance: Double
#   port i_clusters: The cluster point clouds from normal segmentation.
#   port i_assembly: The assembly to extract the joints from
#   port i_angle_threshold: From 0 to 1, it's the sin value. By default 0.1. The closer to 0 the less permissive and viceversa to 1.
#   port i_distance_threshold: From 0 to infinite. By default 0.1. The closer to 0 the less permissive your point.
#   port i_correspondence_distance: The maximum correspondence distance for the local ICP registration that re-aligns the joints for per-face analysis of each joint. The default value is 0.005
#   port i_joint_displacement_tolerance: The maximum distance for a joint segment to be considered as valid for the reference we are comparing to. The default value is 0.05 (5 cm).
#   port o_joint_face_segments: The individual faces of the extracted joints.
#   port o_joint_segments: The extracted joints.
#   port o_reference_point_clouds: The reference point clouds of the joints. They are generated from the
# ---------- dfjointsegmentator: Python ----------
"""Extracts the joints from a point cloud."""
#! python3

import System
import math

import Rhino
import ghpythonlib.treehelpers

from diffCheck import diffcheck_bindings
from diffCheck import df_cvt_bindings as df_cvt

from ghpythonlib.componentbase import executingcomponent as component


ABSTOL = Rhino.RhinoDoc.ActiveDoc.ModelAbsoluteTolerance

class DFJointSegmentator(component):
    def __init__(self):
        super(DFJointSegmentator, self).__init__()
    def RunScript(self,
            i_clusters: System.Collections.Generic.List[Rhino.Geometry.PointCloud],
            i_assembly,
            i_angle_threshold: float,
            i_distance_threshold: float,
            i_correspondence_distance: float,
            i_joint_displacement_tolerance: float):

        if i_clusters is None or i_assembly is None:
            return None
        if i_angle_threshold is None:
            i_angle_threshold = 0.1
        if i_distance_threshold is None:
            i_distance_threshold = 0.1
        if i_correspondence_distance is None:
            i_correspondence_distance = 0.005
        if i_joint_displacement_tolerance is None:
            i_joint_displacement_tolerance =0.05
        if len(i_clusters) == 0:
            raise ValueError("No clusters given.")
        if not isinstance(i_clusters[0], Rhino.Geometry.PointCloud):
            raise ValueError("The input clusters must be PointClouds.")

        # get number of joints
        n_joints = i_assembly.total_number_joints

        # prepping the reference meshes
        df_joints = [[] for _ in range(n_joints)]
        rh_joints = [[] for _ in range(n_joints)]
        for joint in i_assembly.all_joints:
            for face in joint.faces:
                face = face.to_mesh()
                face.Subdivide()
                face.Faces.ConvertQuadsToTriangles()
                rh_joints[joint.id].append(face)
                df_joints[joint.id].append(df_cvt.cvt_rhmesh_2_dfmesh(face))
        o_reference_point_clouds = []
        o_joint_faces_segments = []
        df_cloud_clusters = [df_cvt.cvt_rhcloud_2_dfcloud(cluster) for cluster in i_clusters]
        df_joint_clouds = []
        o_joint_segments = []

        # compute the center of the joints
        rh_joint_centers = []
        for rh_joint in rh_joints:
            vertices = []
            for face in rh_joint:
                for vertice in face.Vertices:
                    vertices.append(Rhino.Geometry.Point3d(vertice.X, vertice.Y, vertice.Z))
            joint_center = Rhino.Geometry.BoundingBox(vertices).Center
            rh_joint_centers.append([joint_center.X, joint_center.Y, joint_center.Z])

        # for each joint, find the corresponding faces, store them as such but also merge them, generate a reference point cloud, and register the merged clusters to the reference point cloud
        for i, df_joint in enumerate(df_joints):
            rh_joint_faces_segments = []
            reference_joint_center = rh_joint_centers[i]

            # create the reference point cloud
            ref_df_joint_cloud = diffcheck_bindings.dfb_geometry.DFPointCloud()
            for face in df_joint:
                ref_face_cloud = face.sample_points_uniformly(1000)
                ref_df_joint_cloud.add_points(ref_face_cloud)
            o_reference_point_clouds.append(df_cvt.cvt_dfcloud_2_rhcloud(ref_df_joint_cloud))

            # find the corresponding clusters and merge them
            df_joint_cloud = diffcheck_bindings.dfb_geometry.DFPointCloud()
            df_joint_face_segments = diffcheck_bindings.dfb_segmentation.DFSegmentation.associate_clusters(False, df_joint, df_cloud_clusters, i_angle_threshold, i_distance_threshold)
            for df_joint_face_segment in df_joint_face_segments:
                df_joint_cloud.add_points(df_joint_face_segment)

            # get the center of the segment
            if len(df_joint_cloud.points)>0:
                df_cloud_bb_points = df_joint_cloud.get_tight_bounding_box()
                x, y, z = 0, 0, 0
                for i in range(len(df_cloud_bb_points)):
                    x += df_cloud_bb_points[i][0]
                    y += df_cloud_bb_points[i][1]
                    z += df_cloud_bb_points[i][2]
                x = x/8 # because a bb has 8 corners
                y = y/8
                z = z/8
                segment_center = [x, y, z]
                segment_dist_to_ref = math.sqrt(math.pow(segment_center[0]-reference_joint_center[0], 2)
                                                + math.pow(segment_center[1]-reference_joint_center[1], 2)
                                                + math.pow(segment_center[2]-reference_joint_center[2], 2))
                if segment_dist_to_ref > i_joint_displacement_tolerance:
                    rh_joint_cloud = df_cvt.cvt_dfcloud_2_rhcloud(df_joint_cloud)
                    rh_joint_cloud.SetUserString("df_sanity_scan_check", "1")
                    o_joint_segments.append(rh_joint_cloud)
                else:
                    rh_joint_cloud = df_cvt.cvt_dfcloud_2_rhcloud(df_joint_cloud)
                    rh_joint_cloud.SetUserString("df_sanity_scan_check", "0")
                    o_joint_segments.append(rh_joint_cloud)
            else:
                rh_joint_cloud = df_cvt.cvt_dfcloud_2_rhcloud(df_joint_cloud)
                rh_joint_cloud.SetUserString("df_sanity_scan_check", "2")
                o_joint_segments.append(rh_joint_cloud)

            # register the joint faces to the reference point cloud
            transform = diffcheck_bindings.dfb_registrations.DFRefinedRegistration.O3DICP(df_joint_cloud, ref_df_joint_cloud, max_correspondence_distance = i_correspondence_distance)
            for df_joint_face_segment in df_joint_face_segments:
                df_joint_face_segment.apply_transformation(transform)
                rh_joint_faces_segments.append(df_cvt.cvt_dfcloud_2_rhcloud(df_joint_face_segment))
            df_joint_clouds.append(df_joint_cloud)
            o_joint_faces_segments.append(rh_joint_faces_segments)

        for rh_joint_faces, rh_joint in zip(o_joint_faces_segments, o_joint_segments):
            for joint_face in rh_joint_faces:
                joint_face.SetUserString("df_sanity_scan_check", rh_joint.GetUserString("df_sanity_scan_check"))

        o_gh_tree_joint_faces_segments = ghpythonlib.treehelpers.list_to_tree(o_joint_faces_segments)

        return o_gh_tree_joint_faces_segments, o_joint_segments, o_reference_point_clouds
# ---------- end dfjointsegmentator ----------

# ---- group: Cloud preview
dfcolorizecloud = DFColorizeCloud(i_clouds=flatten(dfjointsegmentator.o_joint_face_segments))  # -> o_clouds; inputs i_clouds: list of PointCloud
#   port i_clouds: The pointclouds to be colorized.
#   port o_clouds: The point clouds now colorized.
# ---------- dfcolorizecloud: Python ----------
"""Colorizes randomly a list of point clouds."""
#! python3

import System

import Rhino
from ghpythonlib.componentbase import executingcomponent as component

import numpy as np

class DFColorizeCloud(component):
    def RunScript(self,
            i_clouds: System.Collections.Generic.List[Rhino.Geometry.PointCloud]):
        for cloud in i_clouds:
            random_color = System.Drawing.Color.FromArgb(
                np.random.randint(0, 255),
                np.random.randint(0, 255),
                np.random.randint(0, 255))
            for j in range(cloud.Count):
                cloud[j].Color = random_color
        return i_clouds
# ---------- end dfcolorizecloud ----------

# ---- group: Joints clouds
geo_18 = Geometry(simplify(dfjointsegmentator.o_joint_segments))

# ---- group: Per-face clouds
geo_19 = Geometry(simplify(dfjointsegmentator.o_joint_face_segments))

# ---- group: DFAssembly
data_7 = Data(data_6)

# ---- group: Per-face clouds
geo_20 = Geometry(geo_19)

# ---- group: DFAssembly
data_8 = Data(data_7)

# ---- group: Joints clouds
geo_21 = Geometry(geo_18)

# ----
# Error Computation
# Here is where we compute the error of our
# analysis. In the subtractive scenario it can be
# computed as per-joint or per-jointface. The first
# evaluate the accuracy of the position of the joint
# in the beam, the latest the accuracy of the
# execution of the joint per-se.
dfc2mdistance = DFCloudMeshDistance(i_cloud_source=flatten(geo_20), i_assembly=data_8)  # -> o_distances, o_mean, o_rmse, o_max_deviation, o_min_deviation, o_std_deviation, o_result; inputs i_cloud_source: list of PointCloud, i_signed_flag: Boolean, i_swap: Boolean, i_analysis_resolution: Double
#   port i_cloud_source: The source point cloud.
#   port i_assembly: The target DFAssembly
#   port i_signed_flag: whether to consider the sign of the distances
#   port i_swap: whether to swap source and target
#   port i_analysis_resolution: the maximum edge length of the mesh that is used for the distance calculation
#   port o_distances: list of calculated distances for each point of the source.
#   port o_mean: The mean of the distances.
#   port o_rmse: average squared difference between source and target.
#   port o_max_deviation: max deviation between source and target
#   port o_min_deviation: min deviation between source and target
#   port o_std_deviation: standard deviation between source and target.
#   port o_result: The result of the distance calculation.
# ---------- dfc2mdistance: Python ----------
#! python3

import System
import Rhino
from ghpythonlib.componentbase import executingcomponent as component
from Grasshopper.Kernel import GH_RuntimeMessageLevel as RML
import ghpythonlib.treehelpers as th

import diffCheck
from diffCheck import df_error_estimation


class DFCloudMeshDistance(component):

    def RunScript(self,
            i_cloud_source: System.Collections.Generic.List[Rhino.Geometry.PointCloud],
            i_assembly,
            i_signed_flag: bool,
            i_swap: bool,
            i_analysis_resolution: float):

        if i_cloud_source is None or i_assembly is None:
            return None, None, None, None, None, None

        if i_analysis_resolution is None:
            scalef = diffCheck.df_util.get_doc_2_meters_unitf()
            i_analysis_resolution = 0.1 / scalef

        if len(i_assembly.beams) == len(i_cloud_source):
            ghenv.Component.Message = "Per Beam"  # noqa: F821
            rh_mesh_target_list = [beam.to_mesh(i_analysis_resolution) for beam in i_assembly.beams]
        elif len(i_assembly.all_joints) == len(i_cloud_source):
            ghenv.Component.Message = "Per Joint"  # noqa: F821
            rh_mesh_target_list = [joint.to_mesh(i_analysis_resolution) for joint in i_assembly._all_joints]
        elif len(i_assembly.all_joint_faces) == len(i_cloud_source):
            ghenv.Component.Message = "Per Joint Face"  # noqa: F821
            rh_mesh_target_list = [joint_face.to_mesh() for joint_face in i_assembly.all_joint_faces]
        else:
            ghenv.Component.AddRuntimeMessage(RML.Warning, "The input number of objects to compare matches neither the number of beams nor the number of joints")  # noqa: F821
            return None, None, None, None, None, None

        o_result = df_error_estimation.rh_cloud_2_rh_mesh_comparison(
            i_assembly,
            i_cloud_source,
            rh_mesh_target_list,
            i_signed_flag,
            i_swap)  # noqa: F821

        distances_gh_tree = th.list_to_tree(o_result.distances)

        return distances_gh_tree, o_result.distances_mean, o_result.distances_rmse, o_result.distances_max_deviation, o_result.distances_min_deviation, o_result.distances_sd_deviation, o_result
# ---------- end dfc2mdistance ----------
dfc2mdistance_2 = DFCloudMeshDistance(i_cloud_source=flatten(geo_21), i_assembly=data_8)  # -> o_distances, o_mean, o_rmse, o_max_deviation, o_min_deviation, o_std_deviation, o_result; inputs i_cloud_source: list of PointCloud, i_signed_flag: Boolean, i_swap: Boolean, i_analysis_resolution: Double
#   port i_cloud_source: The source point cloud.
#   port i_assembly: The target DFAssembly
#   port i_signed_flag: whether to consider the sign of the distances
#   port i_swap: whether to swap source and target
#   port i_analysis_resolution: the maximum edge length of the mesh that is used for the distance calculation
#   port o_distances: list of calculated distances for each point of the source.
#   port o_mean: The mean of the distances.
#   port o_rmse: average squared difference between source and target.
#   port o_max_deviation: max deviation between source and target
#   port o_min_deviation: min deviation between source and target
#   port o_std_deviation: standard deviation between source and target.
#   port o_result: The result of the distance calculation.
# ---------- dfc2mdistance_2: Python ----------
#! python3

import System
import Rhino
import Grasshopper
from ghpythonlib.componentbase import executingcomponent as component
from Grasshopper.Kernel import GH_RuntimeMessageLevel as RML
import ghpythonlib.treehelpers as th

import diffCheck
from diffCheck import df_cvt_bindings
from diffCheck import df_error_estimation


class DFCloudMeshDistance(component):

    def RunScript(self,
            i_cloud_source: System.Collections.Generic.List[Rhino.Geometry.PointCloud],
            i_assembly,
            i_signed_flag: bool,
            i_swap: bool,
            i_analysis_resolution: float):

        if i_cloud_source is None or i_assembly is None:
            return None, None, None, None, None, None

        if i_analysis_resolution is None:
            scalef = diffCheck.df_util.get_doc_2_meters_unitf()
            i_analysis_resolution = 0.1 / scalef

        if len(i_assembly.beams) == len(i_cloud_source):
            ghenv.Component.Message = "Per Beam"  # noqa: F821
            rh_mesh_target_list = [beam.to_mesh(i_analysis_resolution) for beam in i_assembly.beams]
        elif len(i_assembly.all_joints) == len(i_cloud_source):
            ghenv.Component.Message = "Per Joint"  # noqa: F821
            rh_mesh_target_list = [joint.to_mesh(i_analysis_resolution) for joint in i_assembly._all_joints]
        elif len(i_assembly.all_joint_faces) == len(i_cloud_source):
            ghenv.Component.Message = "Per Joint Face"  # noqa: F821
            rh_mesh_target_list = [joint_face.to_mesh() for joint_face in i_assembly.all_joint_faces]
        else:
            ghenv.Component.AddRuntimeMessage(RML.Warning, "The input number of objects to compare matches neither the number of beams nor the number of joints")  # noqa: F821
            return None, None, None, None, None, None

        # calculate distances
        o_result = df_error_estimation.rh_cloud_2_rh_mesh_comparison(
            i_assembly,
            i_cloud_source,
            rh_mesh_target_list,
            i_signed_flag,
            i_swap)  # noqa: F821

        # distances to tree
        distances_tree = th.list_to_tree(o_result.distances)
        #remove first branch
        # distances_tree = th.tree_trim_front(distances_tree, 1)
        

        return distances_tree, o_result.distances_mean, o_result.distances_rmse, o_result.distances_max_deviation, o_result.distances_min_deviation, o_result.distances_sd_deviation, o_result
# ---------- end dfc2mdistance_2 ----------
entwine = Entwine(Branch00=dfc2mdistance.o_result, Branch01=dfc2mdistance_2.o_result, FlattenInputs=True)  # -> simplify(Result)

# ---- group: Results
data_9 = Data(entwine)

data_10 = Data(data_9)

# ----
# Error Visualization
df_histogram_scale_factor = Slider(0.209, range=0..1)
df_value_t = ValueList({"Dist", "RMSE", "MAX", "MIN", "STD"}, selected="Dist")
df_palette = ValueList({"Jet", "Rainbow", "RdPu", "Viridis"}, selected="Jet")
df_legend_height = Slider(2.204, range=0..20)
df_legend_width = Slider(0.204, range=0..2)
df_legend_plane = Plane()
dfvizsettings = DFVisualizationSettings(
    i_value_type=df_value_t,
    i_palette=df_palette,
    i_legend_height=df_legend_height,
    i_legend_width=df_legend_width,
    i_legend_plane=df_legend_plane,
    i_histogram_scale_factor=df_histogram_scale_factor)  # -> o_viz_settings; inputs i_value_type: String, i_palette: String, i_upper_threshold: Double, i_lower_threshold: Double, i_legend_height: Double, i_legend_width: Double, i_legend_plane: Plane, i_histogram_scale_factor: Double, i_one_histogram_per_item: Double
#   port i_legend_height: Set the total height of the legend
#   port i_legend_width: Set the total width of the legend
#   port i_legend_plane: A construction plane for the legend
#   port i_one_histogram_per_item: make one curve per item
#   port o_viz_settings: Settings to be passed to the Visualization component
# ---------- dfvizsettings: Python ----------
#! python3

import System
import typing
import Rhino
from ghpythonlib.componentbase import executingcomponent as component
import Grasshopper as gh
from Grasshopper import Instances
from Grasshopper.Kernel import GH_RuntimeMessageLevel as RML

from diffCheck import df_visualization


def add_str_valuelist(self,
    values_list: typing.List[str],
    nickname: str,
    indx: int,
    X_param_coord: float,
    Y_param_coord: float,
    X_offset: int=87
    ) -> None:
    """
        Adds a value list of string values to the component input

        :param values_list: a list of string values to add to the value list
        :param nickname: the nickname of the value list
        :param indx: the index of the input parameter
        :param X_param_coord: the x coordinate of the input parameter
        :param Y_param_coord: the y coordinate of the input parameter
        :param X_offset: the offset of the value list from the input parameter
    """
    param = ghenv.Component.Params.Input[indx]  # noqa: F821
    if param.SourceCount == 0:
        valuelist = gh.Kernel.Special.GH_ValueList()
        valuelist.NickName = nickname
        valuelist.Description = "Select the value to use with DFVizSettings"
        selected = valuelist.FirstSelectedItem
        valuelist.ListItems.Clear()
        for v in values_list:
            vli = gh.Kernel.Special.GH_ValueListItem(str(v),str('"' + v + '"'))
            valuelist.ListItems.Add(vli)
        if selected in values_list:
            valuelist.SelectItem(values_list.index(selected))
        valuelist.CreateAttributes()
        valuelist.Attributes.Pivot = System.Drawing.PointF(
            X_param_coord - (valuelist.Attributes.Bounds.Width) - X_offset,
            Y_param_coord - (valuelist.Attributes.Bounds.Height / 2 + 0.1)
            )
        valuelist.Attributes.ExpireLayout()
        gh.Instances.ActiveCanvas.Document.AddObject(valuelist, False)
        ghenv.Component.Params.Input[indx].AddSource(valuelist)  # noqa: F821

def add_slider(self,
    nickname: str,
    indx: int,
    lower_bound: float,
    upper_bound: float,
    default_value: float,
    X_param_coord: float,
    Y_param_coord: float,
    X_offset: int=100
    ) -> None:
    """
        Adds a slider to the component input

        :param nickname: the nickname of the slider
        :param indx: the index of the input parameter
        :param X_param_coord: the x coordinate of the input parameter
        :param Y_param_coord: the y coordinate of the input parameter
        :param X_offset: the offset of the slider from the input parameter
    """
    param = ghenv.Component.Params.Input[indx]  # noqa: F821
    if param.SourceCount == 0:
        slider = gh.Kernel.Special.GH_NumberSlider()
        slider.NickName = nickname
        slider.Description = "Set the value for the threshold"
        slider.Slider.Minimum = System.Decimal(lower_bound)
        slider.Slider.Maximum = System.Decimal(upper_bound)
        slider.Slider.DecimalPlaces = 3
        slider.Slider.SmallChange = System.Decimal(0.001)
        slider.Slider.LargeChange = System.Decimal(0.01)
        slider.Slider.Value = System.Decimal(default_value)
        slider.CreateAttributes()
        slider.Attributes.Pivot = System.Drawing.PointF(
            X_param_coord - (slider.Attributes.Bounds.Width) - X_offset,
            Y_param_coord - (slider.Attributes.Bounds.Height / 2 - 0.1)
            )
        slider.Attributes.ExpireLayout()
        gh.Instances.ActiveCanvas.Document.AddObject(slider, False)
        ghenv.Component.Params.Input[indx].AddSource(slider)  # noqa: F821

def add_plane_object(self,
    nickname: str,
    indx: int,
    X_param_coord: float,
    Y_param_coord: float,
    X_offset: int=75
    ) -> None:
    """
        Adds a plane object to the component input

        :param nickname: the nickname of the plane object
        :param indx: the index of the input parameter
        :param X_param_coord: the x coordinate of the input parameter
        :param Y_param_coord: the y coordinate of the input parameter
        :param X_offset: the offset of the plane object from the input parameter
    """
    param = ghenv.Component.Params.Input[indx]  # noqa: F821
    if param.SourceCount == 0:
        doc = Instances.ActiveCanvas.Document
        if doc:
            plane = gh.Kernel.Parameters.Param_Plane()
            plane.NickName = nickname
            plane.CreateAttributes()
            plane.Attributes.Pivot = System.Drawing.PointF(
                X_param_coord - (plane.Attributes.Bounds.Width) - X_offset,
                Y_param_coord
                )
            plane.Attributes.ExpireLayout()
            doc.AddObject(plane, False)
            ghenv.Component.Params.Input[indx].AddSource(plane)  # noqa: F821


class DFVisualizationSettings(component):
    def __init__(self):
        self.poss_value_types = ["Dist", "RMSE", "MAX", "MIN", "STD"]
        self.poss_palettes = ["Jet", "Rainbow", "RdPu", "Viridis"]

        ghenv.Component.ExpireSolution(True)  # noqa: F821
        ghenv.Component.Attributes.PerformLayout()  # noqa: F821
        params = getattr(ghenv.Component.Params, "Input")  # noqa: F821
        for j in range(len(params)):
            Y_cord = params[j].Attributes.InputGrip.Y
            X_cord = params[j].Attributes.Pivot.X
            input_indx = j
            if "i_value_type" == params[j].NickName:
                add_str_valuelist(
                    ghenv.Component,  # noqa: F821
                    self.poss_value_types,
                    "DF_value_t",
                    input_indx, X_cord, Y_cord)
            if "i_palette" == params[j].NickName:
                add_str_valuelist(
                    ghenv.Component,  # noqa: F821
                    self.poss_palettes,
                    "DF_palette",
                    input_indx, X_cord, Y_cord)
            if "i_legend_height" == params[j].NickName:
                add_slider(
                    ghenv.Component,  # noqa: F821
                    "DF_legend_height",
                    input_indx,
                    0.000, 20.000, 10.000,
                    X_cord, Y_cord)
            if "i_legend_width" == params[j].NickName:
                add_slider(
                    ghenv.Component,  # noqa: F821
                    "DF_legend_width",
                    input_indx,
                    0.000, 2.000, 0.500,
                    X_cord, Y_cord)
            if "i_legend_plane" == params[j].NickName:
                add_plane_object(
                    ghenv.Component,  # noqa: F821
                    "DF_legend_plane",
                    input_indx, X_cord, Y_cord)
            if "i_histogram_scale_factor" == params[j].NickName:
                add_slider(
                    ghenv.Component,  # noqa: F821
                    "DF_histogram_scale_factor",
                    input_indx,
                    0.000, 1.000, 0.01,
                    X_cord, Y_cord)

    def RunScript(self,
            i_value_type: str,
            i_palette: str,
            i_upper_threshold: float,
            i_lower_threshold: float,
            i_legend_height: float,
            i_legend_width: float,
            i_legend_plane: Rhino.Geometry.Plane,
            i_histogram_scale_factor: float,
            i_one_histogram_per_item: float):

        """
        Compiles all the visualization settings to feed to the visualization component

        :param i_value_type: selected type indicates Which values to display. Possible values: "dist", "RMSE", "MAX", "MIN", "STD"
        :param i_palette: Select a color palette to map the values to. Possible values: "Jet", "Rainbow", "RdPu", "Viridis"
        :param i_upper_threshold: Thresholds the values with a maximum value
        :param i_lower_threshold: Thresholds the values with a minimum value
        :param i_legend_height: the total height of the legend
        :param i_legend_width: the total width of the legend
        :param i_legend_plane: the construction plane of the legend
        :param i_histogram_scale_factor: Scales the height of the histogram with a factor

        :returns o_viz_settings: the results of the comparison all in one object
        """
        # set default values
        if i_value_type is not None:
            if i_value_type not in self.poss_value_types:
                ghenv.Component.AddRuntimeMessage(RML.Warning, "Possible values for i_value_type are: dist, RMSE, MAX, MIN, STD")  # noqa: F821
                return None
        else:
            i_value_type = "Dist"
        if i_palette is not None:
            if i_palette not in self.poss_palettes:
                ghenv.Component.AddRuntimeMessage(RML.Warning, "Possible values for i_palette are: Jet, Rainbow, RdPu, Viridis")  # noqa: F821
                return None
        else:
            i_palette = "Jet"
        if i_legend_height is None:
            i_legend_height = 10
        if i_legend_width is None:
            i_legend_width = 0.5
        if i_legend_plane is None:
            i_legend_plane = Rhino.Geometry.Plane.WorldXY
        if i_histogram_scale_factor is None:
            i_histogram_scale_factor = 0.01
        if i_one_histogram_per_item is None:
            i_one_histogram_per_item = False

        # pack settings
        o_viz_settings = df_visualization.DFVizSettings(i_value_type,
                                                        i_palette,
                                                        i_upper_threshold,
                                                        i_lower_threshold,
                                                        i_legend_height,
                                                        i_legend_width,
                                                        i_legend_plane,
                                                        i_histogram_scale_factor,
                                                        i_one_histogram_per_item)

        return o_viz_settings

# if __name__ == "__main__":
#     com = DFVisualizationSettings()
#     o_viz_settings = com.RunScript(
#         i_value_type,
#         i_palette,
#         i_upper_threshold,
#         i_lower_threshold,
#         i_legend_height,
#         i_legend_width,
#         i_legend_plane,
#         i_histogram_scale_factor,
#         i_one_histogram_per_item
#         )
# ---------- end dfvizsettings ----------
data_11 = Data(data_10)
dfviz = DFVisualization(i_result=data_11, i_viz_settings=dfvizsettings)  # -> o_colored_geo, o_legend, o_histogram
#   port i_result: The result of the distance calculation
#   port i_viz_settings: The settings of the visualization
#   port o_colored_geo: The geometry colored according to the distance results.
#   port o_legend: The legend of the visualization
#   port o_histogram: Histogram that shows the frequency of the values
# ---------- dfviz: Python ----------
#! python3

import Rhino.Geometry as rg
from ghpythonlib.componentbase import executingcomponent as component

from diffCheck import df_cvt_bindings
from diffCheck import df_visualization
from diffCheck.df_visualization import DFVizSettings
from diffCheck.df_error_estimation import DFVizResults, DFInvalidData
from diffCheck import diffcheck_bindings

import copy
import numpy as np

class DFVisualization(component):
    def RunScript(self, i_result, i_viz_settings):

        if i_result is None or i_viz_settings is None:
            return None, None, None

        # result_cp = copy.copy(i_result)

        result_cp = DFVizResults(i_result.assembly)

        exclude_indices = [idx for idx, sanity_val in enumerate(i_result.sanity_check) if sanity_val.value != DFInvalidData.VALID.value]
        result_cp.source = [val for idx, val in enumerate(i_result.source) if idx not in exclude_indices]
        result_cp.target = [val for idx, val in enumerate(i_result.target) if idx not in exclude_indices]
        result_cp.distances = [val for idx, val in enumerate(i_result.distances) if idx not in exclude_indices]
        result_cp.distances_mean = [val for idx, val in enumerate(i_result.distances_mean) if idx not in exclude_indices]
        result_cp.distances_rmse = [val for idx, val in enumerate(i_result.distances_rmse) if idx not in exclude_indices]
        result_cp.distances_max_deviation = [val for idx, val in enumerate(i_result.distances_rmse) if idx not in exclude_indices]
        result_cp.distances_min_deviation = [val for idx, val in enumerate(i_result.distances_min_deviation) if idx not in exclude_indices]
        result_cp.distances_sd_deviation = [val for idx, val in enumerate(i_result.distances_sd_deviation) if idx not in exclude_indices]


        # for idx, sanity_val in enumerate(result_cp.sanity_check):
        #     if sanity_val.value != DFInvalidData.VALID.value:
        #         result_cp.source.pop(idx)
        #         result_cp.target.pop(idx)
        #         result_cp.distances.pop(idx)
        #         result_cp.distances_mean.pop(idx)
        #         result_cp.distances_rmse.pop(idx)
        #         result_cp.distances_max_deviation.pop(idx)
        #         result_cp.distances_min_deviation.pop(idx)
        #         result_cp.distances_sd_deviation.pop(idx)

        values, min_value, max_value = result_cp.filter_values_based_on_valuetype(i_viz_settings)

        # check if result_cp.source is a list of pointclouds or a mesh
        if result_cp.is_source_cloud:
            o_source = [df_cvt_bindings.cvt_dfcloud_2_rhcloud(src) for src in result_cp.source]
            o_colored_geo = [df_visualization.color_rh_pcd(src, dist, min_value, max_value, i_viz_settings.palette) for src, dist in zip(o_source, values)]
        else:
            o_source = result_cp.source
            o_colored_geo = [df_visualization.color_rh_mesh(src, dist, min_value, max_value, i_viz_settings.palette) for src, dist in zip(o_source, values)]

        o_legend = df_visualization.create_legend(min_value,
                                                  max_value,
                                                  i_viz_settings.palette,
                                                  steps=10,
                                                  plane=i_viz_settings.legend_plane,
                                                  width=i_viz_settings.legend_width,
                                                  total_height=i_viz_settings.legend_height)

        if len(result_cp.source) > 1 and i_viz_settings.one_histogram_per_item:
            multiple_curves = True
        else:
            multiple_curves = False

        o_histogram = df_visualization.create_histogram(values,
                                                        min_value,
                                                        max_value,
                                                        res=100,
                                                        steps=10,
                                                        plane=i_viz_settings.legend_plane,
                                                        total_height=i_viz_settings.legend_height,
                                                        scaling_factor=i_viz_settings.histogram_scale_factor,
                                                        multiple_curves = multiple_curves)

        return o_colored_geo, o_legend, o_histogram
# ---------- end dfviz ----------
vec = VectorXYZ(XComponent=Slider(-0.316, range=-5..5), YComponent=Slider(0, range=-5..5), ZComponent=0)  # -> Vector, Length
cluster = Cluster(d1_2=dfviz.o_colored_geo, d1=dfviz.o_legend, d2=dfviz.o_histogram, T=vec.Vector)  # -> graph_jf, graph_j

# ---- group: Results
data_12 = Data(data_11)

# ---- group: Graph per-joint
geo_22 = Geometry(cluster.graph_j)

geo_23 = Geometry(geo_22)

# ---- group: Graph per-jointface
geo_24 = Geometry(cluster.graph_jf)

geo_25 = Geometry(geo_24)

# ----
# Analysis preview
# Show either per-jointface or per-joint visualization
#  of the analysis
vis_type = ValueList({"per-jointface": 1, "per-joint": 0}, selected="per-joint")
cluster_2 = Cluster_2(d1=geo_25, d2=geo_23, data=vis_type)
preview_2 = CustomPreview(
    Geometry=cluster_2,
    Material={diffuse=RGB(221, 160, 221), emission=RGB(66, 48, 66), shine=0.5, specular=RGB(255, 255, 255), transparency=0})

# ---- group: Results
data_13 = Data(data_12)

# ----
# Error Output
# The diffcheck's computed results can be output
# for now in a basic csv file to be integrated in
# custom or different visualization pipelines.
txt = Text("CNC_log")
bool = Boolean(button)
panel = Panel("""_jointfaces
_joint""")
concat = Concatenate(FragmentA=txt, FragmentB=panel)  # -> graft(Result)
data_14 = Data(data_13)
path_2 = FilePath(path)

# ---- group: Results
data_15 = Data(data_12)

# ---- group: export csv per jointface + joint
dfcsvexporter = DFCsvExporter(i_dump=bool, i_export_dir=path_2, i_file_name=concat, i_result=data_14)  # inputs i_dump: Boolean, i_export_dir: String, i_file_name: String, i_export_seperate_files: Boolean
#   port i_result: The result of the distance calculation to export
# ---------- dfcsvexporter: Python ----------
#! python3


from ghpythonlib.componentbase import executingcomponent as component

from diffCheck.df_error_estimation import DFVizResults, DFInvalidData
import csv
import os


class DFCsvExporter(component):
    def __init__(self):
        super(DFCsvExporter, self).__init__()
        self.prefix = ""
        self.counter = 0
    
    def _get_id(self, idx, i_result):
        """ Get the ID of the element """
        counter = 0

        if self.prefix == "beam":
            return idx
        elif self.prefix == "joint":
            for idx_b, beam in enumerate(i_result.assembly.beams):
                for idx_j, joint in enumerate(beam.joints):
                    if counter == idx:
                        return f"{idx_b}--{idx_b}--{idx_j}"
                    counter += 1
        elif self.prefix == "joint_face":
            for idx_b, beam in enumerate(i_result.assembly.beams):
                for idx_j, joint in enumerate(beam.joints):
                    for idx_f, face in enumerate(joint.faces):
                        if counter == idx:
                            return f"{idx_b}--{idx_j}--{idx_f}"
                        counter += 1

    def _write_csv(self, file_path, rows):
        """ Write the CSV file """
        with open(file_path, mode='w', newline='') as file:
            writer = csv.writer(file)
            writer.writerow([f"{self.prefix} id", "distances", "min_deviation", "max_deviation", "std_deviation", "rmse", "mean"])
            writer.writerows(rows)

    def _prepare_row(self, idx, i_result):
        """ Prepare a row for the CSV file """
        if i_result.sanity_check[idx].value != DFInvalidData.VALID.value:
            invalid_type = i_result.sanity_check[idx].name
            return [self._get_id(idx, i_result), invalid_type, invalid_type, invalid_type, invalid_type, invalid_type, invalid_type]

        distances = [round(value, 4) for value in i_result.distances[idx]]
        min_dev = round(i_result.distances_min_deviation[idx], 4)
        max_dev = round(i_result.distances_max_deviation[idx], 4)
        std_dev = round(i_result.distances_sd_deviation[idx], 4)
        rmse = round(i_result.distances_rmse[idx], 4)
        mean = round(i_result.distances_mean[idx], 4)
        distances_str = ";".join(map(str, distances))
        return [self._get_id(idx, i_result), distances_str, min_dev, max_dev, std_dev, rmse, mean]

    def RunScript(self,
            i_dump: bool,
            i_export_dir: str,
            i_file_name: str,
            i_export_seperate_files: bool,
            i_result):

        if i_dump:
            os.makedirs(i_export_dir, exist_ok=True)

            if len(i_result.assembly.beams) == len(i_result.source):
                self.prefix = "beam"
            elif len(i_result.assembly.all_joints) == len(i_result.source):
                self.prefix = "joint"
            elif len(i_result.assembly.all_joint_faces) == len(i_result.source):
                self.prefix = "joint_face"

            if i_export_seperate_files:
                for idx in range(len(i_result.source)):
                    element_id = self._get_id( idx, i_result)
                    file_path = os.path.join(i_export_dir, f"{i_file_name}_{self.prefix}_{element_id}.csv")
                    self._write_csv(file_path, [self._prepare_row(idx, i_result)])
            else:
                file_path = os.path.join(i_export_dir, f"{i_file_name}.csv")
                rows = [self._prepare_row(idx, i_result) for idx in range(len(i_result.source))]
                self._write_csv(file_path, rows)
# ---------- end dfcsvexporter ----------

# ==== cluster Cluster
d1 = ClusterInput()
d2 = ClusterInput()
T = ClusterInput()
merge = Merge(Data1=d1, Data2=d2)
d1_2 = ClusterInput()
move = Move(Geometry=merge, Motion=T)  # -> Geometry, Transform
merge_2 = Merge(Data1=d1_2, Data2=move.Geometry)
bang = ExplodeTree(Data=merge_2)  # -> Branch0, Branch1
graph_jf = ClusterOutput(bang.Branch0)
graph_j = ClusterOutput(bang.Branch1)

# ==== cluster Cluster_2
data = ClusterInput()
d1 = ClusterInput()
d2 = ClusterInput()
data_2 = Data(data)
merge = Merge(Data1=d1, Data2=d2)  # -> simplify(Result)
invbool = InvertBoolean(Boolean=data_2)  # -> Inverted, Number
panel = Panel("""{0}
{1}""")
merge_2 = Merge(Data1=data_2, Data2=invbool.Inverted)
dispatch = Dispatch(List=panel, DispatchPattern=merge_2)  # -> ListA, ListB
branch = TreeBranch(Tree=merge, Path=dispatch.ListA, MaintainPaths=True)
B = ClusterOutput(branch)
