# Grasshopper definition exporter.ghx (Grasshopper 1.0.8)
# plug-ins: RhinoCodePluginGH

dump = Button()
path = FilePath("F:\diffCheck\temp\")
brep = Brep([<brep referenced from the Rhino model> x6])
xmlout = DFXMLExporter(i_dump=dump, i_assembly_name="AssemblyTest", i_export_dir=path, i_breps=brep)  # -> o_xml, o_joints, o_sides; inputs i_dump: Boolean, i_assembly_name: String, i_export_dir: String, i_breps: list of Brep
#   port i_dump: Press button to export xml
#   port i_assembly_name: The name of the assembly to export.
#   port i_export_dir: The directors where to export the xml file.
#   port i_breps: The breps of the structure.
#   port o_xml: The string of xml to be exported.
#   port o_joints: The breps of the faces belonging to joints.
#   port o_sides: The breps of the faces belonging to sides.
# ---------- xmlout: Python ----------
#! python3
# requirements: diffCheck

import System
import typing

import Rhino
import Rhino.Geometry as rg

from ghpythonlib.componentbase import executingcomponent as component

from diffCheck.df_geometries import DFVertex, DFFace, DFBeam, DFAssembly
import diffCheck.df_transformations
import diffCheck.df_joint_detector
import diffCheck.df_util


class DFXMLExporter(component):
    def RunScript(self,
            i_dump: bool,
            i_assembly_name: str,
            i_export_dir: str,
            i_breps: System.Collections.Generic.IList[Rhino.Geometry.Brep]):
        """
            This read breps from Rhino, converts them to DFBeams and DFAssemblies, and exports them to XML.
            
            :param i_dump: whether to dump the xml
            :param i_export_dir: directory to export the xml
            :param i_breps: list of breps
        """
        # beams
        beams : typing.List[DFBeam] = []
        for brep in i_breps:
            beam = DFBeam.from_brep(brep)
            beams.append(beam)

        # assembly
        assembly1 = DFAssembly(beams, i_assembly_name)

        # dump the xml
        xml : str = assembly1.to_xml()
        if i_dump:
            assembly1.dump(xml, i_export_dir)
        o_xml = xml

        # show the joint/side faces
        o_joints = [jf.to_brep() for jf in assembly1.all_joint_faces]
        o_sides = [sf.to_brep() for sf in assembly1.all_side_faces]

        return o_xml, o_joints, o_sides
# ---------- end xmlout ----------
preview = CustomPreview(Geometry=xmlout.o_joints, Material=ColourSwatch(SwatchColor=RGB(128, 0, 255)))
preview_2 = CustomPreview(Geometry=xmlout.o_sides, Material=ColourSwatch(SwatchColor=RGB(102, 255, 0)))
