# Grasshopper definition assembly_beam_system.ghx (Grasshopper 1.0.8)
# plug-ins: RhinoCodePluginGH

pcloud = PointCloud(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)
pcloud_2 = PointCloud(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)
number_slider = Slider(46, range=0..1000)
entwine = Entwine(Branch00=pcloud, Branch01=pcloud_2, FlattenInputs=True)
brep = Brep([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])
sizedown = DFCloudSizeDownsample(i_cloud=entwine, i_size=number_slider)  # -> o_cloud; inputs i_size: Int32
#   port i_cloud: The point cloud to reduce the size.
#   port i_size: The size of the wished downsampled cloud.
#   port o_cloud: The downsampled cloud.
# ---------- sizedown: Python ----------
#! python3

import System
import typing

import Rhino
import Rhino.Geometry as rg
from ghpythonlib.componentbase import executingcomponent as component

import Grasshopper as gh
from Grasshopper.Kernel import GH_RuntimeMessageLevel as RML

import diffCheck
import diffCheck.df_geometries
from diffCheck import df_cvt_bindings

class DFCloudSizeDownsample(component):
    def __init__(self):
        super(DFCloudSizeDownsample, self).__init__()
        self.o_cloud = []
        
    def RunScript(self, i_cloud: Rhino.Geometry.PointCloud, i_size: int) -> rg.PointCloud:
        """
            Downsample a point cloud by giving the target size of the downsampled cloud.

            :param i_cloud: input point cloud
            :param i_size: the size of the wished downsampled cloud

            :return o_cloud: downsampled point cloud
        """
        df_cloud = df_cvt_bindings.cvt_rhcloud_2_dfcloud(i_cloud)
        df_cloud.downsample_by_size(i_size)
        cloud = df_cvt_bindings.cvt_dfcloud_2_rhcloud(df_cloud)

        self.o_cloud = [cloud]

        # return [cloud]

    
    def AfterRunScript(self):
        """
            This method is called as soon as the component has finished
            its calculation. It is used to load the GHComponent outputs
            with the values created in the script.
        """
        ghenv.Component.Params.Output[0].VolatileData.Clear()
        ghenv.Component.Params.Output[0].AddVolatileDataList(gh.Kernel.Data.GH_Path(0), self.o_cloud)

# if __name__ == "__main__":
#     com = DFCloudSizeDownsample()
#     o_cloud = com.RunScript(
#         i_cloud,
#         i_size,
#         )
# ---------- end sizedown ----------
scsy_cpy = ScriptSyncCpython(select_file=Button(), packages_2_reload="diffCheck", i_cloud=pcloud, i_size=number_slider)  # -> stdout, o_cloud; inputs select_file: Boolean, packages_2_reload: list of String, i_size: Int32
#   port select_file: Connect a button to open a file dialog to select a cpython file to run.
#   port packages_2_reload: Pass a list with the name of the custom packages you want to reload. This function is useful if you are developing a i.e. PyPI package and you want to reload the submodules after you modified something. The function will reload the package and all its submodules. If you want to reload the package and all its submodules, just pass the package name. If you want to reload only a submodule, pass the package name and the submodule name separated by a dot. If you want to reload multiple submodules, pass the package
#   port i_cloud: A generic x input.
#   port stdout: The redirected standard output of the component scriptsync.
#   port o_cloud: Generic example output of the component
# ---------- scsy_cpy: Python ----------
from ghpythonlib.componentbase import executingcomponent as component

import System
import System.Drawing
import Rhino
import rhinoscriptsyntax as rs
import Grasshopper
import Grasshopper as gh
from Grasshopper.Kernel import GH_RuntimeMessageLevel as RML
import sys
import os
import time

import contextlib
import io

import abc
import socket
import threading
import queue
import json

import importlib
import sys

import traceback


class GHThread(threading.Thread, metaclass=abc.ABCMeta):
    """
        A base class for Grasshopper threads.
    """
    def __init__(self, name : str):
        super().__init__(name=name, daemon=False)
        self._component_on_canvas = True
        self._component_enabled = True

    @abc.abstractmethod
    def run(self):
        """ Run the thread. """
        pass

    def _check_if_component_on_canvas(self):
        """ Check if the component is on canvas from thread. """
        def __check_if_component_on_canvas():
            if ghenv.Component.OnPingDocument() is None:
                self._component_on_canvas = False
                return False
            else:
                self._component_on_canvas = True
                return True
        action = System.Action(__check_if_component_on_canvas)
        Rhino.RhinoApp.InvokeOnUiThread(action)

    def _check_if_component_enabled(self):
        """ Check if the component is enabled from thread. """
        def __check_if_component_enabled():
            if ghenv.Component.Locked:
                self._component_enabled = False
            else:
                self._component_enabled = True
        action = System.Action(__check_if_component_enabled)
        Rhino.RhinoApp.InvokeOnUiThread(action)

    def expire_component_solution(self):
        """ Fire the recalculation of the component solution from thread. """
        def __expire_component_solution():
            ghenv.Component.Params.Output[0].ClearData()  # clear the output
            ghenv.Component.ExpireSolution(True)  # expire the component
        action = System.Action(__expire_component_solution)
        Rhino.RhinoApp.InvokeOnUiThread(action)

    def clear_component(self):
        """ Clear the component from thread. """
        def __clear_component():
            ghenv.Component.ClearData()
        action = System.Action(__clear_component)
        Rhino.RhinoApp.InvokeOnUiThread(action)

    def add_runtime_warning(self, exception : str):
        """ Add a warning tab to the component from main thread. """
        action = System.Action(
            lambda: ghenv.Component.AddRuntimeMessage(RML.Warning, exception)
        )
        Rhino.RhinoApp.InvokeOnUiThread(action)

    def add_runtime_error(self, exception : str):
        """ Add an error tab to the component from main thread. """
        action = System.Action(
            lambda: ghenv.Component.AddRuntimeMessage(RML.Error, exception)
        )
        Rhino.RhinoApp.InvokeOnUiThread(action)

    def add_runtime_remark(self, exception : str):
        """ Add a blank tab to the component from main thread. """
        action = System.Action(
            lambda: ghenv.Component.AddRuntimeMessage(RML.Remark, exception)
        )
        Rhino.RhinoApp.InvokeOnUiThread(action)

    @property
    def component_enabled(self):
        self._check_if_component_enabled()
        return self._component_enabled

    @property
    def component_on_canvas(self):
        self._check_if_component_on_canvas()
        return self._component_on_canvas

class ClientThread(GHThread):
    """
    A thread to connect to the VSCode server.
    """
    def __init__(self, vscode_server_ip: str, vscode_server_port: int, name: str,
                 queue_msg: queue.Queue = None, lock_queue_msg: threading.Lock = None,
                 event_fire_msg: threading.Event = None):
        super().__init__(name=name)
        self.vscode_server_ip = vscode_server_ip
        self.vscode_server_port = vscode_server_port
        self.is_connected = False
        self.connect_refresh_rate = 1  # seconds
        self.queue_msg = queue_msg
        self.lock_queue_msg = lock_queue_msg
        self.event_fire_msg = event_fire_msg
        self.client_socket = socket.socket(socket.AF_INET, socket.SOCK_STREAM)

    def run(self):
        """ Run the thread. Send the message to the vscode server."""
        while self.component_on_canvas and self.component_enabled:
            try:
                if not self.is_connected:
                    self.connect_to_vscode_server()
                    self.clear_component()
                    self.expire_component_solution()
                    continue

                self.event_fire_msg.wait()
                self.send_message_from_queue()

            except Exception as e:
                self.add_runtime_warning(f"script-sync::Unkown error from run: {str(e)}")
                self.is_connected = False
                self.client_socket = socket.socket(socket.AF_INET, socket.SOCK_STREAM)

        self.client_socket.close()

    def send_message_from_queue(self):
        with self.lock_queue_msg:
            if self.queue_msg and not self.queue_msg.empty():
                msg = self.queue_msg.get()
                self.queue_msg.task_done()
                self.event_fire_msg.set()
                self.event_fire_msg.clear()
                self.client_socket.send(msg)

    def connect_to_vscode_server(self):
        """ Connect to the VSCode server. """
        while self.component_on_canvas and not self.is_connected:
            try:
                self.client_socket.send(b"")
                self.is_connected = True
            except socket.error:
                try:
                    self.client_socket.connect((self.vscode_server_ip, self.vscode_server_port))
                    self.is_connected = True
                except (ConnectionRefusedError, ConnectionResetError, socket.error) as e:
                    self.handle_connection_error(e)
            finally:
                time.sleep(self.connect_refresh_rate)

    def handle_connection_error(self, e):
        error_messages = {
            ConnectionRefusedError: "script-sync::Connection refused by the vscode",
            ConnectionResetError: "script-sync::Connection was forcibly closed by the vscode",
            socket.error: f"script-sync::Error connecting to the vscode: {str(e)}, have you tried to press Shift+F4 on VSCode?"
        }
        self.add_runtime_warning(error_messages[type(e)])
        self.is_connected = False if type(e) != socket.error or e.winerror != 10056 else True

class FileChangedThread(GHThread):
    """
        A thread to check if the file has changed on disk.
    """
    def __init__(self,
                path : str,
                name : str
                ):
        super().__init__(name=name)
        self.path = path
        self.refresh_rate = 1000  # milliseconds
        self._on_file_changed = threading.Event()

    def run(self):
        """
            Check if the file has changed on disk.
        """
        last_modified = os.path.getmtime(self.path)
        while self.component_on_canvas and not self._on_file_changed.is_set():
            System.Threading.Thread.Sleep(self.refresh_rate)
            last_modified = self.is_file_modified(last_modified)
        self._on_file_changed.clear()
        return

    def stop(self):
        """ Stop the thread. """
        self._on_file_changed.set()

    def is_file_modified(self, last_modified):
        current_modified = os.path.getmtime(self.path)
        if current_modified != last_modified:
            self.expire_component_solution()
            return current_modified
        return last_modified

class ScriptSyncCPy(component):
    def __init__(self):
        super(ScriptSyncCPy, self).__init__()
        self._var_output = []

        self.is_success = False

        self.client_thread_name : str = f"script-sync-client-thread::{ghenv.Component.InstanceGuid}"
        self.vscode_server_ip = "127.0.0.1"
        self.vscode_server_port = 58260
        self.stdout = None
        self.queue_msg = queue.Queue()
        self.queue_msg_lock = threading.Lock()
        self.event_fire_msg = threading.Event()

        self.filechanged_thread_name : str = f"script-sync-fileChanged-thread::{ghenv.Component.InstanceGuid}"
        self.__path_name_table_value = "script-sync::" + "path::" + str(ghenv.Component.InstanceGuid)
        if self.path is None:
            ghenv.Component.Message = "select-script"

    def RemovedFromDocument(self, doc):
        """ Remove the component from the document. """
        if self.client_thread_name in [t.name for t in threading.enumerate()]:
            client_thread = [t for t in threading.enumerate() if t.name == self.client_thread_name][0]
            client_thread.join()
        if self.filechanged_thread_name in [t.name for t in threading.enumerate()]:
            filechanged_thread = [t for t in threading.enumerate() if t.name == self.filechanged_thread_name][0]
            filechanged_thread.join()
        if self.queue_msg is not None:
            self.queue_msg.join()
        if self.queue_msg_lock is not None:
            self.queue_msg_lock.release()
        if self.event_fire_msg is not None:
            self.event_fire_msg.clear()

        # clear the path from the table view
        del self.path

    def init_script_path(self, select_file : bool = False):
        """
            Check if the button is pressed and load/change path script.
            
            :param select_file: A boolean of the button
        """
        # check if button is pressed
        if select_file is True:
            filename = rs.OpenFileName("Open", "Python Files (*.py)|*.py||")
            if filename is None:
                raise Exception("script-sync::No file selected")
            self.path = filename

        # fi file is in table view before
        if not os.path.exists(self.path):
            raise Exception("script-sync::File does not exist")
    
    def reload_all_modules(self, directory):
        for filename in os.listdir(directory):
            if filename.endswith('.py') and filename != '__init__.py':
                module_name = filename[:-3]  # remove '.py' from filename
                if module_name in sys.modules:
                    importlib.reload(sys.modules[module_name])

    def safe_exec(self, path, globals, locals, packages_2_reload):
        """
            Execute Python3 code safely. It redirects the output of the code
            to a string buffer 'stdout' to output to the GH component param.
            It is send to the vscode server.
            
            :param path: The path of the file to execute.
            :param globals: The globals dictionary.
            :param locals: The locals dictionary.
            :param packages_2_reload: The list of packages to reload, this is used for custom packages developement.
            installed on the system via an editable pip installation for example.
        """
        try:
            with open(path, 'r') as f:
                # reload the specifyed packages
                if packages_2_reload is not None:
                    if packages_2_reload.__len__() != 0:
                        for package in packages_2_reload:
                            for key in list(sys.modules.keys()):
                                if package in key:
                                    #check that the package must have the attribute __file__ (to avoid reloading pyd)
                                    if hasattr(sys.modules[key], '__file__'):
                                        importlib.reload(sys.modules[key])

                # add the path and sub directories to  the sys path
                path_dir = os.path.dirname(path)
                sub_dirs = []
                for root, dirs, files in os.walk(path_dir):
                    for d in dirs:
                        sub_dirs.append(os.path.join(root, d))
                sys.path.extend([path_dir] + sub_dirs)

                # reload all the modules also of the sub directories
                for root, dirs, files in os.walk(path_dir):
                    for d in dirs:
                        self.reload_all_modules(os.path.join(root, d))
                self.reload_all_modules(path_dir)

                # refresh the python interpreter
                importlib.invalidate_caches()

                # parse the code
                code = compile(f.read(), path, 'exec')
                output = io.StringIO()

                # empty the queue and event
                with self.queue_msg_lock:
                    while not self.queue_msg.empty():
                        self.queue_msg.get()
                        self.queue_msg.task_done()
                self.event_fire_msg.clear()

                # clear all the locals dictionary to avoid that the output variables stick between the component
                # executions when it is recomputed
                outparam = ghenv.Component.Params.Output
                outparam_names = [p.NickName for p in outparam]
                for outp in outparam_names:
                    if outp in locals.keys():
                        del locals[outp]

                # execute the code
                with contextlib.redirect_stdout(output):
                    exec(code, globals, locals)
                locals["stdout"] = output.getvalue()

                # send the msg to the vscode server
                msg_json = json.dumps({"script_path": path,
                                       "guid": str(ghenv.Component.InstanceGuid),
                                       "msg": output.getvalue()})
                msg_json = msg_json.encode('utf-8')
                self.queue_msg.put(msg_json)
                self.event_fire_msg.set()

                # pass the script variables to the GH component outputs
                for outp in outparam_names:
                    if outp in locals.keys():
                        self._var_output.append(locals[outp])
                    else:
                        self._var_output.append(None)

                sys.stdout = sys.__stdout__
            return locals

        except Exception as e:
            # Get the traceback
            tb = traceback.format_exc()

            # Send the error message to the vscode server
            err_json = json.dumps({
                "script_path": path,
                "guid": str(ghenv.Component.InstanceGuid),
                "msg": "err:" + str(e),
                "traceback": tb  # Include the traceback in the JSON
            })
            err_json = err_json.encode('utf-8')
            self.queue_msg.put(err_json)
            self.event_fire_msg.set()

            sys.stdout = sys.__stdout__

            err_msg = f"script-sync::Error in the code: {str(e)}\n{tb}"
            raise Exception(err_msg)

    def RunScript(self,
            select_file: bool,
            packages_2_reload: System.Collections.Generic.List[str],
            i_cloud: Rhino.Geometry.PointCloud,
            i_size: int):
        """ This method is called whenever the component has to be recalculated it's the solve main instance. """
        self.is_success = False

        # set the path if button is pressed
        self.init_script_path(select_file)

        # file change listener thread
        if self.filechanged_thread_name not in [t.name for t in threading.enumerate()]:
            FileChangedThread(self.path,
                              self.filechanged_thread_name
                              ).start()

        # set up the tcp client to connect to the vscode server
        _ = [print(t.name) for t in threading.enumerate()]
        if self.client_thread_name not in [t.name for t in threading.enumerate()]:
            ClientThread(self.vscode_server_ip,
                        self.vscode_server_port,
                        self.client_thread_name,
                        self.queue_msg,
                        self.queue_msg_lock,
                        self.event_fire_msg
                        ).start()

        # add to the globals all the input parameters of the component (the locals)
        globals().update(locals())

        res = self.safe_exec(self.path, None, globals(), packages_2_reload)
        self.is_success = True
        return

    def is_nested_iterable(self, lst):
        """ Detect if a list is nested. """
        return any(isinstance(i, list) for i in lst)

    def AfterRunScript(self):
        """
            This method is called as soon as the component has finished
            its calculation. It is used to load the GHComponent outputs
            with the values created in the script.
        """
        if not self.is_success:
            return

        outparam = [p for p in ghenv.Component.Params.Output]
        outparam_names = [p.NickName for p in outparam]

        for idx, outp in enumerate(outparam):
            # detect if the output is a list
            if type(self._var_output[idx]) == tuple:
                ghenv.Component.Params.Output[idx].VolatileData.Clear()
                ghenv.Component.Params.Output[idx].AddVolatileDataList(gh.Kernel.Data.GH_Path(0), self._var_output[idx])
            # TODO: increase the number of nested lists they can be handles (max 2 deep for now)
            elif type(self._var_output[idx]) == list:
                ghenv.Component.Params.Output[idx].VolatileData.Clear()
                if self.is_nested_iterable(self._var_output[idx]):
                    nbr_lists_aka_branches = len(self._var_output[idx])
                    for i in range(nbr_lists_aka_branches):
                        ghenv.Component.Params.Output[idx].AddVolatileDataList(gh.Kernel.Data.GH_Path(i), self._var_output[idx][i])
                else:
                    ghenv.Component.Params.Output[idx].AddVolatileDataList(gh.Kernel.Data.GH_Path(0), self._var_output[idx])
            else:
                ghenv.Component.Params.Output[idx].VolatileData.Clear()
                ghenv.Component.Params.Output[idx].AddVolatileData(gh.Kernel.Data.GH_Path(0), 0, self._var_output[idx])
        self._var_output.clear()

    @property
    def path(self):
        """ Get the path of the file from the table view to be sticking between the sessions. """
        table_value = ghenv.Component.OnPingDocument().ValueTable.GetValue(
            self.__path_name_table_value, "not_found"
        )
        if table_value != "not_found":
            return table_value
        else:
            return None

    @path.setter
    def path(self, path : str):
        """ Set the path of the file to the table view to be sticking between the sessions. """
        ghenv.Component.OnPingDocument().ValueTable.SetValue(self.__path_name_table_value, path)

        script_name = os.path.basename(path)
        ghenv.Component.Message = f"{script_name}"

        if self.filechanged_thread_name in [t.name for t in threading.enumerate()]:
            _ = [t for t in threading.enumerate() if t.name == self.filechanged_thread_name][0].stop()

    @path.deleter
    def path(self):
        """ Delete the path of the file from the table view if the object is erased. """
        ghenv.Component.OnPingDocument().ValueTable.DeleteValue(self.__path_name_table_value)
# ---------- end scsy_cpy ----------
uniformdown = DFCloudUniformDownsample(i_cloud=entwine, i_every_k_points=number_slider)  # -> o_cloud; inputs i_every_k_points: Int32
#   port i_cloud: The point cloud to reduce the size.
#   port i_every_k_points: Every k value points will be deleted.
#   port o_cloud: The downsampled cloud.
# ---------- uniformdown: Python ----------
#! python3

import System
import typing

import Rhino
import Rhino.Geometry as rg
from ghpythonlib.componentbase import executingcomponent as component

import Grasshopper as gh
from Grasshopper.Kernel import GH_RuntimeMessageLevel as RML

import diffCheck
import diffCheck.df_geometries
from diffCheck import df_cvt_bindings

class DFCloudUniformDownsample(component):
    def RunScript(self,
        i_cloud: rg.PointCloud,
        i_every_k_points: int,
    ) -> rg.PointCloud:
        """
            Downsample a point cloud using in a uniform way by selecting every k points to delete.

            :param i_cloud: input point cloud
            :param i_every_k_points: number of every k points to delete

            :return o_cloud: downsampled point cloud
        """
        df_cloud = df_cvt_bindings.cvt_rhcloud_2_dfcloud(i_cloud)
        df_cloud.uniform_downsample(i_every_k_points)
        o_cloud = df_cvt_bindings.cvt_dfcloud_2_rhcloud(df_cloud)

        return [o_cloud]

# if __name__ == "__main__":
#     com = DFCloudUniformDownsample()
#     o_cloud = com.RunScript(
#         i_cloud,
#         i_every_k_points,
#         )
# ---------- end uniformdown ----------

# ---- group: build assembly
dfbuildassembly = DFBuildAssembly(i_assembly_name="test_name", i_breps=brep)  # -> o_assembly; inputs i_assembly_name: String, i_breps: list of Brep
#   port i_assembly_name: The name of the assembly to export.
#   port i_breps: The breps of the structure.
#   port o_assembly: The create DFAssembly object representing the timber elements.
# ---------- dfbuildassembly: Python ----------
#! python3

import System
import typing

import Rhino
import Rhino.Geometry as rg
import scriptcontext as sc

from ghpythonlib.componentbase import executingcomponent as component

import diffCheck
from diffCheck.df_geometries import DFBeam, DFAssembly


class DFBuildAssembly(component):
    def RunScript(self,
            i_assembly_name: str,
            i_breps: System.Collections.Generic.List[Rhino.Geometry.Brep]):
        """
            This component parse a series of breps representing a timber structure or a 
            timber elements into a DFAssembly object.
            
            :param i_assembly_name: the name of the assembly
            :param i_breps: list of breps

            :return o_assembly: the DFAssembly object
        """
        beams: typing.List[DFBeam] = []
        for brep in i_breps:
            beam = DFBeam.from_brep_face(brep)
            beams.append(beam)

        o_assembly = DFAssembly(beams, i_assembly_name)

        return o_assembly


# if __name__ == "__main__":
#     comp = DFBuildAssembly()
#     o_assembly = comp.RunScript(
#         i_assembly_name,
#         i_breps
#     )
# ---------- end dfbuildassembly ----------

# ----
panel = Panel(sizedown)

# ---- group: deconstruct assembly
dfdeconstructassembly = DFDeconstructAssembly(i_assembly=dfbuildassembly)  # -> o_beams
#   port i_assembly: The DFAssembly object to deconstruct.
#   port o_beams: The set of beams contained by this DFAssembly object.
# ---------- dfdeconstructassembly: Python ----------
#! python3

import System
import typing

import Rhino
import Rhino.Geometry as rg
import scriptcontext as sc

from ghpythonlib.componentbase import executingcomponent as component

import diffCheck
from diffCheck.df_geometries import DFBeam, DFAssembly


class DFDeconstructAssembly(component):
    def RunScript(self, i_assembly):
        """
            Deconstruct the DFAssembly into a set of df_beams objects.
            
            :param i_assembly: the DFAssembly object

            :return o_beams
        """
        o_beams = i_assembly.beams

        return o_beams


# if __name__ == "__main__":
#     comp = DFDeconstructAssembly()
#     o_beams = comp.RunScript(
#         i_assembly
#     )
# ---------- end dfdeconstructassembly ----------

# ----
panel_2 = Panel(uniformdown)
panel_3 = Panel(scsy_cpy.o_cloud)

# ---- group: deconstruct beam
dfdeconstructbeam = DFDeconstructBeam(i_beams=graft(dfdeconstructassembly))  # -> o_side_faces, o_joint_faces, o_joint_ids; inputs i_beams: list
#   port i_beams: The DFBeam objects to deconstruct.
#   port o_side_faces: The side faces of as Breps of the beam.
#   port o_joint_faces: The faces as Breps belonging to joints of the beam.
#   port o_joint_ids: An integer indicating to which joint the joint faces are belonging to.
# ---------- dfdeconstructbeam: Python ----------
#! python3

import System
import typing

import Rhino
import Rhino.Geometry as rg
import scriptcontext as sc

from ghpythonlib.componentbase import executingcomponent as component

import diffCheck
from diffCheck.df_geometries import DFBeam, DFAssembly


class DFDeconstructBeam(component):
    def RunScript(self, i_beams: System.Collections.Generic.List[object]):
        """
            Deconstruct the DFBeam object into Rhino objects.
            
            :param i_beams: the DFBeam objects

            :return o_side_faces: the side joints of the beam
            :return o_joint_faces: the face joints of the beam
            :return o_joint_ids: the ids for each face joint
        """
        o_side_faces, o_joint_faces, o_joint_ids, o_breps = [], [], [], []

        for i_b in i_beams:
            o_side_faces = [f.to_brep_face() for f in i_b.side_faces]
            o_joint_faces = [f.to_brep_face() for f in i_b.joint_faces]
            o_joint_ids = [f.joint_id for f in i_b.joint_faces]

        return o_side_faces, o_joint_faces, o_joint_ids

# if __name__ == "__main__":
#     comp = DFDeconstructBeam()
#     o_side_faces, o_joint_faces, o_joint_ids = comp.RunScript(
#         i_beams
#     )
# ---------- end dfdeconstructbeam ----------

# ----
fastgreg = FastGlobalRegistration(i_recompute=Button(), i_cloud_source=pcloud_2)  # -> o_x_form; inputs i_recompute: Boolean, i_radius_kd_search: Double, i_neighbours_kd_search: Int32, i_max_corrspondence_dist: Double, i_iteration_number: Int32, i_max_tuple_count: Int32
#   port i_recompute: Connect a button to recompute the registration.
#   port i_cloud_source: The source point cloud.
#   port i_cloud_target: The target cloud.
#   port i_radius_kd_search: The radius used to search for neighbors in the KDTree.it is expressed relative to the point cloud size (0.01 means radiusKDTreeSearch = 1% of maxSize(pointCloud). It is used for the calculation of FPFHFeatures.
#   port i_neighbours_kd_search: The maximum number of neighbors to search for in the KDTree. It is used for the calculation of FPFHFeatures. A higher value will result in heavier computation but potentially more precise.
#   port i_max_corrspondence_dist: The maximum distance between correspondences. A higher value will result in more correspondences, but potentially include wrong ones.
#   port i_iteration_number: The number of iterations to run the RanSaC registration algorithm. A higher value will take more time to compute but increases the chances of finding a good transformation. As parameter of the FastGlobalRegistrationOption options.
#   port i_max_tuple_count: The maximum number of tuples to consider in the FPFH hyperspace. A higher value will result in heavier computation but potentially more precise. As parameter of the FastGlobalRegistrationOption options.
#   port o_x_form: The computed transformation.
# ---------- fastgreg: Python ----------
#! python3

import System
import typing

import Rhino
import Rhino.Geometry as rg
from ghpythonlib.componentbase import executingcomponent as component

import Grasshopper as gh
from Grasshopper.Kernel import GH_RuntimeMessageLevel as RML

import diffCheck
from diffCheck import diffcheck_bindings
from diffCheck import df_cvt_bindings
import diffCheck.df_util


class DFFastGlobalRegistration(component):
    def RunScript(self,
        i_cloud_source: rg.PointCloud,
        i_cloud_target: rg.PointCloud,
        i_radius_kd_search: float,
        i_neighbours_kd_search: int,
        i_max_corrspondence_dist: float,
        i_iteration_number: int,
        i_max_tuple_count: int
    ) -> rg.Transform:
        """
            The global registration component aligns two point clouds in a rough way.

            :param i_cloud_source: source point cloud
            :param i_cloud_target: target point cloud to align to
            :param i_radius_kd_search: radius for the kd search
            :param i_neighbours_kd_search: number of neighbours to consider
            :param i_max_corrspondence_dist: maximum correspondence distance
            :param i_iteration_number: number of iterations
            :param i_max_tuple_count: maximum tuple count

            :return o_x_form : transformation matrix
        """
        if i_cloud_source is None or i_cloud_target is None:
            ghenv.Component.AddRuntimeMessage(RML.Warning, "Please provide both objects of type point clouds to align")
            return None

        # set default values
        if i_radius_kd_search is None: i_radius_kd_search = 0.8
        if i_neighbours_kd_search is None: i_neighbours_kd_search = 50
        if i_max_corrspondence_dist is None: i_max_corrspondence_dist = 0.05
        if i_iteration_number is None: i_iteration_number = 128
        if i_max_tuple_count is None: i_max_tuple_count = 1000

        # get the working unit of the Rhino document, if other than meters, set a multiplier factor
        scalef = diffCheck.df_util.get_doc_2_meters_unitf()
        i_radius_kd_search *= scalef
        i_max_corrspondence_dist *= scalef

        df_cloud_source = df_cvt_bindings.cvt_rhcloud_2_dfcloud(i_cloud_source)
        df_cloud_target = df_cvt_bindings.cvt_rhcloud_2_dfcloud(i_cloud_target)

        df_xform = diffcheck_bindings.dfb_registrations.DFGlobalRegistrations.O3DFastGlobalRegistrationFeatureMatching(
            source=df_cloud_source,
            target=df_cloud_target,
            voxelize=False,  # set as default
            voxel_size=0.1,  # set as default
            radius_kd_tree_search=i_radius_kd_search,
            max_neighbor_kd_tree_search=i_neighbours_kd_search,
            max_correspondence_distance=i_max_corrspondence_dist,
            iteration_number=i_iteration_number,
            max_tuple_count=i_max_tuple_count
        )
        print("-------------------")
        print("Estimated transformation matrix:")
        print(df_xform.transformation_matrix)
        print("-------------------")

        # cvt df xform to rhino xform
        df_xform_matrix = df_xform.transformation_matrix
        rh_form = rg.Transform()
        for i in range(4):
            for j in range(4):
                rh_form[i, j] = df_xform_matrix[i, j]
        if rh_form == rg.Transform.Identity:
            ghenv.Component.AddRuntimeMessage(RML.Warning, "The transformation matrix is identity, no transformation is applied")
            return None

        o_x_form = rh_form

        return o_x_form


# if __name__ == "__main__":
#     com = DFFastGlobalRegistration()
#     o_x_form = com.RunScript(
#         i_cloud_source,
#         i_cloud_target,
#         i_radius_kd_search,
#         i_neighbours_kd_search,
#         i_max_corrspondence_dist,
#         i_iteration_number,
#         i_max_tuple_count
#         )
# ---------- end fastgreg ----------
custom_preview = CustomPreview(Geometry=dfdeconstructbeam.o_joint_faces, Material=ColourSwatch(SwatchColor=RGB(64, 255, 105)))
custom_preview_2 = CustomPreview(Geometry=dfdeconstructbeam.o_side_faces, Material=ColourSwatch(SwatchColor=RGB(121, 64, 255)))
panel_4 = Panel(dfdeconstructbeam.o_joint_ids)
