# Grasshopper definition normal_estimation.ghx (Grasshopper 1.0.8)
# plug-ins: RhinoCodePluginGH

pcloud = PointCloud(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)
dfcnormestim = DFCloudNormalEstimator(i_cloud=pcloud)  # -> o_cloud; inputs i_knn: Int32, i_radius: Int32, i_bool: Boolean
#   port i_cloud: The point cloud to evaluate.
#   port i_knn: The knn search value (by default 100).
#   port i_radius: The radius search. If value is provided the search will be hybrid.
#   port o_cloud: The cloud with normals computed.
# ---------- dfcnormestim: Python ----------
#! python3

import System

import Rhino
import Rhino.Geometry as rg
from ghpythonlib.componentbase import executingcomponent as component

import diffCheck
import diffCheck.df_geometries
from diffCheck import df_cvt_bindings

class DFCloudNormalEstimator(component):
    def RunScript(self,
        i_cloud : rg.PointCloud = None,
        i_knn : int = None,
        i_radius : float = None,
        i_switch_mode : bool = True
    ):
        """
            Evaluaate the n ormals of a point cloud.

            :param i_cloud: Point cloud to evaluate normals.
            :i_knn: Number of nearest neighbors to consider.
            :i_radius: Radius of the search.
            :i_switch_mode: Switch between Open3d (true) or Cilantro (false) library.
        """
        o_cloud = rg.PointCloud()

        df_cloud = df_cvt_bindings.cvt_rhcloud_2_dfcloud(i_cloud)

        if i_knn is None:
            i_knn = 100

        df_cloud.estimate_normals(
            use_cilantro_evaluator=i_switch_mode,
            knn=i_knn,
            search_radius=i_radius
            )

        o_cloud = df_cvt_bindings.cvt_dfcloud_2_rhcloud(df_cloud)

        return o_cloud

# if __name__ == "__main__":
#     comp = DFCloudNormalEstimator()
#     o_cloud = comp.RunScript(
#         i_cloud,
#         i_knn,
#         i_radius,
#         i_switch_mode
#     )
# ---------- end dfcnormestim ----------
dfcnorseg = DFNormalSegmentator(i_cloud=dfcnormestim)  # -> o_clusters; inputs i_normal_threshold_degree: Double, i_min_cluster_size: Int32, i_use_knn_neighborhood: Boolean, i_knn_neighborhood_size: Int32, i_radius_neighborhood_size: Double
#   port i_cloud: The point cloud to reduce the size.
#   port i_normal_threshold_degree: The normal threshold in degrees (under that it consider to the same cluster).
#   port i_min_cluster_size: The smallest cluster allowed.
#   port i_use_knn_neighborhood: If true use knn, otherwise radius search.
#   port i_knn_neighborhood_size: The knn size.
#   port i_radius_neighborhood_size: The size of the radius.
#   port o_clusters: The segmented clouds.
# ---------- dfcnorseg: Python ----------
#! python3

import System
import typing

import Rhino
import Rhino.Geometry as rg
from ghpythonlib.componentbase import executingcomponent as component

import Grasshopper as gh
from Grasshopper.Kernel import GH_RuntimeMessageLevel as RML

import diffCheck
import diffCheck.df_geometries
from diffCheck.diffcheck_bindings import dfb_segmentation

from diffCheck import df_cvt_bindings


class DFCloudNormalSegmentator(component):
    def RunScript(self,
        i_cloud,
        i_normal_threshold_degree=None,
        i_min_cluster_size=None,
        i_use_knn_neighborhood=None,
        i_knn_neighborhood_size=None,
        i_radius_neighborhood_size=None
    ) -> rg.PointCloud:
        """
            Segment a point cloud into clusters based on normals.

            :param i_cloud: Point cloud to segment.
            :param i_normal_threshold_degree: Threshold in degrees to consider a normal as a cluster.
            :param i_min_cluster_size: Minimum size of a cluster.
            :param i_use_knn_neighborhood: Use KNN neighborhood.
            :param i_knn_neighborhood_size: Size of the KNN neighborhood.
            :param i_radius_neighborhood_size: Size of the radius neighborhood.
        """
        o_clusters = []
        df_cloud = df_cvt_bindings.cvt_rhcloud_2_dfcloud(i_cloud)

        if i_normal_threshold_degree is None:
            i_normal_threshold_degree = 20
        if i_min_cluster_size is None:
            i_min_cluster_size = 10
        if i_use_knn_neighborhood is None:
            i_use_knn_neighborhood = True
        if i_knn_neighborhood_size is None:
            i_knn_neighborhood_size = 30
        if i_radius_neighborhood_size is None:
            i_radius_neighborhood_size = 0.1

        o_clusters = dfb_segmentation.DFSegmentation.segment_by_normal(
            point_cloud=df_cloud,

            normal_threshold_degree=i_normal_threshold_degree,
            min_cluster_size=i_min_cluster_size,
            use_knn_neighborhood=i_use_knn_neighborhood,
            knn_neighborhood_size=i_knn_neighborhood_size,
            radius_neighborhood_size=i_radius_neighborhood_size
        )

        return [df_cvt_bindings.cvt_dfcloud_2_rhcloud(cluster) for cluster in o_clusters]

# if __name__ == "__main__":
#     com = DFCloudNormalSegmentator()
#     o_clusters = com.RunScript(
#         i_cloud,
#         i_normal_threshold_degree,
#         i_min_cluster_size,
#         i_use_knn_neighborhood,
#         i_knn_neighborhood_size,
#         i_radius_neighborhood_size
#         )
# ---------- end dfcnorseg ----------
panel = Panel(dfcnorseg)
