# Grasshopper definition tester.ghx (Grasshopper 1.0.8)
# plug-ins: RhinoCodePluginGH

panel = Panel("diffCheck")  # disabled
dump = Button()  # disabled
panel_2 = Panel("AssemblyTest")  # disabled
button = Button()  # disabled
dump_2 = Button()  # disabled
panel_3 = Panel("AssemblyTest")  # disabled
brep = Brep(<brep referenced from the Rhino model>)  # disabled
path = FilePath("F:\diffCheck\temp\")  # disabled
button_2 = Button()  # disabled
brep_2 = Brep(<brep referenced from the Rhino model>)  # disabled
path_2 = FilePath("F:\diffCheck\temp\")  # disabled
dump_3 = Button()  # disabled
panel_4 = Panel("AssemblyTest")  # disabled
scsy_cpy = ScriptSyncCpython(btn=button, packages_2_reload=panel, i_export_dir=path, i_breps=brep, i_assembly_name=panel_2, i_dump=dump)  # -> stdout, o_xml, o_joints, o_sides; inputs btn: Boolean, packages_2_reload: list, i_breps: list of Brep, i_dump: Boolean; disabled
#   port btn: Connect a button to open a file dialog to select a cpython file to run.
#   port packages_2_reload: Pass a list with the name of the custom packages you want to reload. This function is useful if you are developing a i.e. PyPI package and you want to reload the submodules after you modified something. The function will reload the package and all its submodules. If you want to reload the package and all its submodules, just pass the package name. If you want to reload only a submodule, pass the package name and the submodule name separated by a dot. If you want to reload multiple submodules, pass the package
#   port i_breps: A generic x input.
#   port stdout: The redirected standard output of the component scriptsync.
#   port o_xml: Generic example output of the component
# ---------- scsy_cpy: Python ----------
from ghpythonlib.componentbase import executingcomponent as component

import System
import System.Drawing
import System.Windows.Forms
import Rhino
import Grasshopper
import Grasshopper as gh
from Grasshopper.Kernel import GH_RuntimeMessageLevel as RML
import sys
import os
import time

import contextlib
import io

import abc
import socket
import threading
import queue
import json

import importlib
import inspect
import sys


class GHThread(threading.Thread, metaclass=abc.ABCMeta):
    """
        A base class for Grasshopper threads.
    """
    def __init__(self, name : str):
        super().__init__(name=name, daemon=False)
        self._component_on_canvas = True
        self._component_enabled = True

    @abc.abstractmethod
    def run(self):
        """ Run the thread. """
        pass

    def _check_if_component_on_canvas(self):
        """ Check if the component is on canvas from thread. """
        def __check_if_component_on_canvas():
            if ghenv.Component.OnPingDocument() is None:
                self._component_on_canvas = False
                return False
            else:
                self._component_on_canvas = True
                return True
        action = System.Action(__check_if_component_on_canvas)
        Rhino.RhinoApp.InvokeOnUiThread(action)

    def _check_if_component_enabled(self):
        """ Check if the component is enabled from thread. """
        def __check_if_component_enabled():
            if ghenv.Component.Locked:
                self._component_enabled = False
            else:
                self._component_enabled = True
        action = System.Action(__check_if_component_enabled)
        Rhino.RhinoApp.InvokeOnUiThread(action)

    def expire_component_solution(self):
        """ Fire the recalculation of the component solution from thread. """
        def __expire_component_solution():
            ghenv.Component.Params.Output[0].ClearData()  # clear the output
            ghenv.Component.ExpireSolution(True)  # expire the component
        action = System.Action(__expire_component_solution)
        Rhino.RhinoApp.InvokeOnUiThread(action)

    def clear_component(self):
        """ Clear the component from thread. """
        def __clear_component():
            ghenv.Component.ClearData()
        action = System.Action(__clear_component)
        Rhino.RhinoApp.InvokeOnUiThread(action)

    def add_runtime_warning(self, exception : str):
        """ Add a warning tab to the component from main thread. """
        action = System.Action(
            lambda: ghenv.Component.AddRuntimeMessage(RML.Warning, exception)
        )
        Rhino.RhinoApp.InvokeOnUiThread(action)

    def add_runtime_error(self, exception : str):
        """ Add an error tab to the component from main thread. """
        action = System.Action(
            lambda: ghenv.Component.AddRuntimeMessage(RML.Error, exception)
        )
        Rhino.RhinoApp.InvokeOnUiThread(action)

    def add_runtime_remark(self, exception : str):
        """ Add a blank tab to the component from main thread. """
        action = System.Action(
            lambda: ghenv.Component.AddRuntimeMessage(RML.Remark, exception)
        )
        Rhino.RhinoApp.InvokeOnUiThread(action)

    @property
    def component_enabled(self):
        self._check_if_component_enabled()
        return self._component_enabled

    @property
    def component_on_canvas(self):
        self._check_if_component_on_canvas()
        return self._component_on_canvas

class ClientThread(GHThread):
    """
    A thread to connect to the VSCode server.
    """
    def __init__(self, vscode_server_ip: str, vscode_server_port: int, name: str,
                 queue_msg: queue.Queue = None, lock_queue_msg: threading.Lock = None,
                 event_fire_msg: threading.Event = None):
        super().__init__(name=name)
        self.vscode_server_ip = vscode_server_ip
        self.vscode_server_port = vscode_server_port
        self.is_connected = False
        self.connect_refresh_rate = 1  # seconds
        self.queue_msg = queue_msg
        self.lock_queue_msg = lock_queue_msg
        self.event_fire_msg = event_fire_msg
        self.client_socket = socket.socket(socket.AF_INET, socket.SOCK_STREAM)

    def run(self):
        """ Run the thread. Send the message to the vscode server."""
        while self.component_on_canvas and self.component_enabled:
            try:
                if not self.is_connected:
                    self.connect_to_vscode_server()
                    self.clear_component()
                    self.expire_component_solution()
                    continue

                self.event_fire_msg.wait()
                self.send_message_from_queue()

            except Exception as e:
                self.add_runtime_warning(f"script-sync::Unkown error from run: {str(e)}")
                self.is_connected = False
                self.client_socket = socket.socket(socket.AF_INET, socket.SOCK_STREAM)

        self.client_socket.close()

    def send_message_from_queue(self):
        with self.lock_queue_msg:
            if self.queue_msg and not self.queue_msg.empty():
                msg = self.queue_msg.get()
                self.queue_msg.task_done()
                self.event_fire_msg.set()
                self.event_fire_msg.clear()
                self.client_socket.send(msg)

    def connect_to_vscode_server(self):
        """ Connect to the VSCode server. """
        while self.component_on_canvas and not self.is_connected:
            try:
                self.client_socket.send(b"")
                self.is_connected = True
            except socket.error:
                try:
                    self.client_socket.connect((self.vscode_server_ip, self.vscode_server_port))
                    self.is_connected = True
                except (ConnectionRefusedError, ConnectionResetError, socket.error) as e:
                    self.handle_connection_error(e)
            finally:
                time.sleep(self.connect_refresh_rate)

    def handle_connection_error(self, e):
        error_messages = {
            ConnectionRefusedError: "script-sync::Connection refused by the vscode",
            ConnectionResetError: "script-sync::Connection was forcibly closed by the vscode",
            socket.error: f"script-sync::Error connecting to the vscode: {str(e)}"
        }
        self.add_runtime_warning(error_messages[type(e)])
        self.is_connected = False if type(e) != socket.error or e.winerror != 10056 else True

class FileChangedThread(GHThread):
    """
        A thread to check if the file has changed on disk.
    """
    def __init__(self,
                path : str,
                name : str
                ):
        super().__init__(name=name)
        self.path = path
        self.refresh_rate = 1000  # milliseconds
        self._on_file_changed = threading.Event()

    def run(self):
        """
            Check if the file has changed on disk.
        """
        last_modified = os.path.getmtime(self.path)
        while self.component_on_canvas and not self._on_file_changed.is_set():
            System.Threading.Thread.Sleep(self.refresh_rate)
            last_modified = self.is_file_modified(last_modified)
        self._on_file_changed.clear()
        return

    def stop(self):
        """ Stop the thread. """
        self._on_file_changed.set()

    def is_file_modified(self, last_modified):
        current_modified = os.path.getmtime(self.path)
        if current_modified != last_modified:
            self.expire_component_solution()
            return current_modified
        return last_modified


class ScriptSyncCPy(component):
    def __init__(self):
        super(ScriptSyncCPy, self).__init__()
        self._var_output = []

        self.is_success = False

        self.client_thread_name : str = f"script-sync-client-thread::{ghenv.Component.InstanceGuid}"
        self.vscode_server_ip = "127.0.0.1"
        self.vscode_server_port = 58260
        self.stdout = None
        self.queue_msg = queue.Queue()
        self.queue_msg_lock = threading.Lock()
        self.event_fire_msg = threading.Event()

        self.filechanged_thread_name : str = f"script-sync-fileChanged-thread::{ghenv.Component.InstanceGuid}"
        self.__path_name_table_value = "script-sync::" + "path::" + str(ghenv.Component.InstanceGuid)
        if self.path is None:
            ghenv.Component.Message = "select-script"

    def RemovedFromDocument(self, doc):
        """ Remove the component from the document. """
        if self.client_thread_name in [t.name for t in threading.enumerate()]:
            client_thread = [t for t in threading.enumerate() if t.name == self.client_thread_name][0]
            client_thread.join()
        if self.filechanged_thread_name in [t.name for t in threading.enumerate()]:
            filechanged_thread = [t for t in threading.enumerate() if t.name == self.filechanged_thread_name][0]
            filechanged_thread.join()
        if self.queue_msg is not None:
            self.queue_msg.join()
        if self.queue_msg_lock is not None:
            self.queue_msg_lock.release()
        if self.event_fire_msg is not None:
            self.event_fire_msg.clear()

        # clear the path from the table view
        del self.path

    def init_script_path(self, btn : bool = False):
        """
            Check if the button is pressed and load/change path script.
            
            :param btn: A boolean of the button
        """
        # check if button is pressed
        if btn is True:
            dialog = System.Windows.Forms.OpenFileDialog()
            dialog.Filter = "Python files (*.py)|*.py"
            dialog.Title = "Select a Python file"
            dialog.InitialDirectory = os.path.dirname("")
            dialog.FileName = ""
            dialog.Multiselect = False
            dialog.CheckFileExists = True
            dialog.CheckPathExists = True
            dialog.RestoreDirectory = True
            if dialog.ShowDialog() == System.Windows.Forms.DialogResult.OK:
                self.path = dialog.FileName

        # default init stauts
        if self.path is None:
            raise Exception("script-sync::File not selected")

        # fi file is in table view before
        if not os.path.exists(self.path):
            raise Exception("script-sync::File does not exist")
    
    def reload_all_modules(self, directory):
        for filename in os.listdir(directory):
            if filename.endswith('.py') and filename != '__init__.py':
                module_name = filename[:-3]  # remove '.py' from filename
                if module_name in sys.modules:
                    importlib.reload(sys.modules[module_name])

    def get_reloadable_modules(self):
        """
            Get all the reloadable modules from the sys.modules. It
            make sure to check the module spec and loader to only reload modules 
            that are actually loaded from a file or directory

            :return: The list of reloadable modules.
        """
        BUILTIN_ORIGINS = ['built-in', 'frozen']
        reloadables = []
        for m in sys.modules.values():
            if inspect.ismodule(m):
                spec = getattr(m, "__spec__", None)
                if spec:
                    if spec.origin in BUILTIN_ORIGINS \
                            or isinstance(spec.loader, importlib.machinery.SourcelessFileLoader):
                        continue
                reloadables.append(m)

        return reloadables

    def safe_exec(self, path, globals, locals, packages_2_reload):
        """
            Execute Python3 code safely. It redirects the output of the code
            to a string buffer 'stdout' to output to the GH component param.
            It is send to the vscode server.
            
            :param path: The path of the file to execute.
            :param globals: The globals dictionary.
            :param locals: The locals dictionary.
            :param packages_2_reload: The list of packages to reload, this is used for custom packages developement.
            installed on the system via an editable pip installation for example.
        """
        try:
            with open(path, 'r') as f:
                # reload the specifyed packages
                packages_2_reload = self.get_reloadable_modules()
                # if packages_2_reload is not None:
                #     if packages_2_reload.__len__() != 0:
                #         for package in packages_2_reload:
                #             for key in list(sys.modules.keys()):
                #                 if package in key:
                #                     importlib.reload(sys.modules[key])

                # add the path and sub directories to  the sys path
                path_dir = os.path.dirname(path)
                sub_dirs = []
                for root, dirs, files in os.walk(path_dir):
                    for d in dirs:
                        sub_dirs.append(os.path.join(root, d))
                sys.path.extend([path_dir] + sub_dirs)

                # reload all the modules also of the sub directories
                for root, dirs, files in os.walk(path_dir):
                    for d in dirs:
                        self.reload_all_modules(os.path.join(root, d))
                self.reload_all_modules(path_dir)

                # refresh the python interpreter
                importlib.invalidate_caches()

                # parse the code
                code = compile(f.read(), path, 'exec')
                output = io.StringIO()

                # empty the queue and event
                with self.queue_msg_lock:
                    while not self.queue_msg.empty():
                        self.queue_msg.get()
                        self.queue_msg.task_done()
                self.event_fire_msg.clear()

                # execute the code
                with contextlib.redirect_stdout(output):
                    exec(code, globals, locals)
                locals["stdout"] = output.getvalue()

                # send the msg to the vscode server
                msg_json = json.dumps({"script_path": path,
                                       "guid": str(ghenv.Component.InstanceGuid),
                                       "msg": output.getvalue()})
                msg_json = msg_json.encode('utf-8')
                self.queue_msg.put(msg_json)
                self.event_fire_msg.set()

                # pass the script variables to the GH component outputs
                outparam = ghenv.Component.Params.Output
                outparam_names = [p.NickName for p in outparam]
                for outp in outparam_names:
                    if outp in locals.keys():
                        self._var_output.append(locals[outp])
                    else:
                        self._var_output.append(None)

                sys.stdout = sys.__stdout__
            return locals

        except Exception as e:

            # send the error message to the vscode server
            err_json = json.dumps({"script_path": path,
                                    "guid": str(ghenv.Component.InstanceGuid),
                                    "msg": "err:" + str(e)})
            err_json = err_json.encode('utf-8')
            self.queue_msg.put(err_json)
            self.event_fire_msg.set()
            
            sys.stdout = sys.__stdout__

            err_msg = f"script-sync::Error in the code: {str(e)}"
            raise Exception(err_msg)

    def RunScript(self,
            btn: bool,
            packages_2_reload: System.Collections.Generic.IList[object],
            i_export_dir,
            i_breps: System.Collections.Generic.IList[Rhino.Geometry.Brep],
            i_assembly_name,
            i_dump: bool):
        """ This method is called whenever the component has to be recalculated it's the solve main instance. """
        self.is_success = False

        # set the path if button is pressed
        self.init_script_path(btn)

        # file change listener thread
        if self.filechanged_thread_name not in [t.name for t in threading.enumerate()]:
            FileChangedThread(self.path,
                              self.filechanged_thread_name
                              ).start()

        # set up the tcp client to connect to the vscode server
        _ = [print(t.name) for t in threading.enumerate()]
        if self.client_thread_name not in [t.name for t in threading.enumerate()]:
            ClientThread(self.vscode_server_ip,
                        self.vscode_server_port,
                        self.client_thread_name,
                        self.queue_msg,
                        self.queue_msg_lock,
                        self.event_fire_msg
                        ).start()

        # add to the globals all the input parameters of the component (the locals)
        globals().update(locals())

        res = self.safe_exec(self.path, None, globals(), packages_2_reload)
        self.is_success = True
        return

    def AfterRunScript(self):
        """
            This method is called as soon as the component has finished
            its calculation. It is used to load the GHComponent outputs
            with the values created in the script.
        """
        if not self.is_success:
            return
        outparam = [p for p in ghenv.Component.Params.Output]
        outparam_names = [p.NickName for p in outparam]
        
        # TODO: add the conversion to datatree for nested lists and tuples
        for idx, outp in enumerate(outparam):
            # detect if the output is a list
            if type(self._var_output[idx]) == list or type(self._var_output[idx]) == tuple:
                ghenv.Component.Params.Output[idx].VolatileData.Clear()
                ghenv.Component.Params.Output[idx].AddVolatileDataList(gh.Kernel.Data.GH_Path(0), self._var_output[idx])
            else:
                ghenv.Component.Params.Output[idx].VolatileData.Clear()
                ghenv.Component.Params.Output[idx].AddVolatileData(gh.Kernel.Data.GH_Path(0), 0, self._var_output[idx])
        self._var_output.clear()

    @property
    def path(self):
        """ Get the path of the file from the table view to be sticking between the sessions. """
        table_value = ghenv.Component.OnPingDocument().ValueTable.GetValue(
            self.__path_name_table_value, "not_found"
        )
        if table_value != "not_found":
            return table_value
        else:
            return None

    @path.setter
    def path(self, path : str):
        """ Set the path of the file to the table view to be sticking between the sessions. """
        ghenv.Component.OnPingDocument().ValueTable.SetValue(self.__path_name_table_value, path)

        script_name = os.path.basename(path)
        ghenv.Component.Message = f"{script_name}"

        if self.filechanged_thread_name in [t.name for t in threading.enumerate()]:
            _ = [t for t in threading.enumerate() if t.name == self.filechanged_thread_name][0].stop()

    @path.deleter
    def path(self):
        """ Delete the path of the file from the table view if the object is erased. """
        ghenv.Component.OnPingDocument().ValueTable.DeleteValue(self.__path_name_table_value)
# ---------- end scsy_cpy ----------
path_3 = FilePath("F:\__TEMP\test\")  # disabled
brep_3 = Brep([<brep referenced from the Rhino model> x6])  # disabled
dump_4 = Button()  # disabled
panel_5 = Panel("AssemblyTest")  # disabled
py3 = Python3Script(i_breps=brep_2)  # -> out, a; inputs i_breps: list of Brep; disabled
# ---------- py3: Python ----------
#! python3

import Rhino
import Rhino.Geometry as rg

import os
import typing

import diffCheck
import diffCheck.df_util 
from diffCheck.df_geometries import DFVertex, DFFace, DFBeam, DFAssembly

# # from diffCheck import df_joint_detector

if __name__ == "__main__":
    """
        Main function to test the package
        :param i_breps: list of breps
        :param i_export_dir: directory to export the xml
        :param i_dump: whether to dump the xml
    """
    # beams
    vertex1 = DFVertex(1, 1, 1)
    vertex2 = DFVertex(2, 2, 2)
    vertex3 = DFVertex(3, 3, 3)
    vertex4 = DFVertex(4, 4, 4)
    vertices = []
    vertices_temp = [vertex1, vertex2, vertex3, vertex4]
    vertices.append(vertices_temp)

    face1 = DFFace(vertices)
    face2 = DFFace(vertices)
    faces3 = DFFace(vertices)
    faces4 = DFFace(vertices)

    beams: typing.List[DFBeam] = []
    beam1 = DFBeam("Beam1", [face1, face2])
    beam2 = DFBeam("Beam2", [faces3, faces4])

    faces = diffCheck.df_joint_detector.JointDetector(i_breps[0]).run()
    # beam_x = DFBeam("BeamX", faces)
    # beam_x = DFBeam.from_brep(i_breps[0])

    beams.append(beam1)
    beams.append(beam2)

    assembly1 = DFAssembly(beams, "Assembly1")




#     # for brep in i_breps:
#     #     beam = DFBeam.from_brep(brep)
#     #     beams.append(beam)

#     # # assembly
#     # assembly1 = DFAssembly(beams, i_assembly_name)

#     # # dump the xml
#     # xml: str = assembly1.to_xml()
#     # if i_dump:
#     #     assembly1.dump_xml(xml, i_export_dir)
#     # o_xml = xml

#     # # show the joint/side faces
#     # o_joints = [jf.to_brep() for jf in assembly1.all_joint_faces]
#     # o_sides = [sf.to_brep() for sf in assembly1.all_side_faces]
# ---------- end py3 ----------
scsy_cpy_2 = ScriptSyncCpython(btn=button_2, i_export_dir=path_2, i_breps=brep_2, i_assembly_name=panel_3, i_dump=dump_2)  # -> stdout, o_xml, o_joints, o_sides; inputs btn: Boolean, i_breps: list of Brep, i_dump: Boolean; disabled
#   port btn: Connect a button to open a file dialog to select a cpython file to run.
#   port stdout: The redirected standard output of the component scriptsync.
# ---------- scsy_cpy_2: Python ----------
#! python3
# r: numpy

from ghpythonlib.componentbase import executingcomponent as component

import System
import System.Drawing
import System.Windows.Forms
import Rhino
import Grasshopper
import Grasshopper as gh
from Grasshopper.Kernel import GH_RuntimeMessageLevel as RML
import sys
import os
import time

import contextlib
import io

import abc
import socket
import threading
import queue
import json

import importlib
import sys


class GHThread(threading.Thread, metaclass=abc.ABCMeta):
    """
        A base class for Grasshopper threads.
    """
    def __init__(self, name : str):
        super().__init__(name=name, daemon=False)
        self._component_on_canvas = True
        self._component_enabled = True

    @abc.abstractmethod
    def run(self):
        """ Run the thread. """
        pass

    def _check_if_component_on_canvas(self):
        """ Check if the component is on canvas from thread. """
        def __check_if_component_on_canvas():
            if ghenv.Component.OnPingDocument() is None:
                self._component_on_canvas = False
                return False
            else:
                self._component_on_canvas = True
                return True
        action = System.Action(__check_if_component_on_canvas)
        Rhino.RhinoApp.InvokeOnUiThread(action)

    def _check_if_component_enabled(self):
        """ Check if the component is enabled from thread. """
        def __check_if_component_enabled():
            if ghenv.Component.Locked:
                self._component_enabled = False
            else:
                self._component_enabled = True
        action = System.Action(__check_if_component_enabled)
        Rhino.RhinoApp.InvokeOnUiThread(action)

    def expire_component_solution(self):
        """ Fire the recalculation of the component solution from thread. """
        def __expire_component_solution():
            ghenv.Component.Params.Output[0].ClearData()  # clear the output
            ghenv.Component.ExpireSolution(True)  # expire the component
        action = System.Action(__expire_component_solution)
        Rhino.RhinoApp.InvokeOnUiThread(action)

    def clear_component(self):
        """ Clear the component from thread. """
        def __clear_component():
            ghenv.Component.ClearData()
        action = System.Action(__clear_component)
        Rhino.RhinoApp.InvokeOnUiThread(action)

    def add_runtime_warning(self, exception : str):
        """ Add a warning tab to the component from main thread. """
        action = System.Action(
            lambda: ghenv.Component.AddRuntimeMessage(RML.Warning, exception)
        )
        Rhino.RhinoApp.InvokeOnUiThread(action)

    def add_runtime_error(self, exception : str):
        """ Add an error tab to the component from main thread. """
        action = System.Action(
            lambda: ghenv.Component.AddRuntimeMessage(RML.Error, exception)
        )
        Rhino.RhinoApp.InvokeOnUiThread(action)

    def add_runtime_remark(self, exception : str):
        """ Add a blank tab to the component from main thread. """
        action = System.Action(
            lambda: ghenv.Component.AddRuntimeMessage(RML.Remark, exception)
        )
        Rhino.RhinoApp.InvokeOnUiThread(action)

    @property
    def component_enabled(self):
        self._check_if_component_enabled()
        return self._component_enabled

    @property
    def component_on_canvas(self):
        self._check_if_component_on_canvas()
        return self._component_on_canvas

class ClientThread(GHThread):
    """
    A thread to connect to the VSCode server.
    """
    def __init__(self, vscode_server_ip: str, vscode_server_port: int, name: str,
                 queue_msg: queue.Queue = None, lock_queue_msg: threading.Lock = None,
                 event_fire_msg: threading.Event = None):
        super().__init__(name=name)
        self.vscode_server_ip = vscode_server_ip
        self.vscode_server_port = vscode_server_port
        self.is_connected = False
        self.connect_refresh_rate = 1  # seconds
        self.queue_msg = queue_msg
        self.lock_queue_msg = lock_queue_msg
        self.event_fire_msg = event_fire_msg
        self.client_socket = socket.socket(socket.AF_INET, socket.SOCK_STREAM)

    def run(self):
        """ Run the thread. Send the message to the vscode server."""
        while self.component_on_canvas and self.component_enabled:
            try:
                if not self.is_connected:
                    self.connect_to_vscode_server()
                    self.clear_component()
                    self.expire_component_solution()
                    continue

                self.event_fire_msg.wait()
                self.send_message_from_queue()

            except Exception as e:
                self.add_runtime_warning(f"script-sync::Unkown error from run: {str(e)}")
                self.is_connected = False
                self.client_socket = socket.socket(socket.AF_INET, socket.SOCK_STREAM)

        self.client_socket.close()

    def send_message_from_queue(self):
        with self.lock_queue_msg:
            if self.queue_msg and not self.queue_msg.empty():
                msg = self.queue_msg.get()
                self.queue_msg.task_done()
                self.event_fire_msg.set()
                self.event_fire_msg.clear()
                self.client_socket.send(msg)

    def connect_to_vscode_server(self):
        """ Connect to the VSCode server. """
        while self.component_on_canvas and not self.is_connected:
            try:
                self.client_socket.send(b"")
                self.is_connected = True
            except socket.error:
                try:
                    self.client_socket.connect((self.vscode_server_ip, self.vscode_server_port))
                    self.is_connected = True
                except (ConnectionRefusedError, ConnectionResetError, socket.error) as e:
                    self.handle_connection_error(e)
            finally:
                time.sleep(self.connect_refresh_rate)

    def handle_connection_error(self, e):
        error_messages = {
            ConnectionRefusedError: "script-sync::Connection refused by the vscode",
            ConnectionResetError: "script-sync::Connection was forcibly closed by the vscode",
            socket.error: f"script-sync::Error connecting to the vscode: {str(e)}"
        }
        self.add_runtime_warning(error_messages[type(e)])
        self.is_connected = False if type(e) != socket.error or e.winerror != 10056 else True


class FileChangedThread(GHThread):
    """
        A thread to check if the file has changed on disk.
    """
    def __init__(self,
                path : str,
                name : str
                ):
        super().__init__(name=name)
        self.path = path
        self.refresh_rate = 1000  # milliseconds
        self._on_file_changed = threading.Event()

    def run(self):
        """
            Check if the file has changed on disk.
        """
        last_modified = os.path.getmtime(self.path)
        while self.component_on_canvas and not self._on_file_changed.is_set():
            System.Threading.Thread.Sleep(self.refresh_rate)
            last_modified = self.is_file_modified(last_modified)
        self._on_file_changed.clear()
        return

    def stop(self):
        """ Stop the thread. """
        self._on_file_changed.set()

    def is_file_modified(self, last_modified):
        current_modified = os.path.getmtime(self.path)
        if current_modified != last_modified:
            self.expire_component_solution()
            return current_modified
        return last_modified


class ScriptSyncCPy(component):
    def __init__(self):
        super(ScriptSyncCPy, self).__init__()
        self._var_output = []

        self.is_success = False

        self.client_thread_name : str = f"script-sync-client-thread::{ghenv.Component.InstanceGuid}"
        self.vscode_server_ip = "127.0.0.1"
        self.vscode_server_port = 58260
        self.stdout = None
        self.queue_msg = queue.Queue()
        self.queue_msg_lock = threading.Lock()
        self.event_fire_msg = threading.Event()

        self.filechanged_thread_name : str = f"script-sync-fileChanged-thread::{ghenv.Component.InstanceGuid}"
        self.__path_name_table_value = "script-sync::" + "path::" + str(ghenv.Component.InstanceGuid)
        if self.path is None:
            ghenv.Component.Message = "select-script"

    def RemovedFromDocument(self, doc):
        """ Remove the component from the document. """
        if self.client_thread_name in [t.name for t in threading.enumerate()]:
            client_thread = [t for t in threading.enumerate() if t.name == self.client_thread_name][0]
            client_thread.join()
        if self.filechanged_thread_name in [t.name for t in threading.enumerate()]:
            filechanged_thread = [t for t in threading.enumerate() if t.name == self.filechanged_thread_name][0]
            filechanged_thread.join()
        if self.queue_msg is not None:
            self.queue_msg.join()
        if self.queue_msg_lock is not None:
            self.queue_msg_lock.release()
        if self.event_fire_msg is not None:
            self.event_fire_msg.clear()

        # clear the path from the table view
        del self.path

    def init_script_path(self, btn : bool = False):
        """
            Check if the button is pressed and load/change path script.
            
            :param btn: A boolean of the button
        """
        # check if button is pressed
        if btn is True:
            dialog = System.Windows.Forms.OpenFileDialog()
            dialog.Filter = "Python files (*.py)|*.py"
            dialog.Title = "Select a Python file"
            dialog.InitialDirectory = os.path.dirname("")
            dialog.FileName = ""
            dialog.Multiselect = False
            dialog.CheckFileExists = True
            dialog.CheckPathExists = True
            dialog.RestoreDirectory = True
            if dialog.ShowDialog() == System.Windows.Forms.DialogResult.OK:
                self.path = dialog.FileName

        # default init stauts
        if self.path is None:
            raise Exception("script-sync::File not selected")

        # fi file is in table view before
        if not os.path.exists(self.path):
            raise Exception("script-sync::File does not exist")
    
    def reload_all_modules(self, directory):
        for filename in os.listdir(directory):
            if filename.endswith('.py') and filename != '__init__.py':
                module_name = filename[:-3]  # remove '.py' from filename
                if module_name in sys.modules:
                    importlib.reload(sys.modules[module_name])

    def safe_exec(self, path, globals, locals):
        """
            Execute Python3 code safely. It redirects the output of the code
            to a string buffer 'stdout' to output to the GH component param.
            It is send to the vscode server.
            
            :param path: The path of the file to execute.
            :param globals: The globals dictionary.
            :param locals: The locals dictionary.
        """
        try:
            with open(path, 'r') as f:
                # add the path and sub directories to the sys path
                path_dir = os.path.dirname(path)
                sub_dirs = [d for d in os.listdir(path_dir) if os.path.isdir(os.path.join(path_dir, d))]
                for sub_dir in sub_dirs:
                    print(sub_dir)
                    sys.path.append(os.path.join(path_dir, sub_dir))
                sys.path.append(path_dir)

                # reload all the modules also of the sub directories
                for root, dirs, files in os.walk(path_dir):
                    for d in dirs:
                        self.reload_all_modules(os.path.join(root, d))
                self.reload_all_modules(path_dir)

                # parse the code
                code = compile(f.read(), path, 'exec')
                output = io.StringIO()

                # empty the queue and event
                with self.queue_msg_lock:
                    while not self.queue_msg.empty():
                        self.queue_msg.get()
                        self.queue_msg.task_done()
                self.event_fire_msg.clear()

                # execute the code
                with contextlib.redirect_stdout(output):
                    exec(code, globals, locals)
                locals["stdout"] = output.getvalue()

                # send the msg to the vscode server
                msg_json = json.dumps({"script_path": path,
                                       "guid": str(ghenv.Component.InstanceGuid),
                                       "msg": output.getvalue()})
                msg_json = msg_json.encode('utf-8')
                self.queue_msg.put(msg_json)
                self.event_fire_msg.set()

                # pass the script variables to the GH component outputs
                outparam = ghenv.Component.Params.Output
                outparam_names = [p.NickName for p in outparam]
                for outp in outparam_names:
                    if outp in locals.keys():
                        self._var_output.append(locals[outp])
                    else:
                        self._var_output.append(None)

                sys.stdout = sys.__stdout__
            return locals

        except Exception as e:

            # send the error message to the vscode server
            err_json = json.dumps({"script_path": path,
                                    "guid": str(ghenv.Component.InstanceGuid),
                                    "msg": "err:" + str(e)})
            err_json = err_json.encode('utf-8')
            self.queue_msg.put(err_json)
            self.event_fire_msg.set()
            
            sys.stdout = sys.__stdout__

            err_msg = f"script-sync::Error in the code: {str(e)}"
            raise Exception(err_msg)

    def RunScript(self,
            btn: bool,
            i_export_dir,
            i_breps: System.Collections.Generic.IList[Rhino.Geometry.Brep],
            i_assembly_name,
            i_dump: bool):
        """ This method is called whenever the component has to be recalculated it's the solve main instance. """

        self.is_success = False

        # set the path if button is pressed
        self.init_script_path(btn)

        # file change listener thread
        if self.filechanged_thread_name not in [t.name for t in threading.enumerate()]:
            FileChangedThread(self.path,
                              self.filechanged_thread_name
                              ).start()

        # set up the tcp client to connect to the vscode server
        _ = [print(t.name) for t in threading.enumerate()]
        if self.client_thread_name not in [t.name for t in threading.enumerate()]:
            ClientThread(self.vscode_server_ip,
                        self.vscode_server_port,
                        self.client_thread_name,
                        self.queue_msg,
                        self.queue_msg_lock,
                        self.event_fire_msg
                        ).start()

        # add to the globals all the input parameters of the component (the locals)
        globals().update(locals())

        path_dir = os.path.dirname(self.path)
        sub_dirs = []
        for root, dirs, files in os.walk(path_dir):
            for d in dirs:
                sub_dirs.append(os.path.join(root, d))
                print(d)
        sys.path.extend([path_dir] + sub_dirs)

        # reload all the modules also of the sub directories
        for root, dirs, files in os.walk(path_dir):
            for d in dirs:
                self.reload_all_modules(os.path.join(root, d))
        self.reload_all_modules(path_dir)

        res = self.safe_exec(self.path, None, globals())
        self.is_success = True
        return

    def AfterRunScript(self):
        """
            This method is called as soon as the component has finished
            its calculation. It is used to load the GHComponent outputs
            with the values created in the script.
        """
        if not self.is_success:
            return
        outparam = [p for p in ghenv.Component.Params.Output]
        outparam_names = [p.NickName for p in outparam]
        
        # TODO: add the conversion to datatree for nested lists and tuples
        for idx, outp in enumerate(outparam):
            # detect if the output is a list
            if type(self._var_output[idx]) == list or type(self._var_output[idx]) == tuple:
                ghenv.Component.Params.Output[idx].VolatileData.Clear()
                ghenv.Component.Params.Output[idx].AddVolatileDataList(gh.Kernel.Data.GH_Path(0), self._var_output[idx])
            else:
                ghenv.Component.Params.Output[idx].VolatileData.Clear()
                ghenv.Component.Params.Output[idx].AddVolatileData(gh.Kernel.Data.GH_Path(0), 0, self._var_output[idx])
        self._var_output.clear()

    @property
    def path(self):
        """ Get the path of the file from the table view to be sticking between the sessions. """
        table_value = ghenv.Component.OnPingDocument().ValueTable.GetValue(
            self.__path_name_table_value, "not_found"
        )
        if table_value != "not_found":
            return table_value
        else:
            return None

    @path.setter
    def path(self, path : str):
        """ Set the path of the file to the table view to be sticking between the sessions. """
        ghenv.Component.OnPingDocument().ValueTable.SetValue(self.__path_name_table_value, path)

        script_name = os.path.basename(path)
        ghenv.Component.Message = f"{script_name}"

        if self.filechanged_thread_name in [t.name for t in threading.enumerate()]:
            _ = [t for t in threading.enumerate() if t.name == self.filechanged_thread_name][0].stop()

    @path.deleter
    def path(self):
        """ Delete the path of the file from the table view if the object is erased. """
        ghenv.Component.OnPingDocument().ValueTable.DeleteValue(self.__path_name_table_value)
# ---------- end scsy_cpy_2 ----------
path_4 = FilePath("F:\diffCheck\temp\")  # disabled
brep_4 = Brep([<brep referenced from the Rhino model> x6])  # disabled
xmlout = DFXMLExporter(i_dump=dump_3, i_assembly_name=panel_4, i_export_dir=path_3, i_breps=brep_3)  # -> out, o_xml, o_joints, o_sides; inputs i_dump: Boolean, i_breps: list of Brep; disabled
#   port i_dump: Press button to export xml
#   port i_assembly_name: The name of the assembly to export.
#   port i_export_dir: The directors where to export the xml file.
#   port i_breps: The breps of the structure.
#   port o_xml: The string of xml to be exported.
#   port o_joints: The breps of the faces belonging to joints.
#   port o_sides: The breps of the faces belonging to sides.
# ---------- xmlout: Python ----------
#! python3
# r: diffCheck==0.0.8


import System
import typing

import Rhino
import Rhino.Geometry as rg

from ghpythonlib.componentbase import executingcomponent as component

import diffCheck
from diffCheck.df_geometries import DFBeam, DFAssembly


class DFXMLExporter(component):
    def RunScript(self,
            i_dump: bool,
            i_assembly_name,
            i_export_dir,
            i_breps: System.Collections.Generic.IList[Rhino.Geometry.Brep]):
        """
            This read breps from Rhino, converts them to DFBeams and DFAssemblies, and exports them to XML.
            
            :param i_dump: whether to dump the xml
            :param i_export_dir: directory to export the xml
            :param i_breps: list of breps
        """
        # beams
        beams: typing.List[DFBeam] = []
        for brep in i_breps:
            beam = DFBeam.from_brep(brep)
            beams.append(beam)

        # assembly
        assembly1 = DFAssembly(beams, i_assembly_name)

        # dump the xml
        xml: str = assembly1.to_xml()
        if i_dump:
            assembly1.dump_xml(xml, i_export_dir)
        o_xml = xml

        # show the joint/side faces
        o_joints = [jf.to_brep() for jf in assembly1.all_joint_faces]
        o_sides = [sf.to_brep() for sf in assembly1.all_side_faces]

        return o_xml, o_joints, o_sides
# ---------- end xmlout ----------
xmlout_2 = DFXMLExporter()  # -> o_xml, o_joints, o_sides; inputs i_dump: Boolean, i_breps: list of Brep; disabled
#   port i_dump: Press button to export xml
#   port i_assembly_name: The name of the assembly to export.
#   port i_export_dir: The directors where to export the xml file.
#   port i_breps: The breps of the structure.
#   port o_xml: The string of xml to be exported.
#   port o_joints: The breps of the faces belonging to joints.
#   port o_sides: The breps of the faces belonging to sides.
# ---------- xmlout_2: Python ----------
#! python3

import Rhino
import Rhino.Geometry as rg

import os
import typing

import diffCheck

import diffCheck.newmodule
diffCheck.newmodule.test_new_mdoule()

if __name__ == "__main__":
    """
        Main function to test the package
        :param i_breps: list of breps
        :param i_export_dir: directory to export the xml
        :param i_dump: whether to dump the xml
    """
    # beams
    beams = []
    for brep in i_breps:
        beam = diffCheck.df_geometries.DFBeam.from_brep(brep)
        beams.append(beam)

    # assembly
    assembly1 = diffCheck.df_geometries.DFAssembly(beams, i_assembly_name)

    # dump the xml
    xml: str = assembly1.to_xml()
    if i_dump:
        assembly1.dump_xml(xml, i_export_dir)
    o_xml = xml

    # show the joint/side faces
    o_joints = [jf.to_brep() for jf in assembly1.all_joint_faces]
    o_sides = [sf.to_brep() for sf in assembly1.all_side_faces]
# ---------- end xmlout_2 ----------
xmlout_3 = DFXMLExporter(i_dump=dump_4, i_assembly_name=panel_5, i_export_dir=path_4, i_breps=brep_4)  # -> o_xml, o_joints, o_sides; inputs i_dump: Boolean, i_breps: list of Brep; disabled; same code as xmlout_2
swatch = ColourSwatch(SwatchColor=RGB(128, 0, 255))  # disabled
swatch_2 = ColourSwatch(SwatchColor=RGB(102, 255, 0))  # disabled
swatch_3 = ColourSwatch(SwatchColor=RGB(255, 0, 0))  # disabled
preview = CustomPreview(Geometry=scsy_cpy.o_joints, Material=swatch)  # disabled
preview_2 = CustomPreview(Geometry=scsy_cpy.o_sides, Material=swatch_2)  # disabled
swatch_4 = ColourSwatch(SwatchColor=RGB(128, 0, 255))  # disabled
swatch_5 = ColourSwatch(SwatchColor=RGB(102, 255, 0))  # disabled
swatch_6 = ColourSwatch(SwatchColor=RGB(128, 0, 255))  # disabled
swatch_7 = ColourSwatch(SwatchColor=RGB(102, 255, 0))  # disabled
preview_3 = CustomPreview(Geometry=xmlout_3.o_joints, Material=swatch_6)  # disabled
preview_4 = CustomPreview(Geometry=xmlout_3.o_sides, Material=swatch_7)  # disabled
preview_5 = CustomPreview(Material=swatch_3)
preview_6 = CustomPreview(Geometry=xmlout.o_joints, Material=swatch_4)  # disabled
preview_7 = CustomPreview(Geometry=xmlout.o_sides, Material=swatch_5)  # disabled
panel_6 = Panel(xmlout.out)  # disabled
panel_7 = Panel(scsy_cpy.stdout)
py3_2 = Python3Script()  # -> out, a; disabled
# ---------- py3_2: Python ----------
import sys

print(sys.executable)
# ---------- end py3_2 ----------
panel_8 = Panel(py3_2.out)  # disabled
dump_5 = Button()
path_5 = FilePath("F:\diffCheck\temp\")
brep_5 = Brep(<brep referenced from the Rhino model>)
scsy_cpy_3 = ScriptSyncCpython(
    btn=Button(),
    packages_2_reload="diffCheck",
    i_export_dir=path_5,
    i_breps=brep_5,
    i_assembly_name="AssemblyTest",
    i_dump=dump_5)  # -> stdout, a; inputs btn: Boolean, packages_2_reload: list, i_breps: list of Brep, i_dump: Boolean
#   port btn: Connect a button to open a file dialog to select a cpython file to run.
#   port packages_2_reload: Pass a list with the name of the custom packages you want to reload. This function is useful if you are developing a i.e. PyPI package and you want to reload the submodules after you modified something. The function will reload the package and all its submodules. If you want to reload the package and all its submodules, just pass the package name. If you want to reload only a submodule, pass the package name and the submodule name separated by a dot. If you want to reload multiple submodules, pass the package
#   port i_breps: A generic x input.
#   port stdout: The redirected standard output of the component scriptsync.
#   port a: Generic example output of the component
# ---------- scsy_cpy_3: Python ----------
from ghpythonlib.componentbase import executingcomponent as component

import System
import System.Drawing
import System.Windows.Forms
import Rhino
import Grasshopper
import Grasshopper as gh
from Grasshopper.Kernel import GH_RuntimeMessageLevel as RML
import sys
import os
import time

import contextlib
import io

import abc
import socket
import threading
import queue
import json

import importlib
import inspect
import sys


class GHThread(threading.Thread, metaclass=abc.ABCMeta):
    """
        A base class for Grasshopper threads.
    """
    def __init__(self, name : str):
        super().__init__(name=name, daemon=False)
        self._component_on_canvas = True
        self._component_enabled = True

    @abc.abstractmethod
    def run(self):
        """ Run the thread. """
        pass

    def _check_if_component_on_canvas(self):
        """ Check if the component is on canvas from thread. """
        def __check_if_component_on_canvas():
            if ghenv.Component.OnPingDocument() is None:
                self._component_on_canvas = False
                return False
            else:
                self._component_on_canvas = True
                return True
        action = System.Action(__check_if_component_on_canvas)
        Rhino.RhinoApp.InvokeOnUiThread(action)

    def _check_if_component_enabled(self):
        """ Check if the component is enabled from thread. """
        def __check_if_component_enabled():
            if ghenv.Component.Locked:
                self._component_enabled = False
            else:
                self._component_enabled = True
        action = System.Action(__check_if_component_enabled)
        Rhino.RhinoApp.InvokeOnUiThread(action)

    def expire_component_solution(self):
        """ Fire the recalculation of the component solution from thread. """
        def __expire_component_solution():
            ghenv.Component.Params.Output[0].ClearData()  # clear the output
            ghenv.Component.ExpireSolution(True)  # expire the component
        action = System.Action(__expire_component_solution)
        Rhino.RhinoApp.InvokeOnUiThread(action)

    def clear_component(self):
        """ Clear the component from thread. """
        def __clear_component():
            ghenv.Component.ClearData()
        action = System.Action(__clear_component)
        Rhino.RhinoApp.InvokeOnUiThread(action)

    def add_runtime_warning(self, exception : str):
        """ Add a warning tab to the component from main thread. """
        action = System.Action(
            lambda: ghenv.Component.AddRuntimeMessage(RML.Warning, exception)
        )
        Rhino.RhinoApp.InvokeOnUiThread(action)

    def add_runtime_error(self, exception : str):
        """ Add an error tab to the component from main thread. """
        action = System.Action(
            lambda: ghenv.Component.AddRuntimeMessage(RML.Error, exception)
        )
        Rhino.RhinoApp.InvokeOnUiThread(action)

    def add_runtime_remark(self, exception : str):
        """ Add a blank tab to the component from main thread. """
        action = System.Action(
            lambda: ghenv.Component.AddRuntimeMessage(RML.Remark, exception)
        )
        Rhino.RhinoApp.InvokeOnUiThread(action)

    @property
    def component_enabled(self):
        self._check_if_component_enabled()
        return self._component_enabled

    @property
    def component_on_canvas(self):
        self._check_if_component_on_canvas()
        return self._component_on_canvas

class ClientThread(GHThread):
    """
    A thread to connect to the VSCode server.
    """
    def __init__(self, vscode_server_ip: str, vscode_server_port: int, name: str,
                 queue_msg: queue.Queue = None, lock_queue_msg: threading.Lock = None,
                 event_fire_msg: threading.Event = None):
        super().__init__(name=name)
        self.vscode_server_ip = vscode_server_ip
        self.vscode_server_port = vscode_server_port
        self.is_connected = False
        self.connect_refresh_rate = 1  # seconds
        self.queue_msg = queue_msg
        self.lock_queue_msg = lock_queue_msg
        self.event_fire_msg = event_fire_msg
        self.client_socket = socket.socket(socket.AF_INET, socket.SOCK_STREAM)

    def run(self):
        """ Run the thread. Send the message to the vscode server."""
        while self.component_on_canvas and self.component_enabled:
            try:
                if not self.is_connected:
                    self.connect_to_vscode_server()
                    self.clear_component()
                    self.expire_component_solution()
                    continue

                self.event_fire_msg.wait()
                self.send_message_from_queue()

            except Exception as e:
                self.add_runtime_warning(f"script-sync::Unkown error from run: {str(e)}")
                self.is_connected = False
                self.client_socket = socket.socket(socket.AF_INET, socket.SOCK_STREAM)

        self.client_socket.close()

    def send_message_from_queue(self):
        with self.lock_queue_msg:
            if self.queue_msg and not self.queue_msg.empty():
                msg = self.queue_msg.get()
                self.queue_msg.task_done()
                self.event_fire_msg.set()
                self.event_fire_msg.clear()
                self.client_socket.send(msg)

    def connect_to_vscode_server(self):
        """ Connect to the VSCode server. """
        while self.component_on_canvas and not self.is_connected:
            try:
                self.client_socket.send(b"")
                self.is_connected = True
            except socket.error:
                try:
                    self.client_socket.connect((self.vscode_server_ip, self.vscode_server_port))
                    self.is_connected = True
                except (ConnectionRefusedError, ConnectionResetError, socket.error) as e:
                    self.handle_connection_error(e)
            finally:
                time.sleep(self.connect_refresh_rate)

    def handle_connection_error(self, e):
        error_messages = {
            ConnectionRefusedError: "script-sync::Connection refused by the vscode",
            ConnectionResetError: "script-sync::Connection was forcibly closed by the vscode",
            socket.error: f"script-sync::Error connecting to the vscode: {str(e)}"
        }
        self.add_runtime_warning(error_messages[type(e)])
        self.is_connected = False if type(e) != socket.error or e.winerror != 10056 else True

class FileChangedThread(GHThread):
    """
        A thread to check if the file has changed on disk.
    """
    def __init__(self,
                path : str,
                name : str
                ):
        super().__init__(name=name)
        self.path = path
        self.refresh_rate = 1000  # milliseconds
        self._on_file_changed = threading.Event()

    def run(self):
        """
            Check if the file has changed on disk.
        """
        last_modified = os.path.getmtime(self.path)
        while self.component_on_canvas and not self._on_file_changed.is_set():
            System.Threading.Thread.Sleep(self.refresh_rate)
            last_modified = self.is_file_modified(last_modified)
        self._on_file_changed.clear()
        return

    def stop(self):
        """ Stop the thread. """
        self._on_file_changed.set()

    def is_file_modified(self, last_modified):
        current_modified = os.path.getmtime(self.path)
        if current_modified != last_modified:
            self.expire_component_solution()
            return current_modified
        return last_modified


class ScriptSyncCPy(component):
    def __init__(self):
        super(ScriptSyncCPy, self).__init__()
        self._var_output = []

        self.is_success = False

        self.client_thread_name : str = f"script-sync-client-thread::{ghenv.Component.InstanceGuid}"
        self.vscode_server_ip = "127.0.0.1"
        self.vscode_server_port = 58260
        self.stdout = None
        self.queue_msg = queue.Queue()
        self.queue_msg_lock = threading.Lock()
        self.event_fire_msg = threading.Event()

        self.filechanged_thread_name : str = f"script-sync-fileChanged-thread::{ghenv.Component.InstanceGuid}"
        self.__path_name_table_value = "script-sync::" + "path::" + str(ghenv.Component.InstanceGuid)
        if self.path is None:
            ghenv.Component.Message = "select-script"

    def RemovedFromDocument(self, doc):
        """ Remove the component from the document. """
        if self.client_thread_name in [t.name for t in threading.enumerate()]:
            client_thread = [t for t in threading.enumerate() if t.name == self.client_thread_name][0]
            client_thread.join()
        if self.filechanged_thread_name in [t.name for t in threading.enumerate()]:
            filechanged_thread = [t for t in threading.enumerate() if t.name == self.filechanged_thread_name][0]
            filechanged_thread.join()
        if self.queue_msg is not None:
            self.queue_msg.join()
        if self.queue_msg_lock is not None:
            self.queue_msg_lock.release()
        if self.event_fire_msg is not None:
            self.event_fire_msg.clear()

        # clear the path from the table view
        del self.path

    def init_script_path(self, btn : bool = False):
        """
            Check if the button is pressed and load/change path script.
            
            :param btn: A boolean of the button
        """
        # check if button is pressed
        if btn is True:
            dialog = System.Windows.Forms.OpenFileDialog()
            dialog.Filter = "Python files (*.py)|*.py"
            dialog.Title = "Select a Python file"
            dialog.InitialDirectory = os.path.dirname("")
            dialog.FileName = ""
            dialog.Multiselect = False
            dialog.CheckFileExists = True
            dialog.CheckPathExists = True
            dialog.RestoreDirectory = True
            if dialog.ShowDialog() == System.Windows.Forms.DialogResult.OK:
                self.path = dialog.FileName

        # default init stauts
        if self.path is None:
            raise Exception("script-sync::File not selected")

        # fi file is in table view before
        if not os.path.exists(self.path):
            raise Exception("script-sync::File does not exist")
    
    def reload_all_modules(self, directory):
        """
            Reload all the modules (local files) in the directory of the script.

            :param directory: The directory of the script.
        """
        for filename in os.listdir(directory):
            if filename.endswith('.py') and filename != '__init__.py':
                module_name = filename[:-3]  # remove '.py' from filename
                if module_name in sys.modules:
                    importlib.reload(sys.modules[module_name])

    def get_reloadable_packages(self):
        """
            Get all the reloadable modules from the sys.modules. It
            make sure to check the module spec and loader to only reload modules 
            that are actually loaded from a file or directory

            :return: The list of reloadable modules.
        """
        BUILTIN_ORIGINS = ['built-in', 'frozen']
        reloadables = []
        for m in sys.modules.values():
            if inspect.ismodule(m):
                spec = getattr(m, "__spec__", None)
                if spec:
                    if spec.origin in BUILTIN_ORIGINS \
                            or isinstance(spec.loader, importlib.machinery.SourcelessFileLoader):
                        continue
                reloadables.append(m)

        return reloadables

    def safe_exec(self, path, globals, locals, packages_2_reload):
        """
            Execute Python3 code safely. It redirects the output of the code
            to a string buffer 'stdout' to output to the GH component param.
            It is send to the vscode server.
            
            :param path: The path of the file to execute.
            :param globals: The globals dictionary.
            :param locals: The locals dictionary.
            :param packages_2_reload: The list of packages to reload, this is used for custom packages developement.
            installed on the system via an editable pip installation for example.
        """
        try:
            with open(path, 'r') as f:
                # reload the specifyed packages
                # reloadables = self.get_reloadable_packages()
                # # if packages_2_reload is not None:
                # #     if packages_2_reload.__len__() != 0:
                # #         for package in packages_2_reload:
                # #             if package in reloadables:
                # #                 importlib.reload(package)
                # for package in packages_2_reload:
                #     if package in reloadables:
                #         importlib.reload(package)

                # add the path and sub directories to  the sys path
                path_dir = os.path.dirname(path)
                sub_dirs = []
                for root, dirs, files in os.walk(path_dir):
                    for d in dirs:
                        sub_dirs.append(os.path.join(root, d))
                sys.path.extend([path_dir] + sub_dirs)

                # reload all the modules also of the sub directories
                for root, dirs, files in os.walk(path_dir):
                    for d in dirs:
                        self.reload_all_modules(os.path.join(root, d))
                self.reload_all_modules(path_dir)

                # refresh the python interpreter
                importlib.invalidate_caches()

                # parse the code
                code = compile(f.read(), path, 'exec')
                output = io.StringIO()

                # empty the queue and event
                with self.queue_msg_lock:
                    while not self.queue_msg.empty():
                        self.queue_msg.get()
                        self.queue_msg.task_done()
                self.event_fire_msg.clear()

                # execute the code
                with contextlib.redirect_stdout(output):
                    exec(code, globals, locals)
                locals["stdout"] = output.getvalue()

                # send the msg to the vscode server
                msg_json = json.dumps({"script_path": path,
                                       "guid": str(ghenv.Component.InstanceGuid),
                                       "msg": output.getvalue()})
                msg_json = msg_json.encode('utf-8')
                self.queue_msg.put(msg_json)
                self.event_fire_msg.set()

                # pass the script variables to the GH component outputs
                outparam = ghenv.Component.Params.Output
                outparam_names = [p.NickName for p in outparam]
                for outp in outparam_names:
                    if outp in locals.keys():
                        self._var_output.append(locals[outp])
                    else:
                        self._var_output.append(None)

                sys.stdout = sys.__stdout__
            return locals

        except Exception as e:

            # send the error message to the vscode server
            err_json = json.dumps({"script_path": path,
                                    "guid": str(ghenv.Component.InstanceGuid),
                                    "msg": "err:" + str(e)})
            err_json = err_json.encode('utf-8')
            self.queue_msg.put(err_json)
            self.event_fire_msg.set()
            
            sys.stdout = sys.__stdout__

            err_msg = f"script-sync::Error in the code: {str(e)}"
            raise Exception(err_msg)

    def RunScript(self,
            btn: bool,
            packages_2_reload: System.Collections.Generic.IList[object],
            i_export_dir,
            i_breps: System.Collections.Generic.IList[Rhino.Geometry.Brep],
            i_assembly_name,
            i_dump: bool):
        """ This method is called whenever the component has to be recalculated it's the solve main instance. """
        self.is_success = False

        # set the path if button is pressed
        self.init_script_path(btn)

        # file change listener thread
        if self.filechanged_thread_name not in [t.name for t in threading.enumerate()]:
            FileChangedThread(self.path,
                              self.filechanged_thread_name
                              ).start()

        # set up the tcp client to connect to the vscode server
        _ = [print(t.name) for t in threading.enumerate()]
        if self.client_thread_name not in [t.name for t in threading.enumerate()]:
            ClientThread(self.vscode_server_ip,
                        self.vscode_server_port,
                        self.client_thread_name,
                        self.queue_msg,
                        self.queue_msg_lock,
                        self.event_fire_msg
                        ).start()

        # add to the globals all the input parameters of the component (the locals)
        globals().update(locals())

        res = self.safe_exec(self.path, None, globals(), packages_2_reload)
        self.is_success = True
        return

    def AfterRunScript(self):
        """
            This method is called as soon as the component has finished
            its calculation. It is used to load the GHComponent outputs
            with the values created in the script.
        """
        if not self.is_success:
            return
        outparam = [p for p in ghenv.Component.Params.Output]
        outparam_names = [p.NickName for p in outparam]
        
        # TODO: add the conversion to datatree for nested lists and tuples
        for idx, outp in enumerate(outparam):
            # detect if the output is a list
            if type(self._var_output[idx]) == list or type(self._var_output[idx]) == tuple:
                ghenv.Component.Params.Output[idx].VolatileData.Clear()
                ghenv.Component.Params.Output[idx].AddVolatileDataList(gh.Kernel.Data.GH_Path(0), self._var_output[idx])
            else:
                ghenv.Component.Params.Output[idx].VolatileData.Clear()
                ghenv.Component.Params.Output[idx].AddVolatileData(gh.Kernel.Data.GH_Path(0), 0, self._var_output[idx])
        self._var_output.clear()

    @property
    def path(self):
        """ Get the path of the file from the table view to be sticking between the sessions. """
        table_value = ghenv.Component.OnPingDocument().ValueTable.GetValue(
            self.__path_name_table_value, "not_found"
        )
        if table_value != "not_found":
            return table_value
        else:
            return None

    @path.setter
    def path(self, path : str):
        """ Set the path of the file to the table view to be sticking between the sessions. """
        ghenv.Component.OnPingDocument().ValueTable.SetValue(self.__path_name_table_value, path)

        script_name = os.path.basename(path)
        ghenv.Component.Message = f"{script_name}"

        if self.filechanged_thread_name in [t.name for t in threading.enumerate()]:
            _ = [t for t in threading.enumerate() if t.name == self.filechanged_thread_name][0].stop()

    @path.deleter
    def path(self):
        """ Delete the path of the file from the table view if the object is erased. """
        ghenv.Component.OnPingDocument().ValueTable.DeleteValue(self.__path_name_table_value)
# ---------- end scsy_cpy_3 ----------
py3_3 = Python3Script()  # -> out, a
# ---------- py3_3: Python ----------
#! python 3



from diffCheck import diffCheckBindings

print(f"is pyd working: {diffCheckBindings.test()}")
# ---------- end py3_3 ----------
panel_9 = Panel(py3_3.out)
panel_10 = Panel(scsy_cpy_3.stdout)
