# Grasshopper definition unnamed.gh (Grasshopper 1.0.8)
# plug-ins: RhinoCodePluginGH

df_histogram_scale_factor = Slider(0.01, range=0..0.1)
df_value_t = ValueList({"Dist", "RMSE", "MAX", "MIN", "STD"}, selected="Dist")
df_palette = ValueList({"Jet", "Rainbow", "RdPu", "Viridis"}, selected="Jet")
df_upper_threshold = Slider(5, range=0..5)
df_lower_threshold = Slider(0, range=0..5)
df_legend_height = Slider(10, range=0..20)
df_legend_width = Slider(0.5, range=0..2)
df_legend_plane = Plane()
py3 = Python3Script(
    i_value_type=df_value_t,
    i_palette=df_palette,
    i_upper_threshold=df_upper_threshold,
    i_lower_threshold=df_lower_threshold,
    i_legend_height=df_legend_height,
    i_legend_width=df_legend_width,
    i_legend_plane=df_legend_plane,
    i_histogram_scale_factor=df_histogram_scale_factor)  # -> out, a; inputs i_value_type: String, i_palette: String, i_upper_threshold: Double, i_lower_threshold: Double, i_legend_height: Double, i_legend_width: Double, i_histogram_scale_factor: Double
# ---------- py3: Python ----------
#! python3

from ghpythonlib.componentbase import executingcomponent as component
import Grasshopper, GhPython

import System
import typing

import Rhino
import Rhino.Geometry as rg

from ghpythonlib.componentbase import executingcomponent as component
import Grasshopper as gh
from Grasshopper.Kernel import GH_RuntimeMessageLevel as RML

from diffCheck import df_visualization


def add_str_valuelist(self,
    values_list: typing.List[str],
    nickname: str,
    indx: int,
    X_param_coord: float,
    Y_param_coord: float,
    X_offset: int=87
    ) -> None:
    """
        Adds a value list of string values to the component input

        :param values_list: a list of string values to add to the value list
        :param nickname: the nickname of the value list
        :param indx: the index of the input parameter
        :param X_param_coord: the x coordinate of the input parameter
        :param Y_param_coord: the y coordinate of the input parameter
        :param X_offset: the offset of the value list from the input parameter
    """
    param = ghenv.Component.Params.Input[indx]
    if param.SourceCount == 0:
        valuelist = Grasshopper.Kernel.Special.GH_ValueList()
        valuelist.NickName = nickname
        valuelist.Description = "Select the value to use with DFVizSettings"
        selected = valuelist.FirstSelectedItem
        valuelist.ListItems.Clear()
        for v in values_list:
            vli = gh.Kernel.Special.GH_ValueListItem(str(v),str('"' + v + '"'))
            valuelist.ListItems.Add(vli)
        if selected in values_list:
            valuelist.SelectItem(values_list.index(selected))
        valuelist.CreateAttributes()
        valuelist.Attributes.Pivot = System.Drawing.PointF(
            X_param_coord - (valuelist.Attributes.Bounds.Width) - X_offset,
            Y_param_coord - (valuelist.Attributes.Bounds.Height / 2 + 0.1)
            )
        valuelist.Attributes.ExpireLayout()
        Grasshopper.Instances.ActiveCanvas.Document.AddObject(valuelist, False)
        ghenv.Component.Params.Input[indx].AddSource(valuelist)

def add_slider(self,
    nickname: str,
    indx: int,
    lower_bound: float,
    upper_bound: float,
    default_value: float,
    X_param_coord: float,
    Y_param_coord: float,
    X_offset: int=100
    ) -> None:
    """
        Adds a slider to the component input

        :param nickname: the nickname of the slider
        :param indx: the index of the input parameter
        :param X_param_coord: the x coordinate of the input parameter
        :param Y_param_coord: the y coordinate of the input parameter
        :param X_offset: the offset of the slider from the input parameter
    """
    param = ghenv.Component.Params.Input[indx]
    if param.SourceCount == 0:
        slider = Grasshopper.Kernel.Special.GH_NumberSlider()
        slider.NickName = nickname
        slider.Description = "Set the value for the threshold"
        slider.Slider.Minimum = System.Decimal(lower_bound)
        slider.Slider.Maximum = System.Decimal(upper_bound)
        slider.Slider.DecimalPlaces = 3
        slider.Slider.SmallChange = System.Decimal(0.001)
        slider.Slider.LargeChange = System.Decimal(0.01)
        slider.Slider.Value = System.Decimal(default_value)
        slider.CreateAttributes()
        slider.Attributes.Pivot = System.Drawing.PointF(
            X_param_coord - (slider.Attributes.Bounds.Width) - X_offset,
            Y_param_coord - (slider.Attributes.Bounds.Height / 2 - 0.1)
            )
        slider.Attributes.ExpireLayout()
        Grasshopper.Instances.ActiveCanvas.Document.AddObject(slider, False)
        ghenv.Component.Params.Input[indx].AddSource(slider)

def add_plane_object(self,
    nickname: str,
    indx: int,
    X_param_coord: float,
    Y_param_coord: float,
    X_offset: int=75
    ) -> None:
    """
        Adds a plane object to the component input

        :param nickname: the nickname of the plane object
        :param indx: the index of the input parameter
        :param X_param_coord: the x coordinate of the input parameter
        :param Y_param_coord: the y coordinate of the input parameter
        :param X_offset: the offset of the plane object from the input parameter
    """
    param = ghenv.Component.Params.Input[indx]
    if param.SourceCount == 0:
        from Grasshopper import Instances
        doc = Instances.ActiveCanvas.Document
        if doc:
            plane = Grasshopper.Kernel.Parameters.Param_Plane()
            plane.NickName = nickname
            # set the value of the plane to WorldXY
            # plane.PersistentData.ClearData()
            # plane.PersistentData.Append(rg.Plane.WorldXY)
            plane.CreateAttributes()
            plane.Attributes.Pivot = System.Drawing.PointF(
                X_param_coord - (plane.Attributes.Bounds.Width) - X_offset,
                Y_param_coord
                )
            plane.Attributes.ExpireLayout()
            doc.AddObject(plane, False)
            ghenv.Component.Params.Input[indx].AddSource(plane)
        # Grasshopper.Instances.ActiveCanvas.Document.AddObject(plane, False)


class DFVisualizationSettings(component):
    def __init__(self):
        self.poss_value_types = ["Dist", "RMSE", "MAX", "MIN", "STD"]
        self.poss_palettes = ["Jet", "Rainbow", "RdPu", "Viridis"]
        
        ghenv.Component.ExpireSolution(True)
        ghenv.Component.Attributes.PerformLayout()
        params = getattr(ghenv.Component.Params, "Input")
        for j in range(len(params)):
            Y_cord = params[j].Attributes.InputGrip.Y
            X_cord = params[j].Attributes.Pivot.X
            input_indx = j
            if "i_value_type" == params[j].NickName:
                add_str_valuelist(
                    ghenv.Component,
                    self.poss_value_types,
                    "DF_value_t",
                    input_indx, X_cord, Y_cord)
            if "i_palette" == params[j].NickName:
                add_str_valuelist(
                    ghenv.Component,
                    self.poss_palettes,
                    "DF_palette",
                    input_indx, X_cord, Y_cord)
            if "i_upper_threshold" == params[j].NickName:
                add_slider(
                    ghenv.Component,
                    "DF_upper_threshold",
                    input_indx,
                    0.000, 5.000, 5.000,
                    X_cord, Y_cord)
            if "i_lower_threshold" == params[j].NickName:
                add_slider(
                    ghenv.Component,
                    "DF_lower_threshold",
                    input_indx,
                    0.000, 5.000, 0.000,
                    X_cord, Y_cord)
            if "i_legend_height" == params[j].NickName:
                add_slider(
                    ghenv.Component,
                    "DF_legend_height",
                    input_indx,
                    0.000, 20.000, 10.000,
                    X_cord, Y_cord)
            if "i_legend_width" == params[j].NickName:
                add_slider(
                    ghenv.Component,
                    "DF_legend_width",
                    input_indx,
                    0.000, 2.000, 0.500,
                    X_cord, Y_cord)
            if "i_legend_plane" == params[j].NickName:
                add_plane_object(
                    ghenv.Component,
                    "DF_legend_plane",
                    input_indx, X_cord, Y_cord)
            if "i_histogram_scale_factor" == params[j].NickName:
                add_slider(
                    ghenv.Component,
                    "DF_histogram_scale_factor",
                    input_indx,
                    0.000, 0.100, 0.010,
                    X_cord, Y_cord)

    def RunScript(self,
        i_value_type: str,
        i_palette: str,
        i_upper_threshold: float,
        i_lower_threshold: float,
        i_legend_height: float,
        i_legend_width: float,
        i_legend_plane: rg.Plane,
        i_histogram_scale_factor: float):

        """
        Compiles all the visualization settings to feed to the visualization component

        :param i_value_type: selected type indicates Which values to display. Possible values: "dist", "RMSE", "MAX", "MIN", "STD"
        :param i_palette: Select a color palette to map the values to. Possible values: "Jet", "Rainbow", "RdPu", "Viridis"
        :param i_upper_threshold: Thresholds the values with a maximum value
        :param i_lower_threshold: Thresholds the values with a minimum value
        :param i_legend_height: the total height of the legend
        :param i_legend_width: the total width of the legend
        :param i_legend_plane: the construction plane of the legend
        :param i_histogram_scale_factor: Scales the height of the histogram with a factor

        :returns o_viz_settings: the results of the comparison all in one object
        """
        # set default values
        if i_value_type is not None:
            if i_value_type not in self.poss_value_types:
                ghenv.Component.AddRuntimeMessage(RML.Warning, "Possible values for i_value_type are: dist, RMSE, MAX, MIN, STD")
                return None
        else:
            i_value_type = "Dist"
        if i_palette is not None:
            if i_palette not in self.poss_palettes:
                ghenv.Component.AddRuntimeMessage(RML.Warning, "Possible values for i_palette are: Jet, Rainbow, RdPu, Viridis")
                return None
        else:
            i_palette = "Jet"
        if i_legend_height is None: i_legend_height = 10
        if i_legend_width is None: i_legend_width = 0.5
        if i_legend_plane is None: i_legend_plane = rg.Plane.WorldXY
        if i_histogram_scale_factor is None: i_histogram_scale_factor = 0.01

        # pack settings
        o_viz_settings = df_visualization.DFVizSettings(i_value_type,
                                                        i_upper_threshold,
                                                        i_lower_threshold,
                                                        i_palette,
                                                        i_legend_height,
                                                        i_legend_width,
                                                        i_legend_plane,
                                                        i_histogram_scale_factor)

        return o_viz_settings

# if __name__ == "__main__":
#     com = DFVisualizationSettings()
#     o_viz_settings = com.RunScript(
#         i_value_type,
#         i_palette,
#         i_upper_threshold,
#         i_lower_threshold,
#         i_legend_height,
#         i_legend_width,
#         i_legend_plane,
#         i_histogram_scale_factor
#         )
# ---------- end py3 ----------
brep = Brep([<brep referenced from the Rhino model> x4])
dft = DFTester()  # -> o_is_imported
#   port o_is_imported: True if the import of the diffCheck bindings is successfull.
# ---------- dft: Python ----------
#! python3

import System

import Rhino
import Rhino.Geometry as rg
from ghpythonlib.componentbase import executingcomponent as component

import Grasshopper as gh
from Grasshopper.Kernel import GH_RuntimeMessageLevel as RML

import diffCheck
from diffCheck import diffcheck_bindings

class DFTester(component):
    def RunScript(self):
        """
            The component test and import bind module for diffCheck.
        """
        ghenv.Component.Message = f"diffCheck v: {diffCheck.__version__}"
        is_binding_imported = diffcheck_bindings.dfb_test.test()

        if not is_binding_imported:
            ghenv.Component.AddRuntimeMessage(RML.Warning, "Bindings not imported.")
        else:
            ghenv.Component.AddRuntimeMessage(RML.Remark, "Bindings imported.")

        return is_binding_imported
# ---------- end dft ----------
dfbuildassembly = DFBuildAssembly(i_assembly_name="test_assembly", i_breps=brep)  # -> o_assembly; inputs i_breps: list of Brep
#   port i_assembly_name: The name of the assembly to export.
#   port i_breps: The breps of the structure.
#   port o_assembly: The create DFAssembly object representing the timber elements.
# ---------- dfbuildassembly: Python ----------
#! python3

import System
import typing

import Rhino
import Rhino.Geometry as rg
import scriptcontext as sc

from ghpythonlib.componentbase import executingcomponent as component

import diffCheck
from diffCheck.df_geometries import DFBeam, DFAssembly
import diffCheck.df_cvt_bindings

class DFBuildAssembly(component):
    def RunScript(self,
            i_assembly_name,
            i_breps : System.Collections.Generic.IList[Rhino.Geometry.Brep]):
        """
            This component parse a series of breps representing a timber structure or a 
            timber elements into a DFAssembly object.
            
            :param i_assembly_name: the name of the assembly
            :param i_breps: list of breps

            :return o_assembly: the DFAssembly object
        """
        beams: typing.List[DFBeam] = []
        for brep in i_breps:
            beam = DFBeam.from_brep_face(brep)
            beams.append(beam)

        o_assembly = DFAssembly(beams, i_assembly_name)

        return o_assembly


# if __name__ == "__main__":
#     comp = DFBuildAssembly()
#     o_assembly = comp.RunScript(
#         i_assembly_name,
#         i_breps
#     )
# ---------- end dfbuildassembly ----------
py3_2 = Python3Script()  # -> out, a
# ---------- py3_2: Python ----------
"""Grasshopper Script"""
import System
import Rhino
import Grasshopper

import rhinoscriptsyntax as rs

class MyComponent(Grasshopper.Kernel.GH_ScriptInstance):
    def RunScript(self, x, y):
        a = "Hello Python 3 in Grasshopper!"
        print(a)
        
        return

    # Solve overrides 
    def BeforeRunScript(self):
        pass

    def AfterRunScript(self):
        pass
# ---------- end py3_2 ----------
panel = Panel("diffCheck")  # disabled
button = Button()  # disabled
scsy_cpy = ScriptSyncCpython(select_file=button, package_2_reload=flatten(panel), i_assembly=dfbuildassembly)  # -> stdout, o_assembl_meshes, o_one_joints_beam; inputs select_file: Boolean, package_2_reload: String; disabled
#   port select_file: Connect a button to open a file dialog to select a cpython file to run.
#   port package_2_reload: Pass a list with the name of the custom packages you want to reload. This function is useful if you are developing a i.e. PyPI package and you want to reload the submodules after you modified something. The function will reload the package and all its submodules. If you want to reload the package and all its submodules, just pass the package name. If you want to reload only a submodule, pass the package name and the submodule name separated by a dot. If you want to reload multiple submodules, pass the package
#   port stdout: The redirected standard output of the component scriptsync.
#   port o_assembl_meshes: Generic example output of the component
# ---------- scsy_cpy: Python ----------
import System
import System.Drawing
import Rhino
import rhinoscriptsyntax as rs
import Grasshopper
import Grasshopper as gh
from Grasshopper.Kernel import GH_RuntimeMessageLevel as RML
import sys
import os
import time

import contextlib
import io

import abc
import socket
import threading
import queue
import json

import importlib
import sys

import traceback


class GHThread(threading.Thread, metaclass=abc.ABCMeta):
    """
        A base class for Grasshopper threads.
    """
    def __init__(self, name : str):
        super().__init__(name=name, daemon=False)
        self._component_on_canvas = True
        self._component_enabled = True

    @abc.abstractmethod
    def run(self):
        """ Run the thread. """
        pass

    def _check_if_component_on_canvas(self):
        """ Check if the component is on canvas from thread. """
        def __check_if_component_on_canvas():
            if ghenv.Component.OnPingDocument() is None:
                self._component_on_canvas = False
                return False
            else:
                self._component_on_canvas = True
                return True
        action = System.Action(__check_if_component_on_canvas)
        Rhino.RhinoApp.InvokeOnUiThread(action)

    def _check_if_component_enabled(self):
        """ Check if the component is enabled from thread. """
        def __check_if_component_enabled():
            if ghenv.Component.Locked:
                self._component_enabled = False
            else:
                self._component_enabled = True
        action = System.Action(__check_if_component_enabled)
        Rhino.RhinoApp.InvokeOnUiThread(action)

    def expire_component_solution(self):
        """ Fire the recalculation of the component solution from thread. """
        def __expire_component_solution():
            ghenv.Component.Params.Output[0].ClearData()  # clear the output
            ghenv.Component.ExpireSolution(True)  # expire the component
        action = System.Action(__expire_component_solution)
        Rhino.RhinoApp.InvokeOnUiThread(action)

    def clear_component(self):
        """ Clear the component from thread. """
        def __clear_component():
            ghenv.Component.ClearData()
        action = System.Action(__clear_component)
        Rhino.RhinoApp.InvokeOnUiThread(action)

    def add_runtime_warning(self, exception : str):
        """ Add a warning tab to the component from main thread. """
        action = System.Action(
            lambda: ghenv.Component.AddRuntimeMessage(RML.Warning, exception)
        )
        Rhino.RhinoApp.InvokeOnUiThread(action)

    def add_runtime_error(self, exception : str):
        """ Add an error tab to the component from main thread. """
        action = System.Action(
            lambda: ghenv.Component.AddRuntimeMessage(RML.Error, exception)
        )
        Rhino.RhinoApp.InvokeOnUiThread(action)

    def add_runtime_remark(self, exception : str):
        """ Add a blank tab to the component from main thread. """
        action = System.Action(
            lambda: ghenv.Component.AddRuntimeMessage(RML.Remark, exception)
        )
        Rhino.RhinoApp.InvokeOnUiThread(action)

    @property
    def component_enabled(self):
        self._check_if_component_enabled()
        return self._component_enabled

    @property
    def component_on_canvas(self):
        self._check_if_component_on_canvas()
        return self._component_on_canvas

class ClientThread(GHThread):
    """
    A thread to connect to the VSCode server.
    """
    def __init__(self, vscode_server_ip: str, vscode_server_port: int, name: str,
                 queue_msg: queue.Queue = None, lock_queue_msg: threading.Lock = None,
                 event_fire_msg: threading.Event = None):
        super().__init__(name=name)
        self.vscode_server_ip = vscode_server_ip
        self.vscode_server_port = vscode_server_port
        self.is_connected = False
        self.connect_refresh_rate = 1  # seconds
        self.queue_msg = queue_msg
        self.lock_queue_msg = lock_queue_msg
        self.event_fire_msg = event_fire_msg
        self.client_socket = socket.socket(socket.AF_INET, socket.SOCK_STREAM)

    def run(self):
        """ Run the thread. Send the message to the vscode server."""
        while self.component_on_canvas and self.component_enabled:
            try:
                if not self.is_connected:
                    self.connect_to_vscode_server()
                    self.clear_component()
                    self.expire_component_solution()
                    continue

                self.event_fire_msg.wait()
                self.send_message_from_queue()

            except Exception as e:
                self.add_runtime_warning(f"script-sync::Unkown error from run: {str(e)}")
                self.is_connected = False
                self.client_socket = socket.socket(socket.AF_INET, socket.SOCK_STREAM)

        self.client_socket.close()

    def send_message_from_queue(self):
        with self.lock_queue_msg:
            if self.queue_msg and not self.queue_msg.empty():
                msg = self.queue_msg.get()
                self.queue_msg.task_done()
                self.event_fire_msg.set()
                self.event_fire_msg.clear()
                self.client_socket.send(msg)

    def connect_to_vscode_server(self):
        """ Connect to the VSCode server. """
        while self.component_on_canvas and not self.is_connected:
            try:
                self.client_socket.send(b"")
                self.is_connected = True
            except socket.error:
                try:
                    self.client_socket.connect((self.vscode_server_ip, self.vscode_server_port))
                    self.is_connected = True
                except (ConnectionRefusedError, ConnectionResetError, socket.error) as e:
                    self.handle_connection_error(e)
            finally:
                time.sleep(self.connect_refresh_rate)

    def handle_connection_error(self, e):
        error_messages = {
            ConnectionRefusedError: "script-sync::Connection refused by the vscode",
            ConnectionResetError: "script-sync::Connection was forcibly closed by the vscode",
            socket.error: f"script-sync::Error connecting to the vscode: {str(e)}, have you tried to press Shift+F4 on VSCode?"
        }
        self.add_runtime_warning(error_messages[type(e)])
        self.is_connected = False if type(e) != socket.error or e.winerror != 10056 else True

class FileChangedThread(GHThread):
    """
        A thread to check if the file has changed on disk.
    """
    def __init__(self,
                path : str,
                name : str
                ):
        super().__init__(name=name)
        self.path = path
        self.refresh_rate = 1000  # milliseconds
        self._on_file_changed = threading.Event()

    def run(self):
        """
            Check if the file has changed on disk.
        """
        last_modified = os.path.getmtime(self.path)
        while self.component_on_canvas and not self._on_file_changed.is_set():
            System.Threading.Thread.Sleep(self.refresh_rate)
            last_modified = self.is_file_modified(last_modified)
        self._on_file_changed.clear()
        return

    def stop(self):
        """ Stop the thread. """
        self._on_file_changed.set()

    def is_file_modified(self, last_modified):
        current_modified = os.path.getmtime(self.path)
        if current_modified != last_modified:
            self.expire_component_solution()
            return current_modified
        return last_modified

class ScriptSyncCPy(Grasshopper.Kernel.GH_ScriptInstance):
    def __init__(self):
        self._var_output = []

        self.is_success = False

        self.client_thread_name : str = f"script-sync-client-thread::{ghenv.Component.InstanceGuid}"
        self.vscode_server_ip = "127.0.0.1"
        self.vscode_server_port = 58260
        self.stdout = None
        self.queue_msg = queue.Queue()
        self.queue_msg_lock = threading.Lock()
        self.event_fire_msg = threading.Event()

        self.filechanged_thread_name : str = f"script-sync-fileChanged-thread::{ghenv.Component.InstanceGuid}"
        self.__path_name_table_value = "script-sync::" + "path::" + str(ghenv.Component.InstanceGuid)
        if self.path is None:
            ghenv.Component.Message = "select-script"

    def RemovedFromDocument(self, doc):
        """ Remove the component from the document. """
        if self.client_thread_name in [t.name for t in threading.enumerate()]:
            client_thread = [t for t in threading.enumerate() if t.name == self.client_thread_name][0]
            client_thread.join()
        if self.filechanged_thread_name in [t.name for t in threading.enumerate()]:
            filechanged_thread = [t for t in threading.enumerate() if t.name == self.filechanged_thread_name][0]
            filechanged_thread.join()
        if self.queue_msg is not None:
            self.queue_msg.join()
        if self.queue_msg_lock is not None:
            self.queue_msg_lock.release()
        if self.event_fire_msg is not None:
            self.event_fire_msg.clear()

        # clear the path from the table view
        del self.path

    def init_script_path(self, select_file : bool = False):
        """
            Check if the button is pressed and load/change path script.
            
            :param select_file: A boolean of the button
        """
        # check if button is pressed
        if select_file is True:
            filename = rs.OpenFileName("Open", "Python Files (*.py)|*.py||")
            if filename is None:
                raise Exception("script-sync::No file selected")
            self.path = filename

        # fi file is in table view before
        if not os.path.exists(self.path):
            raise Exception("script-sync::File does not exist")
    
    def reload_all_modules(self, directory):
        for filename in os.listdir(directory):
            if filename.endswith('.py') and filename != '__init__.py':
                module_name = filename[:-3]  # remove '.py' from filename
                if module_name in sys.modules:
                    importlib.reload(sys.modules[module_name])

    def safe_exec(self, path, globals, locals, package_2_reload):
        """
            Execute Python3 code safely. It redirects the output of the code
            to a string buffer 'stdout' to output to the GH component param.
            It is send to the vscode server.
            
            :param path: The path of the file to execute.
            :param globals: The globals dictionary.
            :param locals: The locals dictionary.
            :param package_2_reload: The list of packages to reload, this is used for custom packages developement.
            installed on the system via an editable pip installation for example.
        """
        output_buffer = io.StringIO()
        original_stdout = sys.stdout  # Save a reference to the original stdout
        sys.stdout = output_buffer
        try:
            sys.stdout = output_buffer
            with open(path, 'r') as f:
                # reload the specifyed packages
                if package_2_reload is not None:
                    if package_2_reload.__len__() != 0:
                        for key in list(sys.modules.keys()):
                            if package_2_reload in key:
                                # check that the package must have the attribute __file__ (to avoid reloading pyd)
                                if hasattr(sys.modules[key], '__file__') or hasattr(sys.modules[key], '__path__'):
                                    importlib.reload(sys.modules[key])

                # add the path and sub directories to  the sys path
                path_dir = os.path.dirname(path)
                sub_dirs = []
                for root, dirs, files in os.walk(path_dir):
                    for d in dirs:
                        sub_dirs.append(os.path.join(root, d))
                sys.path.extend([path_dir] + sub_dirs)

                # reload all the modules also of the sub directories
                for root, dirs, files in os.walk(path_dir):
                    for d in dirs:
                        self.reload_all_modules(os.path.join(root, d))
                self.reload_all_modules(path_dir)

                # refresh the python interpreter
                importlib.invalidate_caches()

                # parse the code
                code = compile(f.read(), path, 'exec')
                # output = io.StringIO()

                # empty the queue and event
                with self.queue_msg_lock:
                    while not self.queue_msg.empty():
                        self.queue_msg.get()
                        self.queue_msg.task_done()
                self.event_fire_msg.clear()

                # clear all the locals dictionary to avoid that the output variables stick between the component
                # executions when it is recomputed
                outparam = ghenv.Component.Params.Output
                outparam_names = [p.NickName for p in outparam]
                for outp in outparam_names:
                    if outp in locals.keys():
                        del locals[outp]

                # execute the code
                with contextlib.redirect_stdout(output_buffer):
                    exec(code, globals, locals)
                locals["stdout"] = output_buffer.getvalue()

                # send the msg to the vscode server
                msg_json = json.dumps({"script_path": path,
                                       "guid": str(ghenv.Component.InstanceGuid),
                                       "msg": output_buffer.getvalue()})
                msg_json = msg_json.encode('utf-8')
                self.queue_msg.put(msg_json)
                self.event_fire_msg.set()

                # pass the script variables to the GH component outputs
                for outp in outparam_names:
                    if outp in locals.keys():
                        self._var_output.append(locals[outp])
                    else:
                        self._var_output.append(None)
            return locals

        except Exception as e:
            tb = traceback.format_exc()

            # Send the error message to the vscode server
            err_json = json.dumps({
                "script_path": path,
                "guid": str(ghenv.Component.InstanceGuid),
                "msg": "err:" + str(e),
                "traceback": tb  # Include the traceback in the JSON
            })
            err_json = err_json.encode('utf-8')
            self.queue_msg.put(err_json)
            self.event_fire_msg.set()

            # FIXME: this is not working the retrival of the previous messages
            # for debugging purposes we include the prints before and the error message
            err_msg_header = f"script-sync::Error in the code file {path}"
            err_msg_sep = ">" * 30
            err_msg = f"script-sync::Error in the code: {str(e)}\n{tb}"
            prints_before_err_msg = output_buffer.getvalue()
            prints_before_msg = prints_before_err_msg.split("\n")
            err_msg = err_msg_header + \
                f"\n{err_msg_sep}\n" + "Error msg:" + f"\n{err_msg_sep}\n" + \
                err_msg + \
                f"\n{err_msg_sep}\n" + "Preavious prints before error:" + f"\n{err_msg_sep}\n" + \
                "\n".join(prints_before_msg[:-1])

            raise Exception(err_msg)
        
        finally:
            sys.stdout = original_stdout
            output_buffer.close()

    def RunScript(self, select_file: bool, package_2_reload: str, i_assembly):
        """ This method is called whenever the component has to be recalculated it's the solve main instance. """
        self.is_success = False

        # set the path if button is pressed
        self.init_script_path(select_file)

        # file change listener thread
        if self.filechanged_thread_name not in [t.name for t in threading.enumerate()]:
            FileChangedThread(self.path,
                              self.filechanged_thread_name
                              ).start()

        # set up the tcp client to connect to the vscode server
        _ = [print(t.name) for t in threading.enumerate()]
        if self.client_thread_name not in [t.name for t in threading.enumerate()]:
            ClientThread(self.vscode_server_ip,
                        self.vscode_server_port,
                        self.client_thread_name,
                        self.queue_msg,
                        self.queue_msg_lock,
                        self.event_fire_msg
                        ).start()

        # print all the locals
        print(locals())

        # add to the globals all the input parameters of the component (the locals)
        globals().update(locals())

        res = self.safe_exec(self.path, None, globals(), package_2_reload)
        self.is_success = True
        return

    def is_nested_iterable(self, lst):
        """ Detect if a list is nested. """
        return any(isinstance(i, list) for i in lst)

    def AfterRunScript(self):
        """
            This method is called as soon as the component has finished
            its calculation. It is used to load the GHComponent outputs
            with the values created in the script.
        """
        if not self.is_success:
            return

        outparam = [p for p in ghenv.Component.Params.Output]
        outparam_names = [p.NickName for p in outparam]

        for idx, outp in enumerate(outparam):
            # detect if the output is a list
            if type(self._var_output[idx]) == tuple:
                ghenv.Component.Params.Output[idx].VolatileData.Clear()
                ghenv.Component.Params.Output[idx].AddVolatileDataList(gh.Kernel.Data.GH_Path(0), self._var_output[idx])
            # TODO: increase the number of nested lists they can be handles (max 2 deep for now)
            elif type(self._var_output[idx]) == list:
                ghenv.Component.Params.Output[idx].VolatileData.Clear()
                if self.is_nested_iterable(self._var_output[idx]):
                    nbr_lists_aka_branches = len(self._var_output[idx])
                    for i in range(nbr_lists_aka_branches):
                        ghenv.Component.Params.Output[idx].AddVolatileDataList(gh.Kernel.Data.GH_Path(i), self._var_output[idx][i])
                else:
                    ghenv.Component.Params.Output[idx].AddVolatileDataList(gh.Kernel.Data.GH_Path(0), self._var_output[idx])
            else:
                ghenv.Component.Params.Output[idx].VolatileData.Clear()
                ghenv.Component.Params.Output[idx].AddVolatileData(gh.Kernel.Data.GH_Path(0), 0, self._var_output[idx])
        self._var_output.clear()

    @property
    def path(self):
        """ Get the path of the file from the table view to be sticking between the sessions. """
        table_value = ghenv.Component.OnPingDocument().ValueTable.GetValue(
            self.__path_name_table_value, "not_found"
        )
        if table_value != "not_found":
            return table_value
        else:
            return None

    @path.setter
    def path(self, path : str):
        """ Set the path of the file to the table view to be sticking between the sessions. """
        ghenv.Component.OnPingDocument().ValueTable.SetValue(self.__path_name_table_value, path)

        script_name = os.path.basename(path)
        ghenv.Component.Message = f"{script_name}"

        if self.filechanged_thread_name in [t.name for t in threading.enumerate()]:
            _ = [t for t in threading.enumerate() if t.name == self.filechanged_thread_name][0].stop()

    @path.deleter
    def path(self):
        """ Delete the path of the file from the table view if the object is erased. """
        ghenv.Component.OnPingDocument().ValueTable.DeleteValue(self.__path_name_table_value)
# ---------- end scsy_cpy ----------
nicknametest = ValueList({"Dist", "RMSE", "MAX", "MIN", "STD"}, selected="Dist")  # disabled
panel_2 = Panel(scsy_cpy.o_one_joints_beam)  # disabled
panel_3 = Panel(scsy_cpy.o_assembl_meshes)  # disabled
